# Grasshopper definition bracket.gh (Grasshopper 1.0.7)
# plug-ins: Human

pipeline = GeometryPipeline(
    GroupByLayer=False,
    GroupByType=False,
    IncludeHidden=True,
    IncludeLocked=True,
    LayerFilter="*",
    NameFilter="*",
    SublayerFiltering=True,
    TypeFilter=1)
pt = Point(pipeline)
srf = Surface(<surface referenced from the Rhino model>)
plfit = PlaneFit(Points=pt)  # -> Plane, Deviation
edges = BrepEdges(Brep=srf)  # -> Naked, Interior, NonManifold
hull = ConvexHull(Points=pt, Plane=plfit.Plane)  # -> Hull, HullZ, Indices
join = JoinCurves(Curves=edges.Naked, Preserve=False)
neg = Negative(Value=Slider(5, range=0..10))
offset = OffsetCurve(Curve=hull.Hull, Distance=Slider(3, range=0..10), Corners=1)
offset_2 = OffsetCurve(Curve=join, Distance=neg, Corners=1)

neg_2 = Negative(Value=Slider(7, range=0..10))
offset_3 = OffsetCurve(Curve=offset_2, Distance=neg_2, Corners=1)
cp = ControlPoints(Curve=offset_3)  # -> Points, Weights, Knots
cullpt = CullDuplicates(Points=cp.Points, Tolerance=0.1, CullMode=3)  # -> Points, Indices, Valence

cp_2 = ControlPoints(Curve=offset)  # -> Points, Weights, Knots
cp_3 = ControlPoints(Curve=offset_2)  # -> Points, Weights, Knots
cullpt_2 = CullDuplicates(Points=cp_2.Points, Tolerance=0.1, CullMode=3)  # -> Points, Indices, Valence
cullpt_3 = CullDuplicates(Points=cp_3.Points, Tolerance=0.1, CullMode=3)  # -> Points, Indices, Valence
plfit_2 = PlaneFit(Points=cullpt_3.Points)  # -> Plane, Deviation
circle = CircleCNR(Center=cullpt.Points, Normal=plfit_2.Plane, Radius=Slider(2.3, range=0..10))

previewlw = CustomPreviewLineweights(Geometry=circle, Shader=ColourSwatch(SwatchColor=RGB(0, 0, 0)), Thickness=Slider(2, range=0..10), Absolute=False)

circle_2 = CircleCNR(Center=pt, Normal=plfit.Plane, Radius=Slider(1, range=0..10))

previewlw_2 = CustomPreviewLineweights(Geometry=circle_2, Shader=ColourSwatch(SwatchColor=RGB(0, 0, 0)), Thickness=Slider(2, range=0..10), Absolute=False)

merge = Merge(Data1=flatten(cullpt_2.Points), Data2=flatten(cullpt_3.Points))
ppx = PlanePlane(PlaneA=plfit.Plane, PlaneB=plfit_2.Plane)
python = GhPythonScript(pts=merge, line=ppx)  # -> out, pt_1, pt_2; inputs pts: list of Point3d, line: Line
# ---------- python: Python ----------
import Rhino.Geometry as rh

all_ps = []

for pt in pts:
    cp = line.ClosestParameter(pt)
    all_ps.append(cp)

all_ps.sort()

pt_1 = line.PointAt(all_ps[0])
pt_2 = line.PointAt(all_ps[-1])
# ---------- end python ----------

panel = Panel("""3
3""")
ln = Line(StartPoint=python.pt_1, EndPoint=python.pt_2)
dash = DashPattern(Curve=ln, Pattern=panel)  # -> Dashes, Gaps
previewlw_3 = CustomPreviewLineweights(Geometry=dash.Dashes, Shader=ColourSwatch(SwatchColor=RGB(0, 0, 0)), Thickness=Slider(3, range=0..10), Absolute=False)

merge_2 = Merge(Data1=flatten(python.pt_1), Data2=flatten(python.pt_2))
merge_3 = Merge(Data1=flatten(cullpt_2.Points), Data2=flatten(merge_2))
merge_4 = Merge(Data1=flatten(merge_2), Data2=flatten(cullpt_3.Points))
hull_2 = ConvexHull(Points=merge_3, Plane=plfit.Plane)  # -> Hull, HullZ, Indices
hull_3 = ConvexHull(Points=merge_4, Plane=plfit_2.Plane)  # -> Hull, HullZ, Indices
boundary = BoundarySurfaces(Edges=hull_2.Hull)
boundary_2 = BoundarySurfaces(Edges=hull_3.Hull)
merge_5 = Merge(Data1=flatten(boundary), Data2=flatten(boundary_2))
join_2 = BrepJoin(Breps=merge_5)  # -> Breps, Closed

edges_2 = BrepEdges(Brep=join_2.Breps)  # -> Naked, Interior, NonManifold
previewlw_4 = CustomPreviewLineweights(Geometry=edges_2.Naked, Shader=ColourSwatch(SwatchColor=RGB(0, 0, 0)), Thickness=Slider(2, range=0..10), Absolute=False)
