# Grasshopper definition bracket_2.gh (Grasshopper 1.0.8)
# plug-ins: MeshEdit Components, Human

# ---- group: Materials
py3 = Python3Script(csv_filename="materials.csv")  # -> out, materials, properties
# ---------- py3: Python ----------
import os, sys, re
import csv

def clean_header(header: str) -> str:
    """Remove units in square brackets, e.g. '[MPa]'."""
    return re.sub(r"\s*\[.*?\]", "", header).strip()

def load_csv_as_dict(path_to_csv: str):
    """
    Load a CSV and return a dictionary keyed by the first column.
    Each value is a dict of header -> cell_value for that row.
    """

    if not os.path.isfile(path_to_csv):
        raise FileNotFoundError(f"CSV file not found: {path_to_csv}")

    data_dict = {}

    with open(path_to_csv, newline='', encoding="utf-8") as f:
        reader = csv.reader(f)

        # Read and clean headers
        raw_headers = next(reader)
        headers = [clean_header(h) for h in raw_headers]

        # Use new headers in DictReader
        f.seek(0)
        dict_reader = csv.DictReader(f, fieldnames=headers)
        next(dict_reader)  # skip original header row

        first_col = headers[0]

        for row in dict_reader:
            key = row[first_col]
            data_dict[key] = row.copy()

    return data_dict

# ----------------------------------------------------------------------
# 1. Make sure the folder containing this .gh file is on sys.path
# ----------------------------------------------------------------------
gh_path = ghdoc.Path  # full path to the current Grasshopper file
if gh_path:
    gh_dir = os.path.dirname(gh_path)
    parent_dir = os.path.dirname(gh_dir)   # /path/to/parent/folder

    csv_path = os.path.join(parent_dir, csv_filename)

    material_dictionary = load_csv_as_dict(csv_path)
    materials = list(material_dictionary.keys())
    properties = list(material_dictionary[materials[0]].keys())
# ---------- end py3 ----------
panel = Panel(py3.materials)
panel_2 = Panel(py3.properties)

# ----
number_slider = Slider(7.1, range=0..10)

# ---- group: Get Part A Plane
brep = Brep(<brep referenced from the Rhino model>)
mesh = MeshBrep(
    Brep=brep,
    Settings={GridMaxCount=0, GridMinCount=16, JaggedSeams=False, MaxEdgeLength=0, MinEdgeLength=0.0001, MinTolerance=0, Refine=True, RefineAngle=0, RelativeTolerance=0.65, SimplePlanes=True, Tolerance=0})
demesh = DeconstructMesh(Mesh=mesh)  # -> Vertices, Faces, Colours, Normals
volume = MeshVolume(Mesh=mesh)  # -> Volume, Centroid
deface = DeconstructFace(Face=demesh.Faces)  # -> CornerA, CornerB, CornerC, CornerD
item = ListItem(List=demesh.Vertices, Index=deface.CornerB, Wrap=True)  # -> graft(Item)
item_2 = ListItem(List=demesh.Vertices, Index=deface.CornerA, Wrap=True)  # -> graft(Item)
item_3 = ListItem(List=demesh.Vertices, Index=deface.CornerC, Wrap=True)  # -> graft(Item)
item_4 = ListItem(List=demesh.Vertices, Index=deface.CornerD, Wrap=True)  # -> graft(Item)
merge = Merge(Data1=item_2, Data2=item, Data3=item_3, Data4=item_4)
path = ConstructPath(Indices=Slider(1, range=0..10))
branch = TreeBranch(Tree=simplify(merge), Path=path, MaintainPaths=True)
swatch = ColourSwatch(SwatchColor=RGBA(204, 0, 255, 0))
pline = PolyLine(Vertices=branch, Closed=Toggle(True))
boundary = BoundarySurfaces(Edges=pline)
item_5 = ListItem(List=branch, Index="-1", Wrap=True)
item_6 = ListItem(List=branch, Index=0, Wrap=True)
item_7 = ListItem(List=branch, Index="1", Wrap=True)
previewlw = CustomPreviewLineweights(Geometry=pline, Shader=swatch, Thickness=number_slider, Absolute=False)
preview = CustomPreview(Geometry=boundary, Material=swatch)
pl_3pt = Plane3Pt(PointA=item_6, PointB=item_7, PointC=item_5)

# ---- group: Get Part B Plane
brep_2 = Brep(<brep referenced from the Rhino model>)
mesh_2 = MeshBrep(
    Brep=brep_2,
    Settings={GridMaxCount=0, GridMinCount=16, JaggedSeams=False, MaxEdgeLength=0, MinEdgeLength=0.0001, MinTolerance=0, Refine=True, RefineAngle=0, RelativeTolerance=0.65, SimplePlanes=True, Tolerance=0})
demesh_2 = DeconstructMesh(Mesh=mesh_2)  # -> Vertices, Faces, Colours, Normals
deface_2 = DeconstructFace(Face=demesh_2.Faces)  # -> CornerA, CornerB, CornerC, CornerD
item_8 = ListItem(List=demesh_2.Vertices, Index=deface_2.CornerB, Wrap=True)  # -> graft(Item)
item_9 = ListItem(List=demesh_2.Vertices, Index=deface_2.CornerA, Wrap=True)  # -> graft(Item)
item_10 = ListItem(List=demesh_2.Vertices, Index=deface_2.CornerC, Wrap=True)  # -> graft(Item)
item_11 = ListItem(List=demesh_2.Vertices, Index=deface_2.CornerD, Wrap=True)  # -> graft(Item)
merge_2 = Merge(Data1=item_9, Data2=item_8, Data3=item_10, Data4=item_11)
path_2 = ConstructPath(Indices=Slider(5, range=0..10))
branch_2 = TreeBranch(Tree=simplify(merge_2), Path=path_2, MaintainPaths=True)
swatch_2 = ColourSwatch(SwatchColor=RGBA(61, 196, 190, 37))
pline_2 = PolyLine(Vertices=branch_2, Closed=Toggle(True))
boundary_2 = BoundarySurfaces(Edges=pline_2)
item_12 = ListItem(List=branch_2, Index="-1", Wrap=True)
item_13 = ListItem(List=branch_2, Index=0, Wrap=True)
item_14 = ListItem(List=branch_2, Index="1", Wrap=True)
preview_2 = CustomPreview(Geometry=boundary_2, Material=swatch_2)
previewlw_2 = CustomPreviewLineweights(Geometry=pline_2, Shader=swatch_2, Thickness=number_slider, Absolute=False)
pl_3pt_2 = Plane3Pt(PointA=item_13, PointB=item_14, PointC=item_12)

# ----
merge_3 = Merge(Data1=brep, Data2=brep_2)
preview_3 = CustomPreview(Geometry=merge_3, Material=ColourSwatch(SwatchColor=RGBA(122, 122, 122, 92)))
ppx = PlanePlane(PlaneA=pl_3pt, PlaneB=pl_3pt_2)

# ---- group: Get max hinge line
py3_2 = Python3Script(line=ppx, points=branch)  # -> out, params; inputs line: Line, points: list of Point3d
# ---------- py3_2: Python ----------
import Rhino.Geometry as rh

params = [line.ClosestParameter(pt) for pt in points]
print(params)
# ---------- end py3_2 ----------
py3_3 = Python3Script(line=ppx, points=branch_2)  # -> out, params; inputs line: Line, points: list of Point3d; same code as py3_2
merge_4 = Merge(Data1=flatten(py3_2.params), Data2=flatten(py3_3.params))
sort = SortList(Keys=merge_4)  # -> Keys, ValuesA
item_15 = ListItem(List=reverse(sort.Keys), Index=0, Wrap=True)
item_16 = ListItem(List=sort.Keys, Index=0, Wrap=True)
eval = EvaluateCurve(Curve=ppx, Parameter=item_16)  # -> Point, Tangent, Angle
eval_2 = EvaluateCurve(Curve=ppx, Parameter=item_15)  # -> Point, Tangent, Angle
ln = Line(StartPoint=eval.Point, EndPoint=eval_2.Point)

# ----
eval_3 = EvaluateCurve(Curve=ppx, Parameter=py3_3.params)  # -> Point, Tangent, Angle
dist = Distance(PointA=branch_2, PointB=eval_3.Point)
ln_2 = Line(StartPoint=eval_3.Point, EndPoint=branch_2)
sort_2 = SortList(Keys=dist, ValuesA=ln_2)  # -> Keys, ValuesA
item_17 = ListItem(List=reverse(sort_2.ValuesA), Index=0, Wrap=True)
vec = Vector(item_17)
end = EndPoints(Curve=item_17)  # -> Start, End
scale = Scale(Geometry=item_17, Center=end.Start, Factor=Slider(1.1, range=0..10))  # -> Geometry, Transform

eval_4 = EvaluateCurve(Curve=ppx, Parameter=py3_2.params)  # -> Point, Tangent, Angle
dist_2 = Distance(PointA=branch, PointB=eval_4.Point)
ln_3 = Line(StartPoint=eval_4.Point, EndPoint=branch)
sort_3 = SortList(Keys=dist_2, ValuesA=ln_3)  # -> Keys, ValuesA
item_18 = ListItem(List=reverse(sort_3.ValuesA), Index=0, Wrap=True)
vec_2 = Vector(item_18)
end_2 = EndPoints(Curve=item_18)  # -> Start, End
scale_2 = Scale(Geometry=item_18, Center=end_2.Start, Factor=Slider(1.1, range=0..10))  # -> Geometry, Transform

# ---- group: min bracket extension to first fixture
number_slider_2 = Slider(212, range=0..500)

# ----
unit = UnitVector(Vector=vec_2)
rev = Reverse(Vector=unit)
amp = Amplitude(Vector=rev, Amplitude=number_slider_2)

extr = Extrude(Base=ln, Direction=vec_2)
extr_2 = Extrude(Base=ln, Direction=vec)
merge_5 = Merge(Data1=extr, Data2=extr_2)
join = BrepJoin(Breps=merge_5)  # -> Breps, Closed
preview_4 = CustomPreview(Geometry=join.Breps, Material=ColourSwatch(SwatchColor=RGBA(76, 82, 107, 49)))

move = Move(Geometry=pline, Motion=amp)  # -> Geometry, Transform
number_slider_3 = Slider(0.01, range=0..0.1)
unit_2 = UnitVector(Vector=vec)
rev_2 = Reverse(Vector=unit_2)
amp_2 = Amplitude(Vector=rev_2, Amplitude=number_slider_2)
move_2 = Move(Geometry=pline_2, Motion=amp_2)  # -> Geometry, Transform
py3_4 = Python3Script(line=ln, poly_1=move.Geometry, poly_2=move_2.Geometry, plane_1=pl_3pt, plane_2=pl_3pt_2, tol=number_slider_3)  # -> out, placement_edge, mid; inputs line: Line, poly_1: Polyline, poly_2: Polyline, plane_1: Plane, plane_2: Plane
# ---------- py3_4: Python ----------
from typing import List, Tuple

Interval = Tuple[float, float]

def find_overlapping_regions(a: List[Interval], b: List[Interval]) -> List[Interval]:
    """
    Given two sets of intervals `a` and `b`, return all overlapping regions.
    
    Intervals are treated as half-open: [start, end).
    So two intervals [s1, e1) and [s2, e2) overlap if max(s1, s2) < min(e1, e2).
    
    Parameters
    ----------
    a : List[Interval]
        First list of intervals as (start, end).
    b : List[Interval]
        Second list of intervals as (start, end).
    
    Returns
    -------
    List[Interval]
        List of overlapping intervals as (start, end).
    """
    # Sort both lists by start time
    a_sorted = sorted(a, key=lambda x: x[0])
    b_sorted = sorted(b, key=lambda x: x[0])
    
    i = j = 0
    overlaps: List[Interval] = []
    
    while i < len(a_sorted) and j < len(b_sorted):
        a_start, a_end = a_sorted[i]
        b_start, b_end = b_sorted[j]
        
        # Compute overlap between a[i] and b[j]
        start = max(a_start, b_start)
        end = min(a_end, b_end)
        
        # If they actually overlap, record it
        if start < end:  # use <= if you want closed intervals [start, end]
            overlaps.append((start, end))
        
        # Move the pointer that ends first
        if a_end < b_end:
            i += 1
        else:
            j += 1
    
    return overlaps

import Rhino.Geometry as rh

intervals = []

for poly_index, poly in enumerate([poly_1, poly_2]):

    poly_pts = list(poly.ToArray())

    params = [0.0, 1.0]

    for index, pt_1 in enumerate(poly_pts[:-1]):
        poly_edge = rh.Line(pt_1, poly_pts[index + 1])
        success, p1, p2 = rh.Intersect.Intersection.LineLine(line, poly_edge)

        if p2 > -0.01 and p2 < 1.01: # intersection within poly edge
            if p1 > -0.01 and p1 < 1.01:
                params.append(p1)

    # tol = 0.3

    final_params = []

    for param in params:
        found = False
        for final_param in final_params:
            if abs(param - final_param) < tol:
                found = True
                break
        if not found:
            final_params.append(param)

    final_params.sort()

    # print(final_params)

    intervals.append([])

    plane = [plane_1, plane_2][poly_index]

    for int_num in range(len(final_params)-1):
        mid = (final_params[int_num] + final_params[int_num + 1]) / 2
        mid_pt = line.PointAt(mid)

        contains = poly.ToNurbsCurve().Contains(mid_pt, plane, tol)

        if contains == rh.PointContainment.Inside:
            intervals[-1].append((final_params[int_num], final_params[int_num + 1]))

print(intervals)

overlaps = find_overlapping_regions(intervals[0], intervals[1])

print(overlaps)

mids = [line.PointAt((overlap[0] + overlap[1]) / 2) for overlap in overlaps]

placement_edge = rh.Line(line.PointAt(overlaps[0][0]), line.PointAt(overlaps[0][1]))
mid = mids[0]
# ---------- end py3_4 ----------
end_3 = EndPoints(Curve=py3_4.placement_edge)  # -> Start, End
vec_3 = Vector(ln)

# ---- group: Part B placement area
vec2pt = Vector2Pt(PointA=end.Start, PointB=end_3.Start, Unitize=False)  # -> Vector, Length
vec2pt_2 = Vector2Pt(PointA=end.Start, PointB=end_3.End, Unitize=False)  # -> Vector, Length
move_3 = Move(Geometry=scale.Geometry, Motion=vec2pt.Vector)  # -> Geometry, Transform
move_4 = Move(Geometry=scale.Geometry, Motion=vec2pt_2.Vector)  # -> Geometry, Transform
clx = CurveLine(Curve=pline_2, Line=move_4.Geometry)  # -> Points, Params, Count
ccx = CurveCurve(CurveA=pline_2, CurveB=move_4.Geometry)  # -> Points, ParamsA, ParamsB
clx_2 = CurveLine(Curve=pline_2, Line=move_3.Geometry)  # -> Points, Params, Count
ccx_2 = CurveCurve(CurveA=pline_2, CurveB=move_3.Geometry)  # -> Points, ParamsA, ParamsB
sort_4 = SortList(Keys=ccx.ParamsB, ValuesA=ccx.Points)  # -> Keys, ValuesA
sort_5 = SortList(Keys=ccx_2.ParamsB, ValuesA=ccx_2.Points)  # -> Keys, ValuesA
item_19 = ListItem(List=reverse(sort_4.ValuesA), Index=0, Wrap=True)
item_20 = ListItem(List=reverse(sort_4.Keys), Index=0, Wrap=True)
item_21 = ListItem(List=reverse(sort_5.ValuesA), Index=0, Wrap=True)
item_22 = ListItem(List=reverse(sort_5.Keys), Index=0, Wrap=True)
merge_6 = Merge(Data1=item_21, Data2=item_19)
merge_7 = Merge(Data1=item_22, Data2=item_20)
sort_6 = SortList(Keys=merge_7, ValuesA=merge_6)  # -> Keys, ValuesA
item_23 = ListItem(List=sort_6.ValuesA, Index=0, Wrap=True)
py3_5 = Python3Script(line=ppx, points=item_23)  # -> out, params; inputs line: Line, points: list of Point3d; same code as py3_2
eval_5 = EvaluateCurve(Curve=ppx, Parameter=py3_5.params)  # -> Point, Tangent, Angle
vec2pt_3 = Vector2Pt(PointA=eval_5.Point, PointB=item_23, Unitize=False)  # -> Vector, Length
extr_3 = Extrude(Base=py3_4.placement_edge, Direction=vec2pt_3.Vector)

# ---- group: Part A placement area
vec2pt_4 = Vector2Pt(PointA=end_2.Start, PointB=end_3.Start, Unitize=False)  # -> Vector, Length
vec2pt_5 = Vector2Pt(PointA=end_2.Start, PointB=end_3.End, Unitize=False)  # -> Vector, Length
move_5 = Move(Geometry=scale_2.Geometry, Motion=vec2pt_5.Vector)  # -> Geometry, Transform
move_6 = Move(Geometry=scale_2.Geometry, Motion=vec2pt_4.Vector)  # -> Geometry, Transform
ccx_3 = CurveCurve(CurveA=pline, CurveB=move_5.Geometry)  # -> Points, ParamsA, ParamsB
ccx_4 = CurveCurve(CurveA=pline, CurveB=move_6.Geometry)  # -> Points, ParamsA, ParamsB
sort_7 = SortList(Keys=ccx_4.ParamsB, ValuesA=ccx_4.Points)  # -> Keys, ValuesA
sort_8 = SortList(Keys=ccx_3.ParamsB, ValuesA=ccx_3.Points)  # -> Keys, ValuesA
item_24 = ListItem(List=reverse(sort_8.ValuesA), Index=0, Wrap=True)
item_25 = ListItem(List=reverse(sort_8.Keys), Index=0, Wrap=True)
item_26 = ListItem(List=reverse(sort_7.ValuesA), Index=0, Wrap=True)
item_27 = ListItem(List=reverse(sort_7.Keys), Index=0, Wrap=True)
merge_8 = Merge(Data1=item_26, Data2=item_24)
merge_9 = Merge(Data1=item_27, Data2=item_25)
sort_9 = SortList(Keys=merge_9, ValuesA=merge_8)  # -> Keys, ValuesA
item_28 = ListItem(List=sort_9.ValuesA, Index=0, Wrap=True)
py3_6 = Python3Script(line=ppx, points=item_28)  # -> out, params; inputs line: Line, points: list of Point3d; same code as py3_2
eval_6 = EvaluateCurve(Curve=ppx, Parameter=py3_6.params)  # -> Point, Tangent, Angle
vec2pt_6 = Vector2Pt(PointA=eval_6.Point, PointB=item_28, Unitize=False)  # -> Vector, Length
extr_4 = Extrude(Base=py3_4.placement_edge, Direction=vec2pt_6.Vector)

# ----
ln_4 = Line(StartPoint=eval_6.Point, EndPoint=item_28)

# ---- group: max bolt dia
number_slider_4 = Slider(20, range=0..20)

# ---- group: bracket width
number_slider_5 = Slider(120, range=0..200)

# ----
vlen = VectorLength(Vector=vec2pt_3.Vector)

# ---- group: 2D
multiplication = Multiplication(A=number_slider_4, B=Slider(5, range=0..10))
multiplication_2 = Multiplication(A=multiplication, B=Slider(2, range=0..10))

# ----
vlen_2 = VectorLength(Vector=vec2pt_6.Vector)
line = LineSDL(Start=py3_4.mid, Direction=vec2pt_3.Vector, Length=vlen)
line_2 = LineSDL(Start=py3_4.mid, Direction=vec2pt_6.Vector, Length=vlen_2)
division = Division(A=multiplication_2, B="4")

# ---- group: bolt spacing Y mult
number_slider_6 = Slider(2, range=1..5)

number_slider_7 = Slider(2, range=1..5)

# ----
division_2 = Division(A=multiplication_2, B="2")
amp_3 = Amplitude(Vector=vec_3, Amplitude=division)
number_slider_8 = Slider(50, range=0..200)
amp_4 = Amplitude(Vector=vec_3, Amplitude=division)
multiplication_3 = Multiplication(A=division_2, B=number_slider_6)
multiplication_4 = Multiplication(A=division_2, B=number_slider_7)
rev_3 = Reverse(Vector=amp_3)
move_7 = Move(Geometry=line_2, Motion=amp_3)  # -> Geometry, Transform
move_8 = Move(Geometry=line_2, Motion=rev_3)  # -> Geometry, Transform
rev_4 = Reverse(Vector=amp_4)
move_9 = Move(Geometry=line, Motion=amp_4)  # -> Geometry, Transform
merge_10 = Merge(Data1=move_8.Geometry, Data2=move_7.Geometry)  # -> flatten(Result)
move_10 = Move(Geometry=line, Motion=rev_4)  # -> Geometry, Transform
py3_7 = Python3Script(line=merge_10, poly=pline, plane=pl_3pt, tol=number_slider_3)  # -> out, near, far; inputs line: Line, poly: Polyline, plane: Plane
# ---------- py3_7: Python ----------
from typing import List, Tuple

Interval = Tuple[float, float]

def find_overlapping_regions(a: List[Interval], b: List[Interval]) -> List[Interval]:
    """
    Given two sets of intervals `a` and `b`, return all overlapping regions.
    
    Intervals are treated as half-open: [start, end).
    So two intervals [s1, e1) and [s2, e2) overlap if max(s1, s2) < min(e1, e2).
    
    Parameters
    ----------
    a : List[Interval]
        First list of intervals as (start, end).
    b : List[Interval]
        Second list of intervals as (start, end).
    
    Returns
    -------
    List[Interval]
        List of overlapping intervals as (start, end).
    """
    # Sort both lists by start time
    a_sorted = sorted(a, key=lambda x: x[0])
    b_sorted = sorted(b, key=lambda x: x[0])
    
    i = j = 0
    overlaps: List[Interval] = []
    
    while i < len(a_sorted) and j < len(b_sorted):
        a_start, a_end = a_sorted[i]
        b_start, b_end = b_sorted[j]
        
        # Compute overlap between a[i] and b[j]
        start = max(a_start, b_start)
        end = min(a_end, b_end)
        
        # If they actually overlap, record it
        if start < end:  # use <= if you want closed intervals [start, end]
            overlaps.append((start, end))
        
        # Move the pointer that ends first
        if a_end < b_end:
            i += 1
        else:
            j += 1
    
    return overlaps

import Rhino.Geometry as rh

intervals = []

# for poly_index, poly in enumerate([poly_1, poly_2]):

poly_pts = list(poly.ToArray())

params = [0.0]
# params = []

for index, pt_1 in enumerate(poly_pts[:-1]):
    poly_edge = rh.Line(pt_1, poly_pts[index + 1])
    success, p1, p2 = rh.Intersect.Intersection.LineLine(line, poly_edge)

    if p2 > -0.01 and p2 < 1.01: # intersection within poly edge
        if p1 > -0.01:
            params.append(p1)

# tol = 0.3

final_params = []

for param in params:
    found = False
    for final_param in final_params:
        if abs(param - final_param) < tol:
            found = True
            break
    if not found:
        final_params.append(param)

final_params.sort()

print(final_params)

intervals = []

# plane = [plane_1, plane_2][poly_index]

for int_num in range(len(final_params)-1):
    mid = (final_params[int_num] + final_params[int_num + 1]) / 2
    mid_pt = line.PointAt(mid)

    contains = poly.ToNurbsCurve().Contains(mid_pt, plane, tol)

    if contains == rh.PointContainment.Inside:
        intervals.append((final_params[int_num], final_params[int_num + 1]))

print(intervals)

near = line.PointAt(0.0).DistanceTo(line.PointAt(intervals[0][0]))
far = line.PointAt(0.0).DistanceTo(line.PointAt(intervals[0][1]))

# overlaps = find_overlapping_regions(intervals[0], intervals[1])

# print(overlaps)

# mids = [line.PointAt((overlap[0] + overlap[1]) / 2) for overlap in overlaps]

# placement_edge = rh.Line(line.PointAt(overlaps[0][0]), line.PointAt(overlaps[0][1]))
# mid = mids[0]
# ---------- end py3_7 ----------
merge_11 = Merge(Data1=move_10.Geometry, Data2=move_9.Geometry)  # -> flatten(Result)
py3_8 = Python3Script(line=merge_11, poly=pline_2, plane=pl_3pt_2, tol=number_slider_3)  # -> out, near, far; inputs line: Line, poly: Polyline, plane: Plane; same code as py3_7
sort_10 = SortList(Keys=py3_8.far)  # -> Keys, ValuesA
sort_11 = SortList(Keys=py3_8.near)  # -> Keys, ValuesA
item_29 = ListItem(List=sort_10.Keys, Index=0, Wrap=True)
sort_12 = SortList(Keys=py3_7.far)  # -> Keys, ValuesA
sort_13 = SortList(Keys=py3_7.near)  # -> Keys, ValuesA
item_30 = ListItem(List=reverse(sort_11.Keys), Index=0, Wrap=True)
addition = Addition(A=item_30, B=number_slider_8)
addition_2 = Addition(A=addition, B=multiplication_3)

division_3 = Division(A=multiplication_2, B=Slider(4, range=0..10))
py3_9 = Python3Script(x=division_3)  # -> out, a
# ---------- py3_9: Python ----------
a = (x**2 * 2)**0.5
# ---------- end py3_9 ----------
num = Number(py3_9.a)

panel_3 = Panel("""50
25""")
item_31 = ListItem(List=reverse(sort_13.Keys), Index=0, Wrap=True)
addition_3 = Addition(A=item_31, B=number_slider_8)
addition_4 = Addition(A=addition_3, B=multiplication_4)
item_32 = ListItem(List=sort_12.Keys, Index=0, Wrap=True)
addition_5 = Addition(A=addition_2, B=division)
addition_6 = Addition(A=addition_4, B=division)

# ---- group: Bolt pattern calc
number_slider_9 = Slider(4, range=0..10)
pi = Pi(Factor="2")
division_4 = Division(A=pi, B=number_slider_9)
series = Series(Start=0, Step=division_4, Count=number_slider_9)
multiplication_5 = Multiplication(A=division_4, B=Slider(0.5, range=0..1))
addition_7 = Addition(A=series, B=multiplication_5)

# ----
merge_12 = Merge(Data1=flatten(item_32), Data2=flatten(addition_6))
merge_13 = Merge(Data1=flatten(item_29), Data2=flatten(addition_5))
sort_14 = SortList(Keys=merge_12)  # -> Keys, ValuesA
sort_15 = SortList(Keys=merge_13)  # -> Keys, ValuesA

# ---- group: CP bolt cluster
panel_4 = Panel(addition_3)

# ----
item_33 = ListItem(List=sort_14.Keys, Index=0, Wrap=True)
item_34 = ListItem(List=sort_15.Keys, Index=0, Wrap=True)
division_5 = Division(A=multiplication_2, B="2")
subtraction = Subtraction(A=item_33, B=division)

amp_5 = Amplitude(Vector=vec2pt_6.Vector, Amplitude=addition_3)
move_11 = Move(Geometry=py3_4.mid, Motion=amp_5)  # -> Geometry, Transform
amp_6 = Amplitude(Vector=vec2pt_6.Vector, Amplitude=subtraction)
move_12 = Move(Geometry=py3_4.mid, Motion=amp_6)  # -> Geometry, Transform
merge_14 = Merge(Data1=flatten(move_11.Geometry), Data2=flatten(move_12.Geometry))
amp_7 = Amplitude(Vector=vec_3, Amplitude=division)
rev_5 = Reverse(Vector=amp_7)
move_13 = Move(Geometry=merge_14, Motion=rev_5)  # -> Geometry, Transform
move_14 = Move(Geometry=merge_14, Motion=amp_7)  # -> Geometry, Transform
merge_15 = Merge(Data1=flatten(move_14.Geometry), Data2=flatten(move_13.Geometry))

division_6 = Division(A=multiplication_2, B="2")
division_7 = Division(A=division_5, B="2")
addition_8 = Addition(A=addition_3, B=division_7)
division_8 = Division(A=division_6, B="2")
addition_9 = Addition(A=addition, B=division_8)

# ---- group: Bolt group A
amp_8 = Amplitude(Vector=vec2pt_6.Vector, Amplitude=addition_8)
pln = Plane(pl_3pt)
move_15 = Move(Geometry=py3_4.mid, Motion=amp_8)  # -> Geometry, Transform
amp_9 = Amplitude(Vector=amp_8, Amplitude=num)
move_16 = Move(Geometry=move_15.Geometry, Motion=amp_9)  # -> Geometry, Transform
pl_origin = PlaneOrigin(Base=pln, Origin=move_15.Geometry)
deplane = DeconstructPlane(Plane=pl_origin)  # -> Origin, XAxis, YAxis, ZAxis
amp_10 = Amplitude(Vector=deplane.ZAxis, Amplitude=1)
amp_11 = Amplitude(Vector=vec2pt_6.Vector, Amplitude=1)
pl = ConstructPlane(Origin=move_15.Geometry, XAxis=amp_10, YAxis=amp_11)
rotate = Rotate(Geometry=move_16.Geometry, Angle=addition_7, Plane=pl_origin)  # -> Geometry, Transform
deplane_2 = DeconstructPlane(Plane=pl)  # -> Origin, XAxis, YAxis, ZAxis

# ---- group: Bolt group B
amp_12 = Amplitude(Vector=vec2pt_3.Vector, Amplitude=addition_9)
pln_2 = Plane(pl_3pt_2)
move_17 = Move(Geometry=py3_4.mid, Motion=amp_12)  # -> Geometry, Transform
amp_13 = Amplitude(Vector=amp_12, Amplitude=num)
move_18 = Move(Geometry=move_17.Geometry, Motion=amp_13)  # -> Geometry, Transform
pl_origin_2 = PlaneOrigin(Base=pln_2, Origin=move_17.Geometry)
deplane_3 = DeconstructPlane(Plane=pl_origin_2)  # -> Origin, XAxis, YAxis, ZAxis
amp_14 = Amplitude(Vector=deplane_3.ZAxis, Amplitude=1)
amp_15 = Amplitude(Vector=vec2pt_3.Vector, Amplitude=1)
pl_2 = ConstructPlane(Origin=move_17.Geometry, XAxis=amp_14, YAxis=amp_15)
deplane_4 = DeconstructPlane(Plane=pl_2)  # -> Origin, XAxis, YAxis, ZAxis
rotate_2 = Rotate(Geometry=move_18.Geometry, Angle=addition_7, Plane=pl_origin_2)  # -> Geometry, Transform

# ---- group: L2
num_2 = Number(addition)

# ----
panel_5 = Panel(num_2)
subtraction_2 = Subtraction(A=item_34, B=division)

# ---- group: L1
num_3 = Number(subtraction_2)

# ----
amp_16 = Amplitude(Vector=vec2pt_3.Vector, Amplitude=num_2)
move_19 = Move(Geometry=py3_4.mid, Motion=amp_16)  # -> Geometry, Transform
amp_17 = Amplitude(Vector=vec2pt_3.Vector, Amplitude=num_3)
move_20 = Move(Geometry=py3_4.mid, Motion=amp_17)  # -> Geometry, Transform
merge_16 = Merge(Data1=flatten(move_19.Geometry), Data2=flatten(move_20.Geometry))
amp_18 = Amplitude(Vector=vec_3, Amplitude=division)
rev_6 = Reverse(Vector=amp_18)
move_21 = Move(Geometry=merge_16, Motion=rev_6)  # -> Geometry, Transform
move_22 = Move(Geometry=merge_16, Motion=amp_18)  # -> Geometry, Transform
merge_17 = Merge(Data1=flatten(move_22.Geometry), Data2=flatten(move_21.Geometry))

panel_6 = Panel(num_3)

# ---- group: plate thickness (mm)
number_slider_10 = Slider(13.4, range=0..25)

# ---- group: Vector scaling
number_slider_11 = Slider(0.022, range=0..0.1)

# ---- group: B bolt points
geo = Geometry(merge_17)

# ----
bang = ExplodeTree(Data=simplify(graft(geo)))  # -> Branch0, Branch1, Branch2, Branch3
pt = Point(bang.Branch3)
pt_2 = Point(bang.Branch1)
pt_3 = Point(bang.Branch2)

# ---- group: INNER
merge_18 = Merge(Data1=bang.Branch0, Data2=bang.Branch2)

# ---- group: OUTER
merge_19 = Merge(Data1=bang.Branch1, Data2=bang.Branch3)

# ----
pl_3pt_3 = Plane3Pt(PointA=pt, PointB=pt_2, PointC=pt_3)

# ---- group: Get Material
list = ValueList({"S235 (Structural Steel)", "42CrMo4 (Heat-resistant Steel)", "1.4301 (Stainless Steel)", "EN AW-6061 (Aluminum Alloy)", "Cu-ETP (Copper)"}, selected="1.4301 (Stainless Steel)")
panel_7 = Panel("materials.csv")
list_2 = ValueList({"Material", "Elastic Modulus", "Shear Modulus", "Density", "Ultimate Strength", "Yield Strength", "Shear Strength", "Poisson's Ratio"}, selected="Density")
py3_10 = Python3Script(csv_filename=panel_7, material=list, prop=list_2)  # -> out, materials, properties, value
# ---------- py3_10: Python ----------
import os, sys, re
import csv

def clean_header(header: str) -> str:
    """Remove units in square brackets, e.g. '[MPa]'."""
    return re.sub(r"\s*\[.*?\]", "", header).strip()

def load_csv_as_dict(path_to_csv: str):
    """
    Load a CSV and return a dictionary keyed by the first column.
    Each value is a dict of header -> cell_value for that row.
    """

    if not os.path.isfile(path_to_csv):
        raise FileNotFoundError(f"CSV file not found: {path_to_csv}")

    data_dict = {}

    with open(path_to_csv, newline='', encoding="utf-8") as f:
        reader = csv.reader(f)

        # Read and clean headers
        raw_headers = next(reader)
        headers = [clean_header(h) for h in raw_headers]

        # Use new headers in DictReader
        f.seek(0)
        dict_reader = csv.DictReader(f, fieldnames=headers)
        next(dict_reader)  # skip original header row

        first_col = headers[0]

        for row in dict_reader:
            key = row[first_col]
            data_dict[key] = row.copy()

    return data_dict

# ----------------------------------------------------------------------
# 1. Make sure the folder containing this .gh file is on sys.path
# ----------------------------------------------------------------------
gh_path = ghdoc.Path  # full path to the current Grasshopper file
if gh_path:
    gh_dir = os.path.dirname(gh_path)
    parent_dir = os.path.dirname(gh_dir)   # /path/to/parent/folder

    csv_path = os.path.join(parent_dir, csv_filename)

    material_dictionary = load_csv_as_dict(csv_path)

    materials = list(material_dictionary.keys())
    properties = list(material_dictionary[materials[0]].keys())
    
    value = material_dictionary[material][prop]
# ---------- end py3_10 ----------
panel_8 = Panel(py3_10.value)
panel_9 = Panel(py3_10.materials)
panel_10 = Panel(py3_10.properties)

# ---- group: Create ribs / Num ribs
number_slider_12 = Slider(1, range=0..2)

# ---- group: SOLVER / Vector scaling
number_slider_13 = Slider(77, range=0..1000)

number_slider_14 = Slider(77, range=0..1000)

# ---- group: Get Material
list_3 = ValueList({"S235 (Structural Steel)", "42CrMo4 (Heat-resistant Steel)", "1.4301 (Stainless Steel)", "EN AW-6061 (Aluminum Alloy)", "Cu-ETP (Copper)"}, selected="Cu-ETP (Copper)")
list_4 = ValueList({"Material", "Elastic Modulus", "Shear Modulus", "Density", "Ultimate Strength", "Yield Strength", "Shear Strength", "Poisson's Ratio"}, selected="Density")
py3_11 = Python3Script(csv_filename="materials.csv", material=list_3, prop=list_4)  # -> out, materials, properties, value; same code as py3_10
panel_11 = Panel(py3_11.value)
panel_12 = Panel(py3_11.materials)
panel_13 = Panel(py3_11.properties)

# ----
list_5 = ValueList({"Material", "Elastic Modulus", "Shear Modulus", "Density", "Ultimate Strength", "Yield Strength", "Shear Strength", "Poisson's Ratio"}, selected="Yield Strength")

# ---- group: Create ribs / Hinge direction
vec_4 = Vector(vec_3)

# ---- group: Create ribs / Plate thickness
num_4 = Number(number_slider_10)

# ---- group: SOLVER / B bolt points
geo_2 = Geometry(merge_17)

# ---- group: Create bracket geo / Direction along spine
vec_5 = Vector(vec_3)

# ---- group: SOLVER / B bolt points
geo_3 = Geometry(merge_15)

# ---- group: SOLVER / B Flange normal
vec_6 = Vector(deplane_4.XAxis)

vec_7 = Vector(deplane_2.XAxis)

# ----
py3_12 = Python3Script(csv_filename=panel_7, material=list, prop=list_5)  # -> out, materials, properties, value; same code as py3_10
panel_14 = Panel(py3_12.value)
multiplication_6 = Multiplication(A=py3_12.value, B="1000000")

# ---- group: 1G (m/s2)
panel_15 = Panel("9.81")

# ----
panel_16 = Panel(multiplication_6)

# ---- group: 1G (m/s2)
panel_17 = Panel("9.81")

# ---- group: Maximum Bending Moment / L2
num_5 = Number(num_2)

# ---- group: Maximum Bending Moment / L1
num_6 = Number(num_3)

# ---- group: Placement zone
merge_20 = Merge(Data1=extr_4, Data2=extr_3)
join_2 = BrepJoin(Breps=merge_20)  # -> Breps, Closed
mesh_3 = MeshBrep(
    Brep=join_2.Breps,
    Settings={GridMaxCount=0, GridMinCount=16, JaggedSeams=False, MaxEdgeLength=0, MinEdgeLength=0.0001, MinTolerance=0, Refine=True, RefineAngle=0, RelativeTolerance=0.65, SimplePlanes=True, Tolerance=0})
wires = BrepWireframe(Brep=join_2.Breps, Density=-1)
preview_5 = CustomPreview(Geometry=mesh_3, Material=ColourSwatch(SwatchColor=RGBA(102, 102, 102, 124)))
area = MeshArea(Mesh=mesh_3)  # -> Area, Centroid
panel_18 = Panel(area.Area)

# ----
dash = DashPattern(Curve=wires, Pattern=panel_3)  # -> Dashes, Gaps

# ---- group: Placement zone (continued)
previewlw_3 = CustomPreviewLineweights(Geometry=dash.Dashes, Shader=ColourSwatch(SwatchColor=RGB(0, 0, 0)), Thickness=Slider(3.23, range=0..10), Absolute=False)

# ---- group: SOLVER
number_slider_15 = Slider(0.71, range=0..5)
volume_2 = MeshVolume(Mesh=mesh_2)  # -> Volume, Centroid
num_7 = Number(number_slider_11)
neg = Negative(Value=Slider(0, range=0..5))
vec_8 = VectorXYZ(XComponent=0, YComponent=0, ZComponent=0)  # -> Vector, Length
number_slider_16 = Slider(5, range=0..10)

# ---- group: SOLVER / CP
pt_4 = Point(volume_2.Centroid)

# ---- group: Volume (m3)
division_9 = Division(A=volume_2.Volume, B="1000000000")

# ----
multiplication_7 = Multiplication(A=division_9, B=py3_11.value)
multiplication_8 = Multiplication(A=panel_15, B=multiplication_7)
f_n = Panel(multiplication_8)

# ---- group: SOLVER
number_slider_17 = Slider(0.71, range=0..5)
volume_3 = MeshVolume(Mesh=mesh_2)  # -> Volume, Centroid
num_8 = Number(number_slider_11)
neg_2 = Negative(Value=Slider(0, range=0..5))
vec_9 = VectorXYZ(XComponent=0, YComponent=0, ZComponent=0)  # -> Vector, Length
number_slider_18 = Slider(5, range=0..10)

# ---- group: Volume (m3)
division_10 = Division(A=volume_3.Volume, B="1000000000")

# ----
multiplication_9 = Multiplication(A=division_10, B=py3_11.value)
mass_kg = Panel(multiplication_9)

# ---- group: Create ribs
py3_13 = Python3Script(x=number_slider_12)  # -> out, a
# ---------- py3_13: Python ----------
if x == 1:
    a = 0.5
elif x == 2:
    a = [0, 1]
# ---------- end py3_13 ----------
amp_19 = Amplitude(Vector=vec_4, Amplitude=num_4)
multiplication_10 = Multiplication(A=multiplication_2, B=py3_13.a)
multiplication_11 = Multiplication(A=num_4, B=py3_13.a)
subtraction_3 = Subtraction(A=multiplication_10, B=multiplication_11)
amp_20 = Amplitude(Vector=vec_4, Amplitude=subtraction_3)
bool = Boolean(number_slider_12)
p_n_c = PickNChoose(Pattern=bool, Stream0=Toggle(False), Stream1=Toggle(True))

# ---- group: Bolts
addition_10 = Addition(A=number_slider_10, B=".1")
amp_21 = Amplitude(Vector=deplane_4.XAxis, Amplitude="-.1")
amp_22 = Amplitude(Vector=deplane_4.XAxis, Amplitude=addition_10)
amp_23 = Amplitude(Vector=deplane_2.XAxis, Amplitude="-.1")
amp_24 = Amplitude(Vector=deplane_2.XAxis, Amplitude=addition_10)

# ---- group: SOLVER (continued)
neg_3 = Negative(Value=multiplication_8)
vec_10 = VectorXYZ(XComponent=neg, YComponent=Slider(0, range=0..5), ZComponent=neg_3)  # -> Vector, Length
rev_7 = Reverse(Vector=vec_10.Vector)
vlen_3 = VectorLength(Vector=vec_10.Vector)
multiplication_12 = Multiplication(A=vlen_3, B=num_7)
amp_25 = Amplitude(Vector=vec_10.Vector, Amplitude=multiplication_12)
vdisex = VectorDisplayEx(Point=pt_4, Vector=amp_25, Colour=RGB(0, 0, 0), Width=2)
move_23 = Move(Geometry=pt_4, Motion=amp_25)  # -> Geometry, Transform
int = Integer(vlen_3)
tag = TextTag(Location=move_23.Geometry, Text=int)

# ---- group: SOLVER / solver
py3_14 = Python3Script(F=rev_7, M=vec_8.Vector, c=pt_4, r=geo_2)  # -> out, R; inputs c: Point3d, r: list of Point3d
# ---------- py3_14: Python ----------
# r: numpy

import sys
import os
import importlib

# ----------------------------------------------------------------------
# 1. Make sure the folder containing this .gh file is on sys.path
# ----------------------------------------------------------------------
gh_path = ghdoc.Path  # full path to the current Grasshopper file
if gh_path:
    gh_dir = os.path.dirname(gh_path)
    parent_dir = os.path.dirname(gh_dir)   # /path/to/parent/folder

    if parent_dir not in sys.path:
        sys.path.append(parent_dir)

# ----------------------------------------------------------------------
# 2. Import (and reload) your module
# ----------------------------------------------------------------------
import scripts.rigid_body_solver
importlib.reload(scripts.rigid_body_solver)

from scripts.rigid_body_solver import calculate_equilibrium_reactions, split_vector, vector_magnitude

# ----------------------------------------------------------------------
# 3. Call your function using Grasshopper inputs
#    (hook these up in the component: supports, loads, etc.)
# ----------------------------------------------------------------------

# Applied loads at the centre of gravity
applied_F = [F.X, F.Y, F.Z]    # in Newtons
applied_M = [M.X, M.Y, M.Z]      # in Newton-meters

print(applied_F)
print(applied_M)

# Define the centre of gravity coordinates (global system)
cg = [c.X/1000, c.Y/1000, c.Z/1000]  # Example: CG at the origin; change as needed

# Define n reaction (support) points in the global coordinate system (meters)
# Example: An equilateral triangle in the horizontal (XY) plane.
reaction_points = [ [pt.X/1000, pt.Y/1000, pt.Z/1000] for pt in r ]

print(r)
print(reaction_points)

# Calculate the reaction forces at the three support points.
reactions = calculate_equilibrium_reactions(applied_F, applied_M, reaction_points, cg)

# Display the results:
print("Applied Force (N):", applied_F)
print("Applied Moment (N·m):", applied_M)
print("Centre of Gravity (m):", cg, "\n")

print("---- Reaction Points and Their Reaction Loads ----")
for i, (point, reaction) in enumerate(zip(reaction_points, reactions), start=1):
    mag = vector_magnitude(reaction)
    print(f"Support {i} at {point} -> Reaction Force: {reaction} N, Magnitude: {mag:.2f} N")

import Rhino.Geometry as rh

# R = []
# for reaction in reactions:
#     R.append(rh.Vector3d(reaction[0], reaction[1], reaction[2]))

R = [ rh.Vector3d(reaction[0], reaction[1], reaction[2]) for reaction in reactions ]
# ---------- end py3_14 ----------

# ---- group: Create bracket geo
division_11 = Division(A=multiplication_2, B="2")
amp_26 = Amplitude(Vector=vec_5, Amplitude=division_11)
rev_8 = Reverse(Vector=amp_26)
amp_27 = Amplitude(Vector=vec2pt_6.Vector, Amplitude=item_33)
amp_28 = Amplitude(Vector=vec2pt_3.Vector, Amplitude=item_34)
amp_29 = Amplitude(Vector=vec_5, Amplitude=multiplication_2)

# ---- group: Create bracket geo / Bracket corner pt
move_24 = Move(Geometry=py3_4.mid, Motion=rev_8)  # -> Geometry, Transform

# ---- group: SOLVER (continued)
py3_15 = Python3Script(R=py3_14.R, V=vec_6)  # -> out, T, S; inputs R: list
# ---------- py3_15: Python ----------
# r: numpy

import sys
import os
import importlib

# ----------------------------------------------------------------------
# 1. Make sure the folder containing this .gh file is on sys.path
# ----------------------------------------------------------------------
gh_path = ghdoc.Path  # full path to the current Grasshopper file
if gh_path:
    gh_dir = os.path.dirname(gh_path)
    parent_dir = os.path.dirname(gh_dir)   # /path/to/parent/folder

    if parent_dir not in sys.path:
        sys.path.append(parent_dir)

# ----------------------------------------------------------------------
# 2. Import (and reload) your module
# ----------------------------------------------------------------------
import scripts.rigid_body_solver
importlib.reload(scripts.rigid_body_solver)

from scripts.rigid_body_solver import split_vector

# ----------------------------------------------------------------------
# 3. Call your function using Grasshopper inputs
#    (hook these up in the component: supports, loads, etc.)
# ----------------------------------------------------------------------

import Rhino.Geometry as rh

T = []
S = []

for reaction in R:

    v = [ V.X, V.Y, V.Z ]
    u = [ reaction.X, reaction.Y, reaction.Z ]

    t, s = split_vector(u, v)

    T.append(rh.Vector3d(t[0], t[1], t[2]))
    S.append(rh.Vector3d(s[0], s[1], s[2]))
# ---------- end py3_15 ----------
vlen_4 = VectorLength(Vector=py3_15.T)
vlen_5 = VectorLength(Vector=py3_15.S)
vlen_6 = VectorLength(Vector=py3_14.R)
panel_19 = Panel(vlen_4)
panel_20 = Panel(vlen_5)
panel_21 = Panel(vlen_6)
multiplication_13 = Multiplication(A=vlen_4, B=num_7)
multiplication_14 = Multiplication(A=vlen_5, B=num_7)
multiplication_15 = Multiplication(A=vlen_6, B=num_7)
line_3 = LineSDL(Start=geo_2, Direction=py3_15.T, Length=multiplication_13)
line_4 = LineSDL(Start=geo_2, Direction=py3_15.S, Length=multiplication_14)
line_5 = LineSDL(Start=geo_2, Direction=py3_14.R, Length=multiplication_15)
previewlw_4 = CustomPreviewLineweights(Geometry=line_3, Shader=ColourSwatch(SwatchColor=RGB(0, 102, 255)), Thickness=number_slider_16, Absolute=False)
previewlw_5 = CustomPreviewLineweights(Geometry=line_4, Shader=ColourSwatch(SwatchColor=RGB(0, 181, 9)), Thickness=number_slider_16, Absolute=False)
previewlw_6 = CustomPreviewLineweights(Geometry=line_5, Shader=ColourSwatch(SwatchColor=RGB(255, 94, 94)), Thickness=number_slider_16, Absolute=False)
end_4 = EndPoints(Curve=line_4)  # -> Start, End
end_5 = EndPoints(Curve=line_3)  # -> Start, End
end_6 = EndPoints(Curve=line_5)  # -> Start, End
srf4pt = _4PointSurface(CornerA=end_5.Start, CornerB=end_5.End, CornerC=end_6.End, CornerD=end_4.End)
amp_30 = Amplitude(Vector=line_3, Amplitude="10")
rev_9 = Reverse(Vector=amp_30)
move_25 = Move(Geometry=geo_2, Motion=rev_9)  # -> Geometry, Transform

# ---- group: SOLVER / bolt picker
py3_16 = Python3Script(T=vlen_4, S=vlen_5)  # -> out, R, B, D
# ---------- py3_16: Python ----------
# r: numpy

import sys
import os
import importlib

# ----------------------------------------------------------------------
# 1. Make sure the folder containing this .gh file is on sys.path
# ----------------------------------------------------------------------
gh_path = ghdoc.Path  # full path to the current Grasshopper file
if gh_path:
    gh_dir = os.path.dirname(gh_path)
    parent_dir = os.path.dirname(gh_dir)   # /path/to/parent/folder

    if parent_dir not in sys.path:
        sys.path.append(parent_dir)

# ----------------------------------------------------------------------
# 2. Import (and reload) your module
# ----------------------------------------------------------------------
import scripts.bolt_sizing
importlib.reload(scripts.bolt_sizing)

from scripts.bolt_sizing import select_bolt_gh, summarize_result

# ----------------------------------------------------------------------
# 3. Call your function using Grasshopper inputs
#    (hook these up in the component: supports, loads, etc.)
# ----------------------------------------------------------------------

result, summary = select_bolt_gh(T, S)

R = summary
B = result.size
D = result.hole_size
# ---------- end py3_16 ----------

# ---- group: largest bolt size
sort_16 = SortList(Keys=py3_16.D)  # -> Keys, ValuesA
item_35 = ListItem(List=reverse(sort_16.Keys), Index=0, Wrap=True)

# ----
circle = CircleCNR(Center=merge_17, Normal=deplane_4.XAxis, Radius=item_35)

# ---- group: SOLVER (continued)
panel_22 = Panel(py3_16.R)
tag_2 = TextTag(Location=move_25.Geometry, Text=py3_16.B)

# ----
int_2 = Integer(vlen_4)
int_3 = Integer(vlen_5)
int_4 = Integer(vlen_6)
tag_3 = TextTag(Location=end_5.End, Text=int_2)
tag_4 = TextTag(Location=end_4.End, Text=int_3)
tag_5 = TextTag(Location=end_6.End, Text=int_4)

# ---- group: Bolts (continued)
move_26 = Move(Geometry=circle, Motion=amp_21)  # -> graft(Geometry), Transform
move_27 = Move(Geometry=circle, Motion=amp_22)  # -> graft(Geometry), Transform
merge_21 = Merge(Data1=move_26.Geometry, Data2=move_27.Geometry)
loft = Loft(Curves=merge_21, Options={Adjust=False, Closed=False, LoftEnds=0, LoftSimp=0, LoftType=0, Rebuild=10, Refit=0.01})
cap = CapHoles(Brep=loft)

# ---- group: Create bracket geo (continued)
move_28 = Move(Geometry=move_24.Geometry, Motion=amp_27)  # -> Geometry, Transform
move_29 = Move(Geometry=move_24.Geometry, Motion=amp_28)  # -> Geometry, Transform
merge_22 = Merge(Data1=flatten(move_28.Geometry), Data2=flatten(move_24.Geometry), Data3=flatten(move_29.Geometry))
pline_3 = PolyLine(Vertices=merge_22, Closed=False)

# ---- group: Create bracket geo / Bracket profile
crv = Curve(pline_3)

# ---- group: Create bracket geo / Offset profile
neg_4 = Negative(Value=number_slider_10)
offset = OffsetCurve(Curve=crv, Distance=neg_4, Corners=1)
flip = FlipCurve(Curve=offset)  # -> Curve, Flag

# ---- group: Create ribs (continued)
cp = ControlPoints(Curve=flip.Curve)  # -> Points, Weights, Knots
pline_4 = PolyLine(Vertices=cp.Points, Closed=Toggle(True))
extr_5 = Extrude(Base=pline_4, Direction=amp_19)
cap_2 = CapHoles(Brep=extr_5)
move_30 = Move(Geometry=cap_2, Motion=amp_20)  # -> Geometry, Transform
dispatch = Dispatch(List=move_30.Geometry, DispatchPattern=p_n_c)  # -> ListA, ListB

# ---- group: Create bracket geo (continued)
end_7 = EndPoints(Curve=crv)  # -> Start, End
end_8 = EndPoints(Curve=flip.Curve)  # -> Start, End
ln_5 = Line(StartPoint=end_7.End, EndPoint=end_8.Start)
ln_6 = Line(StartPoint=end_8.End, EndPoint=end_7.Start)
merge_23 = Merge(Data1=flatten(crv), Data2=flatten(ln_5), Data3=flatten(flip.Curve), Data4=flatten(ln_6))
join_3 = JoinCurves(Curves=merge_23, Preserve=False)
extr_6 = Extrude(Base=join_3, Direction=amp_29)
cap_3 = CapHoles(Brep=extr_6)

# ----
merge_24 = Merge(Data1=flatten(cap_3), Data2=flatten(dispatch.ListA))
volume_4 = MeshVolume(Mesh=merge_24)  # -> Volume, Centroid

# ---- group: Volume (m3)
division_12 = Division(A=volume_4.Volume, B="1000000000")

# ----
multiplication_16 = Multiplication(A=division_12, B=py3_10.value)
mass_kg_2 = Panel(multiplication_16)
merge_25 = Merge(Data1=flatten(multiplication_9), Data2=flatten(multiplication_16))
merge_26 = Merge(Data1=flatten(volume_3.Centroid), Data2=flatten(volume_4.Centroid))
pdecon = Deconstruct(Point=merge_26)  # -> XComponent, YComponent, ZComponent
ma = MassAddition(Input=merge_25)  # -> Result, PartialResults

multiplication_17 = Multiplication(A=merge_25, B=pdecon.ZComponent)
ma_2 = MassAddition(Input=multiplication_17)  # -> Result, PartialResults
division_13 = Division(A=ma_2.Result, B=ma.Result)

multiplication_18 = Multiplication(A=merge_25, B=pdecon.YComponent)
ma_3 = MassAddition(Input=multiplication_18)  # -> Result, PartialResults
division_14 = Division(A=ma_3.Result, B=ma.Result)

multiplication_19 = Multiplication(A=merge_25, B=pdecon.XComponent)
ma_4 = MassAddition(Input=multiplication_19)  # -> Result, PartialResults
division_15 = Division(A=ma_4.Result, B=ma.Result)

pt_5 = ConstructPoint(XCoordinate=division_15, YCoordinate=division_14, ZCoordinate=division_13)

# ---- group: SOLVER / CP
pt_6 = Point(pt_5)

# ----
mass_kg_3 = Panel(ma.Result)
multiplication_20 = Multiplication(A=panel_17, B=ma.Result)
f_n_2 = Panel(multiplication_20)

# ---- group: SOLVER (continued)
neg_5 = Negative(Value=multiplication_20)
vec_11 = VectorXYZ(XComponent=neg_2, YComponent=Slider(0, range=0..5), ZComponent=neg_5)  # -> Vector, Length
vlen_7 = VectorLength(Vector=vec_11.Vector)
rev_10 = Reverse(Vector=vec_11.Vector)
multiplication_21 = Multiplication(A=vlen_7, B=num_8)
amp_31 = Amplitude(Vector=vec_11.Vector, Amplitude=multiplication_21)
vdisex_2 = VectorDisplayEx(Point=pt_6, Vector=amp_31, Colour=RGB(0, 0, 0), Width=2)
move_31 = Move(Geometry=pt_6, Motion=amp_31)  # -> Geometry, Transform
int_5 = Integer(vlen_7)
tag_6 = TextTag(Location=move_31.Geometry, Text=int_5)

# ---- group: SOLVER / solver
py3_17 = Python3Script(F=rev_10, M=vec_9.Vector, c=pt_6, r=geo_3)  # -> out, R; inputs c: Point3d, r: list of Point3d; same code as py3_14

# ---- group: SOLVER (continued)
py3_18 = Python3Script(R=py3_17.R, V=vec_7)  # -> out, T, S; inputs R: list; same code as py3_15
vlen_8 = VectorLength(Vector=py3_18.T)
vlen_9 = VectorLength(Vector=py3_18.S)
vlen_10 = VectorLength(Vector=py3_17.R)
panel_23 = Panel(vlen_8)
panel_24 = Panel(vlen_9)
panel_25 = Panel(vlen_10)
multiplication_22 = Multiplication(A=vlen_8, B=num_8)
multiplication_23 = Multiplication(A=vlen_9, B=num_8)
multiplication_24 = Multiplication(A=vlen_10, B=num_8)
line_6 = LineSDL(Start=geo_3, Direction=py3_18.T, Length=multiplication_22)
line_7 = LineSDL(Start=geo_3, Direction=py3_18.S, Length=multiplication_23)
line_8 = LineSDL(Start=geo_3, Direction=py3_17.R, Length=multiplication_24)
previewlw_7 = CustomPreviewLineweights(Geometry=line_6, Shader=ColourSwatch(SwatchColor=RGB(0, 102, 255)), Thickness=number_slider_18, Absolute=False)
previewlw_8 = CustomPreviewLineweights(Geometry=line_7, Shader=ColourSwatch(SwatchColor=RGB(0, 181, 9)), Thickness=number_slider_18, Absolute=False)
previewlw_9 = CustomPreviewLineweights(Geometry=line_8, Shader=ColourSwatch(SwatchColor=RGB(255, 94, 94)), Thickness=number_slider_18, Absolute=False)
end_9 = EndPoints(Curve=line_7)  # -> Start, End
end_10 = EndPoints(Curve=line_6)  # -> Start, End
end_11 = EndPoints(Curve=line_8)  # -> Start, End
srf4pt_2 = _4PointSurface(CornerA=end_10.Start, CornerB=end_10.End, CornerC=end_11.End, CornerD=end_9.End)
amp_32 = Amplitude(Vector=line_6, Amplitude="10")
rev_11 = Reverse(Vector=amp_32)
move_32 = Move(Geometry=geo_3, Motion=rev_11)  # -> Geometry, Transform

# ---- group: SOLVER / bolt picker
py3_19 = Python3Script(T=vlen_8, S=vlen_9)  # -> out, R, B, D; same code as py3_16

# ---- group: largest bolt size
sort_17 = SortList(Keys=py3_19.D)  # -> Keys, ValuesA
item_36 = ListItem(List=reverse(sort_17.Keys), Index=0, Wrap=True)

# ----
circle_2 = CircleCNR(Center=merge_15, Normal=deplane_2.XAxis, Radius=item_36)

# ---- group: Bolts (continued)
move_33 = Move(Geometry=circle_2, Motion=amp_23)  # -> graft(Geometry), Transform
move_34 = Move(Geometry=circle_2, Motion=amp_24)  # -> graft(Geometry), Transform
merge_27 = Merge(Data1=move_33.Geometry, Data2=move_34.Geometry)
loft_2 = Loft(Curves=merge_27, Options={Adjust=False, Closed=False, LoftEnds=0, LoftSimp=0, LoftType=0, Rebuild=10, Refit=0.01})
cap_4 = CapHoles(Brep=loft_2)
merge_28 = Merge(Data1=flatten(cap_4), Data2=flatten(cap))

# ---- group: SOLVER (continued)
panel_26 = Panel(py3_19.R)
tag_7 = TextTag(Location=move_32.Geometry, Text=py3_19.B)

# ----
int_6 = Integer(vlen_9)
int_7 = Integer(vlen_8)
int_8 = Integer(vlen_10)
tag_8 = TextTag(Location=end_9.End, Text=int_6)
tag_9 = TextTag(Location=end_10.End, Text=int_7)
tag_10 = TextTag(Location=end_11.End, Text=int_8)

# ---- group: Final plate geo
sdiff = SolidDifference(BrepsA=cap_3, BrepsB=merge_28)

# ---- group: Bracket geo / collect Solid geometry
merge_29 = Merge(Data1=flatten(sdiff), Data2=flatten(dispatch.ListA))

# ---- group: Bracket geo
sunion = SolidUnion(Breps=merge_29)
mesh_4 = MeshBrep(
    Brep=sunion,
    Settings={GridMaxCount=0, GridMinCount=16, JaggedSeams=False, MaxEdgeLength=0, MinEdgeLength=0.0001, MinTolerance=0, Refine=True, RefineAngle=0, RelativeTolerance=0.65, SimplePlanes=True, Tolerance=0})
wires_2 = BrepWireframe(Brep=sunion, Density=-1)
unifynormals = MeshUnifyNormals(Mesh=mesh_4)
previewlw_10 = CustomPreviewLineweights(Geometry=wires_2, Shader=ColourSwatch(SwatchColor=RGB(0, 0, 0)), Thickness=Slider(2, range=0..10), Absolute=False)
preview_6 = CustomPreview(Geometry=unifynormals, Material=ColourSwatch(SwatchColor=RGBA(168, 168, 99, 107)))

# ---- group: Section sizing
bbox = BoundingBox(Content=sunion, Plane=pl_3pt_3)  # -> Box, Box_2
debox = DeconstructBox(Box=bbox.Box_2)  # -> Plane, X, Y, Z
division_16 = Division(A=multiplication_2, B="1000")
dedomain = DeconstructDomain(Domain=debox.Z)  # -> Start, End
subtraction_4 = Subtraction(A=dedomain.End, B=dedomain.Start)
number_slider_19 = Slider(0.6, range=0..1)
number_slider_20 = Slider(0.4, range=0..1)
division_17 = Division(A=subtraction_4, B="1000")

# ----
wires_3 = BrepWireframe(Brep=bbox.Box, Density=-1)

# ---- group: Maximum Bending Moment
bang_2 = ExplodeTree(Data=simplify(graft(py3_15.T)))  # -> Branch0, Branch1, Branch2, Branch3
panel_27 = Panel(num_5)
panel_28 = Panel(num_6)

# ---- group: Maximum Bending Moment / INNER
merge_30 = Merge(Data1=bang_2.Branch0, Data2=bang_2.Branch2)  # -> flatten(Result)

# ---- group: Maximum Bending Moment / OUTER
merge_31 = Merge(Data1=bang_2.Branch1, Data2=bang_2.Branch3)  # -> flatten(Result)

# ---- group: Maximum Bending Moment / F1
ma_5 = MassAddition(Input=merge_31)  # -> Result, PartialResults

ma_6 = MassAddition(Input=merge_30)  # -> Result, PartialResults

# ---- group: Maximum Bending Moment (continued)
panel_29 = Panel(merge_31)
panel_30 = Panel(merge_30)
panel_31 = Panel(ma_5.Result)
panel_32 = Panel(ma_6.Result)
vlen_11 = VectorLength(Vector=ma_5.Result)
vlen_12 = VectorLength(Vector=ma_6.Result)
panel_33 = Panel(vlen_11)
panel_34 = Panel(vlen_12)
multiplication_25 = Multiplication(A=ma_6.Result, B=num_6)
multiplication_26 = Multiplication(A=ma_5.Result, B=num_5)
subtraction_5 = Subtraction(A=multiplication_25, B=multiplication_26)
vlen_13 = VectorLength(Vector=subtraction_5)
panel_35 = Panel(vlen_13)

# ---- group: Section sizing / section sizing
py3_20 = Python3Script(b=division_16, h=division_17, M=vlen_13, s=multiplication_6)  # -> out, t_opt
# ---------- py3_20: Python ----------
# r: scipy

import sys
import os
import importlib

# ----------------------------------------------------------------------
# 1. Make sure the folder containing this .gh file is on sys.path
# ----------------------------------------------------------------------
gh_path = ghdoc.Path  # full path to the current Grasshopper file
if gh_path:
    gh_dir = os.path.dirname(gh_path)
    parent_dir = os.path.dirname(gh_dir)   # /path/to/parent/folder

    if parent_dir not in sys.path:
        sys.path.append(parent_dir)

# ----------------------------------------------------------------------
# 2. Import (and reload) your module
# ----------------------------------------------------------------------
import scripts.section_sizing
importlib.reload(scripts.section_sizing)

from scripts.section_sizing import optimum_thickness

# ----------------------------------------------------------------------
# 3. Call your function using Grasshopper inputs
#    (hook these up in the component: supports, loads, etc.)
# ----------------------------------------------------------------------

t_opt = optimum_thickness(b, h, M, s)
print(f"Optimum flange thickness: {t_opt:.4f} m")
# ---------- end py3_20 ----------

# ---- group: Section sizing / Plate thickness (mm)
multiplication_27 = Multiplication(A=py3_20.t_opt, B="1000")
panel_36 = Panel(multiplication_27)
