# Grasshopper definition bracket_3_python.gh (Grasshopper 1.0.8)
# plug-ins: MeshEdit Components, Human

# ---- group: Input BREPs
brep = Brep(<brep referenced from the Rhino model>)
brep_2 = Brep(<brep referenced from the Rhino model>)

# ---- group: Materials
py3 = Python3Script(csv_filename="materials.csv")  # -> out, materials, properties
# ---------- py3: Python ----------
import os, sys, re
import csv

def clean_header(header: str) -> str:
    """Remove units in square brackets, e.g. '[MPa]'."""
    return re.sub(r"\s*\[.*?\]", "", header).strip()

def load_csv_as_dict(path_to_csv: str):
    """
    Load a CSV and return a dictionary keyed by the first column.
    Each value is a dict of header -> cell_value for that row.
    """

    if not os.path.isfile(path_to_csv):
        raise FileNotFoundError(f"CSV file not found: {path_to_csv}")

    data_dict = {}

    with open(path_to_csv, newline='', encoding="utf-8") as f:
        reader = csv.reader(f)

        # Read and clean headers
        raw_headers = next(reader)
        headers = [clean_header(h) for h in raw_headers]

        # Use new headers in DictReader
        f.seek(0)
        dict_reader = csv.DictReader(f, fieldnames=headers)
        next(dict_reader)  # skip original header row

        first_col = headers[0]

        for row in dict_reader:
            key = row[first_col]
            data_dict[key] = row.copy()

    return data_dict

# ----------------------------------------------------------------------
# 1. Make sure the folder containing this .gh file is on sys.path
# ----------------------------------------------------------------------
gh_path = ghdoc.Path  # full path to the current Grasshopper file
if gh_path:
    gh_dir = os.path.dirname(gh_path)
    parent_dir = os.path.dirname(gh_dir)   # /path/to/parent/folder

    csv_path = os.path.join(parent_dir, csv_filename)

    material_dictionary = load_csv_as_dict(csv_path)
    materials = list(material_dictionary.keys())
    properties = list(material_dictionary[materials[0]].keys())
# ---------- end py3 ----------
panel = Panel(py3.materials)
panel_2 = Panel(py3.properties)

# ---- group: Get Material - supported part
list = ValueList({"S235 (Structural Steel)", "42CrMo4 (Heat-resistant Steel)", "1.4301 (Stainless Steel)", "EN AW-6061 (Aluminum Alloy)", "Cu-ETP (Copper)"}, selected="Cu-ETP (Copper)")
list_2 = ValueList({"Material", "Elastic Modulus", "Shear Modulus", "Density", "Ultimate Strength", "Yield Strength", "Shear Strength", "Poisson's Ratio"}, selected="Density")
py3_2 = Python3Script(csv_filename="materials.csv", material=list, prop=list_2)  # -> out, materials, properties, value
# ---------- py3_2: Python ----------
import os, sys, re
import csv

def clean_header(header: str) -> str:
    """Remove units in square brackets, e.g. '[MPa]'."""
    return re.sub(r"\s*\[.*?\]", "", header).strip()

def load_csv_as_dict(path_to_csv: str):
    """
    Load a CSV and return a dictionary keyed by the first column.
    Each value is a dict of header -> cell_value for that row.
    """

    if not os.path.isfile(path_to_csv):
        raise FileNotFoundError(f"CSV file not found: {path_to_csv}")

    data_dict = {}

    with open(path_to_csv, newline='', encoding="utf-8") as f:
        reader = csv.reader(f)

        # Read and clean headers
        raw_headers = next(reader)
        headers = [clean_header(h) for h in raw_headers]

        # Use new headers in DictReader
        f.seek(0)
        dict_reader = csv.DictReader(f, fieldnames=headers)
        next(dict_reader)  # skip original header row

        first_col = headers[0]

        for row in dict_reader:
            key = row[first_col]
            data_dict[key] = row.copy()

    return data_dict

# ----------------------------------------------------------------------
# 1. Make sure the folder containing this .gh file is on sys.path
# ----------------------------------------------------------------------
gh_path = ghdoc.Path  # full path to the current Grasshopper file
if gh_path:
    gh_dir = os.path.dirname(gh_path)
    parent_dir = os.path.dirname(gh_dir)   # /path/to/parent/folder

    csv_path = os.path.join(parent_dir, csv_filename)

    material_dictionary = load_csv_as_dict(csv_path)

    materials = list(material_dictionary.keys())
    properties = list(material_dictionary[materials[0]].keys())
    
    value = material_dictionary[material][prop]
# ---------- end py3_2 ----------
panel_3 = Panel(py3_2.value)
panel_4 = Panel(py3_2.materials)
panel_5 = Panel(py3_2.properties)

# ---- group: Select face
debrep = DeconstructBrep(Brep=brep)  # -> Faces, Edges, Vertices
debrep_2 = DeconstructBrep(Brep=brep_2)  # -> Faces, Edges, Vertices
item = ListItem(List=debrep.Faces, Index=Slider(1, range=0..10), Wrap=True)
item_2 = ListItem(List=debrep_2.Faces, Index=Slider(5, range=0..10), Wrap=True)

# ---- group: Viz BREPs
merge = Merge(Data1=brep, Data2=brep_2)
preview = CustomPreview(Geometry=merge, Material=ColourSwatch(SwatchColor=RGBA(122, 122, 122, 92)))

# ---- group: min bracket extension to first fixture
number_slider = Slider(500, range=0..500)

# ----
number_slider_2 = Slider(50, range=0..200)

# ---- group: plate thickness (mm)
number_slider_3 = Slider(13.4, range=0..25)

# ---- group: Init bolt radius
number_slider_4 = Slider(8, range=0..10)

# ---- group: bolt spacing Y mult
number_slider_5 = Slider(2, range=1..5)

number_slider_6 = Slider(2, range=1..5)

# ---- group: max bolt dia
number_slider_7 = Slider(20, range=0..20)

# ---- group: vector thickness
number_slider_8 = Slider(5, range=0..10)

# ----
list_3 = ValueList({"S235 (Structural Steel)", "42CrMo4 (Heat-resistant Steel)", "1.4301 (Stainless Steel)", "EN AW-6061 (Aluminum Alloy)", "Cu-ETP (Copper)"}, selected="Cu-ETP (Copper)")
list_4 = ValueList({"S235 (Structural Steel)", "42CrMo4 (Heat-resistant Steel)", "1.4301 (Stainless Steel)", "EN AW-6061 (Aluminum Alloy)", "Cu-ETP (Copper)"}, selected="1.4301 (Stainless Steel)")

# ---- group: Vector scaling
number_slider_9 = Slider(0.022, range=0..0.1)

# ---- group: Num ribs
number_slider_10 = Slider(1, range=0..2)

# ----
merge_2 = Merge(Data1=brep_2)
py3_3 = Python3Script(
    free_objects=merge_2,
    srf_1=item,
    srf_2=item_2,
    min_bracket_extension=number_slider,
    max_bolt_dia=number_slider_7,
    min_edge_clearance=number_slider_2,
    bolt_spacing_1=number_slider_6,
    bolt_spacing_2=number_slider_5,
    init_bolt_radius=number_slider_4,
    init_plate_thickness=number_slider_3,
    num_ribs=number_slider_10,
    material_csv="materials.csv",
    material_free=list_3,
    material_bracket=list_4)  # -> out, plane_1, plane_2, perp_1, perp_2, boundary_1, boundary_2, boundary_pts_1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; inputs free_objects: list of Brep, srf_1: Surface, srf_2: Surface; disabled
# ---------- py3_3: Python ----------
import Rhino
import Rhino.Geometry as rg
from Rhino.Geometry.Intersect import Intersection

tol = Rhino.RhinoDoc.ActiveDoc.ModelAbsoluteTolerance

def add_unique(pt, pts, tol):
    for p in pts:
        if pt.DistanceTo(p) <= tol:
            return
    pts.append(pt)

ok, plane = srf_1.TryGetPlane()  # you can also pass a tolerance
if ok:
    plane_1 = plane

curves = srf_1.ToBrep().DuplicateEdgeCurves()

boundary_pts_1 = []

for crv in curves:
    add_unique(crv.PointAtStart, boundary_pts_1, tol)
    add_unique(crv.PointAtEnd, boundary_pts_1, tol)
   
# join using document tolerance
joined = rg.Curve.JoinCurves(curves, tol)

# usually returns a list (often length = 1)
boundary_1 = joined[0] if len(joined) == 1 else joined

ok, plane = srf_2.TryGetPlane()  # you can also pass a tolerance
if ok:
    plane_2 = plane

perp_1 = plane_1.ZAxis
perp_1.Unitize()

perp_2 = plane_2.ZAxis
perp_2.Unitize()

curves = srf_2.ToBrep().DuplicateEdgeCurves()

boundary_pts_2 = []

for crv in curves:
    add_unique(crv.PointAtStart, boundary_pts_2, tol)
    add_unique(crv.PointAtEnd, boundary_pts_2, tol)

# join using document tolerance
joined = rg.Curve.JoinCurves(curves, tol)

# usually returns a list (often length = 1)
boundary_2 = joined[0] if len(joined) == 1 else joined

ok, line = Intersection.PlanePlane(plane_1, plane_2)
plane_intersection = line if ok else None   # None if parallel / coincident

def get_far_edge(pts, line):

    max_distance = 0
    far_edge = None
    
    for pt in pts:
        t = line.ClosestParameter(pt)
        closest_pt = line.PointAt(t)

        if closest_pt:
            distance = closest_pt.DistanceTo(pt)
            if distance > max_distance:
                max_distance = distance
                far_edge = rg.Line(closest_pt, pt)
    
    return far_edge

far_edge_1 = get_far_edge(boundary_pts_1, plane_intersection)
far_edge_2 = get_far_edge(boundary_pts_2, plane_intersection)

def get_params(pts, line):
    return [line.ClosestParameter(pt) for pt in pts]

all_params = get_params(boundary_pts_1, line) + get_params(boundary_pts_2, line)
all_params.sort()

intersect_line_pt_1 = plane_intersection.PointAt(all_params[0])
intersect_line_pt_2 = plane_intersection.PointAt(all_params[-1])

intersect_line = rg.Line(intersect_line_pt_1, intersect_line_pt_2)

poly_1 = boundary_1.DuplicateCurve()

vec = far_edge_1.Direction
vec.Unitize()
vec *= -1 * min_bracket_extension

poly_1.Transform(rg.Transform.Translation(vec))

poly_2 = boundary_2.DuplicateCurve()

vec = far_edge_2.Direction
vec.Unitize()
vec *= -1 * min_bracket_extension

poly_2.Transform(rg.Transform.Translation(vec))


from typing import List, Tuple

Interval = Tuple[float, float]

def find_overlapping_regions(a: List[Interval], b: List[Interval]) -> List[Interval]:
    """
    Given two sets of intervals `a` and `b`, return all overlapping regions.
    
    Intervals are treated as half-open: [start, end).
    So two intervals [s1, e1) and [s2, e2) overlap if max(s1, s2) < min(e1, e2).
    
    Parameters
    ----------
    a : List[Interval]
        First list of intervals as (start, end).
    b : List[Interval]
        Second list of intervals as (start, end).
    
    Returns
    -------
    List[Interval]
        List of overlapping intervals as (start, end).
    """
    # Sort both lists by start time
    a_sorted = sorted(a, key=lambda x: x[0])
    b_sorted = sorted(b, key=lambda x: x[0])
    
    i = j = 0
    overlaps: List[Interval] = []
    
    while i < len(a_sorted) and j < len(b_sorted):
        a_start, a_end = a_sorted[i]
        b_start, b_end = b_sorted[j]
        
        # Compute overlap between a[i] and b[j]
        start = max(a_start, b_start)
        end = min(a_end, b_end)
        
        # If they actually overlap, record it
        if start < end:  # use <= if you want closed intervals [start, end]
            overlaps.append((start, end))
        
        # Move the pointer that ends first
        if a_end < b_end:
            i += 1
        else:
            j += 1
    
    return overlaps

intervals = []

for poly_index, poly in enumerate([poly_1, poly_2]):

    poly_pts = list(poly.ToArray())

    params = [0.0, 1.0]

    for index, pt_1 in enumerate(poly_pts[:-1]):
        poly_edge = rg.Line(pt_1, poly_pts[index + 1])
        success, p1, p2 = Intersection.LineLine(intersect_line, poly_edge)

        if p2 > -0.01 and p2 < 1.01: # intersection within poly edge
            if p1 > -0.01 and p1 < 1.01:
                params.append(p1)

    tol = 0.01

    final_params = []

    for param in params:
        found = False
        for final_param in final_params:
            if abs(param - final_param) < tol:
                found = True
                break
        if not found:
            final_params.append(param)

    final_params.sort()

    intervals.append([])

    plane = [plane_1, plane_2][poly_index]

    for int_num in range(len(final_params)-1):
        mid = (final_params[int_num] + final_params[int_num + 1]) / 2
        mid_pt = intersect_line.PointAt(mid)

        contains = poly.ToNurbsCurve().Contains(mid_pt, plane, tol)

        if contains == rg.PointContainment.Inside:
            intervals[-1].append((final_params[int_num], final_params[int_num + 1]))

print(intervals)

overlaps = find_overlapping_regions(intervals[0], intervals[1])

print(overlaps)

mids = [intersect_line.PointAt((overlap[0] + overlap[1]) / 2) for overlap in overlaps]

placement_edge = rg.Line(intersect_line.PointAt(overlaps[0][0]), intersect_line.PointAt(overlaps[0][1]))
mid = mids[0]

def get_mid_extension(ref_edge, placement_edge, intersect_boundary):

    placement_1 = rg.Line(ref_edge.From, ref_edge.To)
    placement_1.Transform(rg.Transform.Translation(rg.Vector3d(placement_edge.From) - rg.Vector3d(ref_edge.From)))
    placement_2 = rg.Line(ref_edge.From, ref_edge.To)
    placement_2.Transform(rg.Transform.Translation(rg.Vector3d(placement_edge.To) - rg.Vector3d(ref_edge.From)))

    inters = rg.Intersect.Intersection.CurveLine(intersect_boundary, placement_1, tol, tol)
    tB = [inter.ParameterB for inter in inters]
    largest_1 = sorted(tB)[-1]
    inters = rg.Intersect.Intersection.CurveLine(intersect_boundary, placement_2, tol, tol)
    tB = [inter.ParameterB for inter in inters]
    largest_2 = sorted(tB)[-1]

    extension_p = sorted([largest_1, largest_2])[0]
    extension_pt = ref_edge.PointAt(extension_p)

    mid_extension = rg.Line(ref_edge.From, extension_pt)
    mid_extension.Transform(rg.Transform.Translation(rg.Vector3d(mid) - rg.Vector3d(ref_edge.From)))

    return mid_extension

mid_extension_1 = get_mid_extension(far_edge_1, placement_edge, boundary_1)
mid_extension_2 = get_mid_extension(far_edge_2, placement_edge, boundary_2)

half_bracket_width = max_bolt_dia * 5 # 2D rule
bracket_width = half_bracket_width * 2
quarter_bracket_width = half_bracket_width / 2

axis_0 = placement_edge.Direction
axis_0.Unitize()

axis_1 = mid_extension_1.Direction
axis_1.Unitize()

axis_2 = mid_extension_2.Direction
axis_2.Unitize()

def get_near_far(line, poly, plane):
    intervals = []

    # for poly_index, poly in enumerate([poly_1, poly_2]):

    poly_pts = list(poly.ToArray())

    params = [0.0]
    # params = []

    for index, pt_1 in enumerate(poly_pts[:-1]):
        poly_edge = rg.Line(pt_1, poly_pts[index + 1])
        success, p1, p2 = rg.Intersect.Intersection.LineLine(line, poly_edge)

        if p2 > -0.01 and p2 < 1.01: # intersection within poly edge
            if p1 > -0.01:
                params.append(p1)

    # tol = 0.3

    final_params = []

    for param in params:
        found = False
        for final_param in final_params:
            if abs(param - final_param) < tol:
                found = True
                break
        if not found:
            final_params.append(param)

    final_params.sort()

    print(final_params)

    intervals = []

    for int_num in range(len(final_params)-1):
        mid = (final_params[int_num] + final_params[int_num + 1]) / 2
        mid_pt = line.PointAt(mid)

        contains = poly.ToNurbsCurve().Contains(mid_pt, plane, tol)

        if contains == rg.PointContainment.Inside:
            intervals.append((final_params[int_num], final_params[int_num + 1]))

    print(intervals)

    near = line.PointAt(0.0).DistanceTo(line.PointAt(intervals[0][0]))
    far = line.PointAt(0.0).DistanceTo(line.PointAt(intervals[0][1]))

    return near, far


lines_1 = []

for fac in [-1, 1]:
    new_line = rg.Line(mid_extension_1.From, mid_extension_1.To)
    vec = rg.Vector3d(axis_0)
    vec *= quarter_bracket_width * fac
    new_line.Transform(rg.Transform.Translation(vec))
    lines_1.append(new_line)

near_1 = []
far_1 = []

for line in lines_1:
    near, far = get_near_far(line, boundary_1, plane_1)
    near_1.append(near)
    far_1.append(far)
    
lines_2 = []

for fac in [-1, 1]:
    new_line = rg.Line(mid_extension_2.From, mid_extension_2.To)
    vec = rg.Vector3d(axis_0)
    vec *= quarter_bracket_width * fac
    new_line.Transform(rg.Transform.Translation(vec))
    lines_2.append(new_line)

near_2 = []
far_2 = []

for line in lines_2:
    near, far = get_near_far(line, boundary_2, plane_2)
    near_2.append(near)
    far_2.append(far)


far_1.sort()
first_far_1 = far_1[0]

near_1.sort()
last_near_1 = near_1[-1]

cp_bolts_1_1 = last_near_1 + min_edge_clearance
cp_bolts_1_2 = cp_bolts_1_1 + half_bracket_width * bolt_spacing_1

far_1_options = [first_far_1, cp_bolts_1_2]
far_1_options.sort()
cp_bolts_1_2 = far_1_options[0]

cps_bolts_1 = []

for i in [quarter_bracket_width, -1 * quarter_bracket_width]:
    for j in [cp_bolts_1_1, cp_bolts_1_2]:
        new_bolt_cp = rg.Point3d(mid) # copy mid pt
        vec = rg.Vector3d(axis_0)
        vec *= i
        new_bolt_cp.Transform(rg.Transform.Translation(vec))
        vec = rg.Vector3d(axis_1)
        vec *= j
        new_bolt_cp.Transform(rg.Transform.Translation(vec))
        cps_bolts_1.append(new_bolt_cp)

bolt_circles_1 = []

for cp in cps_bolts_1:
    bolt_circles_1.append(rg.Circle(plane_1, cp, init_bolt_radius))

far_2.sort()
first_far_2 = far_2[0]

near_2.sort()
last_near_2 = near_2[-1]

cp_bolts_2_1 = last_near_2 + min_edge_clearance
cp_bolts_2_2 = cp_bolts_2_1 + half_bracket_width * bolt_spacing_2

far_2_options = [first_far_2, cp_bolts_2_2]
far_2_options.sort()
cp_bolts_2_2 = far_2_options[0]

cps_bolts_2 = []

for i in [quarter_bracket_width, -1 * quarter_bracket_width]:
    for j in [cp_bolts_2_1, cp_bolts_2_2]:
        new_bolt_cp = rg.Point3d(mid) # copy mid pt
        vec = rg.Vector3d(axis_0)
        vec *= i
        new_bolt_cp.Transform(rg.Transform.Translation(vec))
        vec = rg.Vector3d(axis_2)
        vec *= j
        new_bolt_cp.Transform(rg.Transform.Translation(vec))
        cps_bolts_2.append(new_bolt_cp)

bolt_circles_2 = []

for cp in cps_bolts_2:
    bolt_circles_2.append(rg.Circle(plane_2, cp, init_bolt_radius))

bolt_extension = 10
bolts_geo = []

for circle in bolt_circles_1:
    c = circle.ToNurbsCurve().DuplicateCurve()
    v = rg.Vector3d(perp_1)
    v *= -bolt_extension
    c.Transform(rg.Transform.Translation(v))
    brep = rg.Extrusion.Create(c, bolt_extension * 2 + init_plate_thickness, True)
    bolts_geo.append(brep)

for circle in bolt_circles_2:
    c = circle.ToNurbsCurve().DuplicateCurve()
    v = rg.Vector3d(perp_2)
    v *= -bolt_extension
    c.Transform(rg.Transform.Translation(v))
    brep = rg.Extrusion.Create(c, bolt_extension * 2 + init_plate_thickness, True)
    bolts_geo.append(brep)

corner_pt = rg.Point3d(mid)
v = rg.Vector3d(axis_0)
v *= -half_bracket_width
corner_pt.Transform(rg.Transform.Translation(v))

corner_pts = []
for i,d in enumerate([axis_1, axis_2]):
    v = rg.Vector3d(d)
    v *= [cp_bolts_1_2, cp_bolts_2_2][i] + quarter_bracket_width
    new_pt = rg.Point3d(corner_pt)
    new_pt.Transform(rg.Transform.Translation(v))
    corner_pts.append(new_pt)

corner_pts.insert(1, corner_pt)

profile_poly = rg.Polyline(corner_pts)

profile_plane = rg.Plane(corner_pt, axis_0)

profile_crv = profile_poly.ToNurbsCurve()
profile_offset = profile_crv.ToNurbsCurve().Offset(profile_plane, init_plate_thickness, tol, rg.CurveOffsetCornerStyle.Sharp)[0]
profile_offset.Reverse()

cap_lines = []
cap_lines.append(rg.Line(profile_crv.PointAtStart, profile_offset.PointAtEnd))
cap_lines.append(rg.Line(profile_offset.PointAtStart, profile_crv.PointAtEnd))

profile = rg.Curve.JoinCurves([profile_crv, profile_offset] + [cap_line.ToNurbsCurve() for cap_line in cap_lines])[0]
bracket_geo = rg.Extrusion.Create(profile, bracket_width, True)


bracket_geo_bool = bracket_geo.ToBrep().Duplicate()

for other_geo in bolts_geo:
    print(bracket_geo_bool)
    print(other_geo)
    bracket_geo_bool = rg.Brep.CreateBooleanDifference(bracket_geo_bool, other_geo.ToBrep(), tol)[0]

inside_poly = profile_offset.ControlPolygon()
if not inside_poly.IsClosed:
    pts = list(inside_poly.ToArray())
    inside_poly = rg.Polyline(pts + [pts[0]])

inside_rib = rg.Extrusion.Create(inside_poly.ToNurbsCurve(), init_plate_thickness, True)

facs = []

if num_ribs == 1:
    facs = [0.5]
elif num_ribs == 2:
    facs = [0, 1]

inside_ribs = []

for fac in facs:
    new_rib = inside_rib.Duplicate()
    v = rg.Vector3d(axis_0)
    v *= bracket_width * fac - init_plate_thickness * fac
    new_rib.Transform(rg.Transform.Translation(v))
    inside_ribs.append(new_rib.ToBrep())

bracket_solid = rg.Brep.CreateBooleanUnion([bracket_geo_bool] + inside_ribs, tol)[0]

# Import material library

import os, sys, re
import csv

def clean_header(header: str) -> str:
    """Remove units in square brackets, e.g. '[MPa]'."""
    return re.sub(r"\s*\[.*?\]", "", header).strip()

def load_csv_as_dict(path_to_csv: str):
    """
    Load a CSV and return a dictionary keyed by the first column.
    Each value is a dict of header -> cell_value for that row.
    """

    if not os.path.isfile(path_to_csv):
        raise FileNotFoundError(f"CSV file not found: {path_to_csv}")

    data_dict = {}

    with open(path_to_csv, newline='', encoding="utf-8") as f:
        reader = csv.reader(f)

        # Read and clean headers
        raw_headers = next(reader)
        headers = [clean_header(h) for h in raw_headers]

        # Use new headers in DictReader
        f.seek(0)
        dict_reader = csv.DictReader(f, fieldnames=headers)
        next(dict_reader)  # skip original header row

        first_col = headers[0]

        for row in dict_reader:
            key = row[first_col]
            data_dict[key] = row.copy()

    return data_dict

# ----------------------------------------------------------------------
# 1. Make sure the folder containing this .gh file is on sys.path
# ----------------------------------------------------------------------
gh_path = ghdoc.Path  # full path to the current Grasshopper file
if gh_path:
    gh_dir = os.path.dirname(gh_path)
    parent_dir = os.path.dirname(gh_dir)   # /path/to/parent/folder

    csv_path = os.path.join(parent_dir, material_csv)

    material_dictionary = load_csv_as_dict(csv_path)

    materials = list(material_dictionary.keys())
    properties = list(material_dictionary[materials[0]].keys())
    
free_density = float(material_dictionary[material_free]["Density"])

free_volume = 0

for free_object in free_objects:
    free_volume += free_object.GetVolume() / 1000000000

free_mass = free_volume * free_density
gravity_force_1 = free_mass * 9.81

mp = rg.VolumeMassProperties.Compute(free_objects[0])
free_cg = mp.Centroid if mp else None

bracket_density = float(material_dictionary[material_bracket]["Density"])
bracket_volume = bracket_solid.GetVolume() / 1000000000
bracket_mass = bracket_volume * bracket_density

combined_mass = free_mass + bracket_mass
gravity_force_2 = combined_mass * 9.81

print("combined_mass: {}".format(combined_mass))
print("gravity_force_2: {}".format(gravity_force_2))

mp = rg.VolumeMassProperties.Compute(bracket_solid)
bracket_cg = mp.Centroid if mp else None

x = 0
y = 0
z = 0

for i, pt in enumerate([free_cg, bracket_cg]):
    x += [free_mass, bracket_mass][i] * pt.X
    y += [free_mass, bracket_mass][i] * pt.Y
    z += [free_mass, bracket_mass][i] * pt.Z

x /= combined_mass
y /= combined_mass
z /= combined_mass

combined_cg = rg.Point3d(x, y, z)


## Calc reactions (at free flange)

# r: numpy

import sys
import os
import importlib

# ----------------------------------------------------------------------
# 1. Make sure the folder containing this .gh file is on sys.path
# ----------------------------------------------------------------------
gh_path = ghdoc.Path  # full path to the current Grasshopper file
if gh_path:
    gh_dir = os.path.dirname(gh_path)
    parent_dir = os.path.dirname(gh_dir)   # /path/to/parent/folder

    if parent_dir not in sys.path:
        sys.path.append(parent_dir)

# ----------------------------------------------------------------------
# 2. Import (and reload) your module
# ----------------------------------------------------------------------
import scripts.rigid_body_solver
importlib.reload(scripts.rigid_body_solver)

from scripts.rigid_body_solver import calculate_equilibrium_reactions, split_vector, vector_magnitude

# ----------------------------------------------------------------------
# 3. Call your function using Grasshopper inputs
#    (hook these up in the component: supports, loads, etc.)
# ----------------------------------------------------------------------

# Applied loads at the centre of gravity
applied_F = [0, 0, gravity_force_1]    # in Newtons
applied_M = [0, 0, 0]      # in Newton-meters

print(applied_F)
print(applied_M)

# Define the centre of gravity coordinates (global system)
cg = [free_cg.X/1000, free_cg.Y/1000, free_cg.Z/1000]  # Example: CG at the origin; change as needed

# Define n reaction (support) points in the global coordinate system (meters)
# Example: An equilateral triangle in the horizontal (XY) plane.
reaction_points = [ [pt.X/1000, pt.Y/1000, pt.Z/1000] for pt in cps_bolts_2 ]

# Calculate the reaction forces at the three support points.
reactions = calculate_equilibrium_reactions(applied_F, applied_M, reaction_points, cg)

# Display the results:
print("Applied Force (N):", applied_F)
print("Applied Moment (N·m):", applied_M)
print("Centre of Gravity (m):", cg, "\n")

print("---- Reaction Points and Their Reaction Loads ----")
for i, (point, reaction) in enumerate(zip(reaction_points, reactions), start=1):
    mag = vector_magnitude(reaction)
    print(f"Support {i} at {point} -> Reaction Force: {reaction} N, Magnitude: {mag:.2f} N")

'''
R: reaction vector
T: axial portion of reaction vector
S: shear portion of reaction vector
'''

R_2 = [ rg.Vector3d(reaction[0], reaction[1], reaction[2]) for reaction in reactions ]

T_2 = []
S_2 = []

for reaction in R_2:

    v = [ perp_2.X, perp_2.Y, perp_2.Z ]
    u = [ reaction.X, reaction.Y, reaction.Z ]

    t, s = split_vector(u, v)

    T_2.append(rg.Vector3d(t[0], t[1], t[2]))
    S_2.append(rg.Vector3d(s[0], s[1], s[2]))

## Bolt sizing

import scripts.bolt_sizing
importlib.reload(scripts.bolt_sizing)

from scripts.bolt_sizing import select_bolt_gh, summarize_result

# ----------------------------------------------------------------------
# 3. Call your function using Grasshopper inputs
#    (hook these up in the component: supports, loads, etc.)
# ----------------------------------------------------------------------

bolt_summary = []
bolt_sizes = []
bolt_hole_sizes = []

for T, S in zip(T_2, S_2):
    result, summary = select_bolt_gh(T.Length, S.Length)

    bolt_summary.append(summary)
    bolt_sizes.append(result.size)
    bolt_hole_sizes.append(result.hole_size)

hole_size_2 = sorted(list(bolt_hole_sizes))[-1]


## Calc reactions (at attached flange)

# Applied loads at the centre of gravity
applied_F = [0, 0, gravity_force_2]    # in Newtons
applied_M = [0, 0, 0]      # in Newton-meters

print(applied_F)
print(applied_M)

# Define the centre of gravity coordinates (global system)
cg = [combined_cg.X/1000, combined_cg.Y/1000, combined_cg.Z/1000]  # Example: CG at the origin; change as needed

# Define n reaction (support) points in the global coordinate system (meters)
# Example: An equilateral triangle in the horizontal (XY) plane.
reaction_points = [ [pt.X/1000, pt.Y/1000, pt.Z/1000] for pt in cps_bolts_1 ]

# Calculate the reaction forces at the three support points.
reactions = calculate_equilibrium_reactions(applied_F, applied_M, reaction_points, cg)

# Display the results:
print("Applied Force (N):", applied_F)
print("Applied Moment (N·m):", applied_M)
print("Centre of Gravity (m):", cg, "\n")

print("---- Reaction Points and Their Reaction Loads ----")
for i, (point, reaction) in enumerate(zip(reaction_points, reactions), start=1):
    mag = vector_magnitude(reaction)
    print(f"Support {i} at {point} -> Reaction Force: {reaction} N, Magnitude: {mag:.2f} N")

'''
R: reaction vector
T: axial portion of reaction vector
S: shear portion of reaction vector
'''

R_1 = [ rg.Vector3d(reaction[0], reaction[1], reaction[2]) for reaction in reactions ]

T_1 = []
S_1 = []

for reaction in R_1:

    v = [ perp_1.X, perp_1.Y, perp_1.Z ]
    u = [ reaction.X, reaction.Y, reaction.Z ]

    t, s = split_vector(u, v)

    T_1.append(rg.Vector3d(t[0], t[1], t[2]))
    S_1.append(rg.Vector3d(s[0], s[1], s[2]))

## Bolt sizing

import scripts.bolt_sizing
importlib.reload(scripts.bolt_sizing)

from scripts.bolt_sizing import select_bolt_gh, summarize_result

# ----------------------------------------------------------------------
# 3. Call your function using Grasshopper inputs
#    (hook these up in the component: supports, loads, etc.)
# ----------------------------------------------------------------------

# bolt_summary = []
# bolt_sizes = []
# bolt_hole_sizes = []

new_bolt_hole_sizes = []

for T, S in zip(T_1, S_1):
    result, summary = select_bolt_gh(T.Length, S.Length)

    bolt_summary.append(summary)
    bolt_sizes.append(result.size)
    new_bolt_hole_sizes.append(result.hole_size)

hole_size_1 = sorted(list(new_bolt_hole_sizes))[-1]

bolt_hole_sizes += new_bolt_hole_sizes


F1 = T_2[1] + T_2[3]
F2 = T_2[0] + T_2[2]

L1 = cp_bolts_2_2
L2 = cp_bolts_2_1

print(L1)
print(L2)

F1 *= L1
F2 *= L2

M = F1 - F2

print("M: {}".format(M.Length))

bb = bracket_solid.GetBoundingBox(plane_2)
bb_height = (bb.Max.Z - bb.Min.Z)

bracket_yield_strength = float(material_dictionary[material_bracket]["Yield Strength"])

b = bracket_width / 1000
h = bb_height / 1000
s = bracket_yield_strength * 1000000

# ----------------------------------------------------------------------
# 2. Import (and reload) your module
# ----------------------------------------------------------------------
import scripts.section_sizing
importlib.reload(scripts.section_sizing)

from scripts.section_sizing import optimum_thickness

# ----------------------------------------------------------------------
# 3. Call your function using Grasshopper inputs
#    (hook these up in the component: supports, loads, etc.)
# ----------------------------------------------------------------------

t_opt = optimum_thickness(b, h, M, s) * 1000
print(f"Optimum flange thickness: {t_opt:.4f} mm")
# ---------- end py3_3 ----------
py3_4 = Python3Script(
    free_objects=merge_2,
    srf_1=item,
    srf_2=item_2,
    min_bracket_extension=number_slider,
    max_bolt_dia=number_slider_7,
    min_edge_clearance=number_slider_2,
    bolt_spacing_1=number_slider_6,
    bolt_spacing_2=number_slider_5,
    init_bolt_radius=number_slider_4,
    init_plate_thickness=number_slider_3,
    num_ribs=number_slider_10,
    material_csv="materials.csv",
    material_free=list_3,
    material_bracket=list_4)  # -> out, plane_2, boundary_1, boundary_2, far_edge_1, far_edge_2, intersect_line, placement_edge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; inputs free_objects: list of Brep, srf_1: Surface, srf_2: Surface; disabled
# ---------- py3_4: Python ----------
import os, sys, re, csv, importlib
from typing import List, Tuple, Optional, Callable

import Rhino
import Rhino.Geometry as rg
from Rhino.Geometry.Intersect import Intersection

# ----------------------------------------------------------------------
# Settings
# ----------------------------------------------------------------------
DEBUG = False  # set True to see log output

DOC_TOL = Rhino.RhinoDoc.ActiveDoc.ModelAbsoluteTolerance
PARAM_TOL = 0.01  # your original param dedupe / contains tol
EPS_EDGE = 0.01   # your original line/edge intersection gate +/-


Interval = Tuple[float, float]


# ----------------------------------------------------------------------
# Logging / guardrails
# ----------------------------------------------------------------------
def make_logger(enabled: bool) -> Callable[[str], None]:
    def _log(msg: str) -> None:
        if enabled:
            print(msg)
    return _log


def require(cond: bool, msg: str):
    if not cond:
        raise ValueError(msg)


# ----------------------------------------------------------------------
# Small utilities
# ----------------------------------------------------------------------
def add_unique_point(pt: rg.Point3d, pts: List[rg.Point3d], tol: float) -> None:
    for p in pts:
        if pt.DistanceTo(p) <= tol:
            return
    pts.append(pt)


def unique_floats(values: List[float], tol: float) -> List[float]:
    out: List[float] = []
    for v in values:
        if not any(abs(v - u) < tol for u in out):
            out.append(v)
    out.sort()
    return out


def unitized(v: rg.Vector3d) -> rg.Vector3d:
    vv = rg.Vector3d(v)
    vv.Unitize()
    return vv


def translate_geom(geom, vec: rg.Vector3d):
    geom.Transform(rg.Transform.Translation(vec))
    return geom


# ----------------------------------------------------------------------
# Surface/boundary extraction
# ----------------------------------------------------------------------
def surface_plane(srf: rg.Surface) -> rg.Plane:
    ok, plane = srf.TryGetPlane()
    require(ok, "Surface is not planar (TryGetPlane failed).")
    return plane


def surface_boundary(srf: rg.Surface, tol: float) -> rg.Curve:
    curves = srf.ToBrep().DuplicateEdgeCurves()
    require(curves is not None and len(curves) > 0, "Surface has no edge curves.")
    joined = rg.Curve.JoinCurves(curves, tol)
    require(joined is not None and len(joined) > 0, "Failed to join surface edge curves.")

    # Behavior note: your old script allowed either a single curve or a list.
    # Downstream, you treat it like a curve (DuplicateCurve, ToArray, ToNurbsCurve),
    # so we REQUIRE that it is actually a single curve to avoid silent weirdness.
    require(len(joined) == 1, f"Expected 1 joined boundary curve; got {len(joined)}. Consider selecting the outer loop only.")
    return joined[0]


def surface_boundary_points(srf: rg.Surface, tol: float) -> List[rg.Point3d]:
    curves = srf.ToBrep().DuplicateEdgeCurves()
    require(curves is not None and len(curves) > 0, "Surface has no edge curves.")
    pts: List[rg.Point3d] = []
    for crv in curves:
        add_unique_point(crv.PointAtStart, pts, tol)
        add_unique_point(crv.PointAtEnd, pts, tol)
    require(len(pts) >= 2, "Failed to extract boundary points.")
    return pts


def surface_frame(srf: rg.Surface, tol: float):
    plane = surface_plane(srf)
    perp = unitized(plane.ZAxis)
    boundary = surface_boundary(srf, tol)
    bpts = surface_boundary_points(srf, tol)
    return plane, perp, boundary, bpts


# ----------------------------------------------------------------------
# Intersections / interval logic
# ----------------------------------------------------------------------
def plane_plane_intersection_line(p1: rg.Plane, p2: rg.Plane) -> rg.Line:
    ok, line = Intersection.PlanePlane(p1, p2)
    require(ok, "Planes are parallel or coincident; no unique intersection line.")
    return line


def far_edge_from_points_to_line(pts: List[rg.Point3d], line: rg.Line) -> rg.Line:
    max_distance = -1.0
    far_edge: Optional[rg.Line] = None

    for pt in pts:
        t = line.ClosestParameter(pt)
        closest_pt = line.PointAt(t)
        d = closest_pt.DistanceTo(pt)
        if d > max_distance:
            max_distance = d
            far_edge = rg.Line(closest_pt, pt)

    require(far_edge is not None, "Could not compute far edge (no points?).")
    return far_edge


def clip_line_to_param_range(line: rg.Line, params: List[float]) -> rg.Line:
    require(len(params) >= 2, "Need at least 2 params to clip intersection line.")
    params_sorted = sorted(params)
    a = line.PointAt(params_sorted[0])
    b = line.PointAt(params_sorted[-1])
    return rg.Line(a, b)


def find_overlapping_regions(a: List[Interval], b: List[Interval]) -> List[Interval]:
    a_sorted = sorted(a, key=lambda x: x[0])
    b_sorted = sorted(b, key=lambda x: x[0])

    i = j = 0
    overlaps: List[Interval] = []

    while i < len(a_sorted) and j < len(b_sorted):
        a_start, a_end = a_sorted[i]
        b_start, b_end = b_sorted[j]

        start = max(a_start, b_start)
        end = min(a_end, b_end)

        if start < end:
            overlaps.append((start, end))

        if a_end < b_end:
            i += 1
        else:
            j += 1

    return overlaps


def curve_intervals_inside_poly_on_line(
    log: Callable[[str], None],
    line: rg.Line,
    poly_crv: rg.Curve,
    plane: rg.Plane,
    param_tol: float,
    contain_tol: float,
) -> List[Interval]:
    poly_pts = list(poly_crv.ToArray())
    require(len(poly_pts) >= 2, "Polygon curve has too few points (ToArray).")

    params = [0.0, 1.0]

    for i, a in enumerate(poly_pts[:-1]):
        edge = rg.Line(a, poly_pts[i + 1])
        success, p_line, p_edge = Intersection.LineLine(line, edge)
        if not success:
            continue

        if (-EPS_EDGE <= p_edge <= 1.0 + EPS_EDGE) and (-EPS_EDGE <= p_line <= 1.0 + EPS_EDGE):
            params.append(p_line)

    final_params = unique_floats(params, param_tol)
    require(len(final_params) >= 2, "Failed to compute usable intersection params.")

    intervals: List[Interval] = []
    nurbs = poly_crv.ToNurbsCurve()

    for k in range(len(final_params) - 1):
        mid = (final_params[k] + final_params[k + 1]) / 2.0
        mid_pt = line.PointAt(mid)

        contains = nurbs.Contains(mid_pt, plane, contain_tol)

        # Keep your original behavior: only Inside counts.
        # (You might later choose to treat Boundary as Inside.)
        if contains == rg.PointContainment.Inside:
            intervals.append((final_params[k], final_params[k + 1]))

    log(f"intervals: {intervals}")
    return intervals


def near_far_distances_on_line_for_inside_interval(line: rg.Line, inside: Interval) -> Tuple[float, float]:
    near = line.PointAt(0.0).DistanceTo(line.PointAt(inside[0]))
    far = line.PointAt(0.0).DistanceTo(line.PointAt(inside[1]))
    return near, far


# ----------------------------------------------------------------------
# Geometry construction helpers
# ----------------------------------------------------------------------
def mid_extension_line(
    ref_edge: rg.Line,
    placement_edge: rg.Line,
    intersect_boundary: rg.Curve,
    tol: float,
    mid_pt: rg.Point3d,
) -> rg.Line:
    placement_1 = rg.Line(ref_edge.From, ref_edge.To)
    translate_geom(placement_1, rg.Vector3d(placement_edge.From) - rg.Vector3d(ref_edge.From))

    placement_2 = rg.Line(ref_edge.From, ref_edge.To)
    translate_geom(placement_2, rg.Vector3d(placement_edge.To) - rg.Vector3d(ref_edge.From))

    inters = rg.Intersect.Intersection.CurveLine(intersect_boundary, placement_1, tol, tol)
    require(inters is not None and inters.Count > 0, "No CurveLine intersections for placement_1.")
    largest_1 = sorted([inter.ParameterB for inter in inters])[-1]

    inters = rg.Intersect.Intersection.CurveLine(intersect_boundary, placement_2, tol, tol)
    require(inters is not None and inters.Count > 0, "No CurveLine intersections for placement_2.")
    largest_2 = sorted([inter.ParameterB for inter in inters])[-1]

    extension_p = min(largest_1, largest_2)
    extension_pt = ref_edge.PointAt(extension_p)

    mid_extension = rg.Line(ref_edge.From, extension_pt)
    translate_geom(mid_extension, rg.Vector3d(mid_pt) - rg.Vector3d(ref_edge.From))
    return mid_extension


def make_bolt_circles_and_points(
    mid: rg.Point3d,
    axis_0: rg.Vector3d,
    axis_long: rg.Vector3d,
    plane: rg.Plane,
    quarter_width: float,
    cp1: float,
    cp2: float,
    init_radius: float,
) -> Tuple[List[rg.Circle], List[rg.Point3d]]:
    cps: List[rg.Point3d] = []
    for i in [quarter_width, -quarter_width]:
        for j in [cp1, cp2]:
            p = rg.Point3d(mid)
            translate_geom(p, rg.Vector3d(axis_0) * i)
            translate_geom(p, rg.Vector3d(axis_long) * j)
            cps.append(p)

    circles = [rg.Circle(plane, cp, init_radius) for cp in cps]
    return circles, cps


def extrude_bolt_solids(
    circles: List[rg.Circle],
    perp: rg.Vector3d,
    bolt_extension: float,
    plate_thickness: float,
) -> List[rg.Brep]:
    breps: List[rg.Brep] = []
    for circle in circles:
        c = circle.ToNurbsCurve().DuplicateCurve()
        translate_geom(c, rg.Vector3d(perp) * (-bolt_extension))
        ex = rg.Extrusion.Create(c, bolt_extension * 2 + plate_thickness, True)
        breps.append(ex)
    return breps


# ----------------------------------------------------------------------
# CSV / materials
# ----------------------------------------------------------------------
def clean_header(header: str) -> str:
    return re.sub(r"\s*\[.*?\]", "", header).strip()


def load_csv_as_dict(path_to_csv: str):
    if not os.path.isfile(path_to_csv):
        raise FileNotFoundError(f"CSV file not found: {path_to_csv}")

    data_dict = {}
    with open(path_to_csv, newline="", encoding="utf-8") as f:
        reader = csv.reader(f)
        raw_headers = next(reader)
        headers = [clean_header(h) for h in raw_headers]

        f.seek(0)
        dict_reader = csv.DictReader(f, fieldnames=headers)
        next(dict_reader)

        key_col = headers[0]
        for row in dict_reader:
            data_dict[row[key_col]] = row.copy()

    return data_dict


def gh_parent_dir() -> str:
    gh_path = ghdoc.Path
    require(bool(gh_path), "Grasshopper document path not available (ghdoc.Path is empty).")
    gh_dir = os.path.dirname(gh_path)
    return os.path.dirname(gh_dir)


def ensure_parent_on_syspath(parent_dir: str) -> None:
    if parent_dir not in sys.path:
        sys.path.append(parent_dir)


# ----------------------------------------------------------------------
# External solver wrappers
# ----------------------------------------------------------------------
def compute_reactions(log, calculate_equilibrium_reactions, vector_magnitude,
                      applied_F, applied_M, reaction_pts_xyz_m, cg_xyz_m):
    reactions = calculate_equilibrium_reactions(applied_F, applied_M, reaction_pts_xyz_m, cg_xyz_m)
    log("---- Reaction Points and Their Reaction Loads ----")
    for i, (pt, r) in enumerate(zip(reaction_pts_xyz_m, reactions), start=1):
        mag = vector_magnitude(r)
        log(f"Support {i} at {pt} -> Reaction Force: {r} N, Magnitude: {mag:.2f} N")
    return reactions


def reactions_to_T_S_vectors(split_vector, reactions_xyz, perp: rg.Vector3d):
    R = [rg.Vector3d(r[0], r[1], r[2]) for r in reactions_xyz]
    T, S = [], []
    v = [perp.X, perp.Y, perp.Z]
    for reaction in R:
        u = [reaction.X, reaction.Y, reaction.Z]
        t, s = split_vector(u, v)
        T.append(rg.Vector3d(t[0], t[1], t[2]))
        S.append(rg.Vector3d(s[0], s[1], s[2]))
    return T, S


# ======================================================================
# MAIN (all GH inputs are used here explicitly)
# ======================================================================
def main(
    free_objects,
    srf_1,
    srf_2,
    min_bracket_extension,
    max_bolt_dia,
    min_edge_clearance,
    bolt_spacing_1,
    bolt_spacing_2,
    init_bolt_radius,
    init_plate_thickness,
    num_ribs,
    material_csv,
    material_free,
    material_bracket,
):
    log = make_logger(DEBUG)

    # --- Surface frames
    plane_1, perp_1, boundary_1, boundary_pts_1 = surface_frame(srf_1, DOC_TOL)
    plane_2, perp_2, boundary_2, boundary_pts_2 = surface_frame(srf_2, DOC_TOL)

    # --- Plane intersection (clipped)
    raw_intersection = plane_plane_intersection_line(plane_1, plane_2)

    far_edge_1 = far_edge_from_points_to_line(boundary_pts_1, raw_intersection)
    far_edge_2 = far_edge_from_points_to_line(boundary_pts_2, raw_intersection)

    all_params = [raw_intersection.ClosestParameter(pt) for pt in boundary_pts_1] + \
                 [raw_intersection.ClosestParameter(pt) for pt in boundary_pts_2]

    intersect_line = clip_line_to_param_range(raw_intersection, all_params)

    # --- Offset boundaries away
    poly_1 = boundary_1.DuplicateCurve()
    translate_geom(poly_1, unitized(far_edge_1.Direction) * (-min_bracket_extension))

    poly_2 = boundary_2.DuplicateCurve()
    translate_geom(poly_2, unitized(far_edge_2.Direction) * (-min_bracket_extension))

    # --- Overlap along intersection line
    intervals_1 = curve_intervals_inside_poly_on_line(log, intersect_line, poly_1, plane_1, PARAM_TOL, PARAM_TOL)
    intervals_2 = curve_intervals_inside_poly_on_line(log, intersect_line, poly_2, plane_2, PARAM_TOL, PARAM_TOL)

    overlaps = find_overlapping_regions(intervals_1, intervals_2)
    require(len(overlaps) > 0, "No overlapping interval found between the two boundaries along the intersection line.")

    placement_edge = rg.Line(intersect_line.PointAt(overlaps[0][0]), intersect_line.PointAt(overlaps[0][1]))
    mid = intersect_line.PointAt((overlaps[0][0] + overlaps[0][1]) / 2.0)

    # --- Mid extensions
    mid_extension_1 = mid_extension_line(far_edge_1, placement_edge, boundary_1, DOC_TOL, mid)
    mid_extension_2 = mid_extension_line(far_edge_2, placement_edge, boundary_2, DOC_TOL, mid)

    # --- Bracket sizes / axes
    half_bracket_width = max_bolt_dia * 5
    bracket_width = half_bracket_width * 2
    quarter_bracket_width = half_bracket_width / 2

    axis_0 = unitized(placement_edge.Direction)
    axis_1 = unitized(mid_extension_1.Direction)
    axis_2 = unitized(mid_extension_2.Direction)

    # --- Near/far distances helper
    def offset_lines(base_line: rg.Line, axis: rg.Vector3d, offset: float) -> List[rg.Line]:
        lines: List[rg.Line] = []
        for fac in [-1, 1]:
            ln = rg.Line(base_line.From, base_line.To)
            translate_geom(ln, rg.Vector3d(axis) * (offset * fac))
            lines.append(ln)
        return lines

    def near_far_for_two_offsets(base_line: rg.Line, boundary: rg.Curve, plane: rg.Plane) -> Tuple[List[float], List[float]]:
        lines = offset_lines(base_line, axis_0, quarter_bracket_width)
        nears: List[float] = []
        fars: List[float] = []
        for ln in lines:
            inside = curve_intervals_inside_poly_on_line(log, ln, boundary, plane, PARAM_TOL, PARAM_TOL)
            require(len(inside) > 0, "Failed to compute inside interval for near/far calc.")
            n, f = near_far_distances_on_line_for_inside_interval(ln, inside[0])
            nears.append(n)
            fars.append(f)
        return nears, fars

    near_1, far_1 = near_far_for_two_offsets(mid_extension_1, boundary_1, plane_1)
    near_2, far_2 = near_far_for_two_offsets(mid_extension_2, boundary_2, plane_2)

    # --- Bolt centerline distances
    first_far_1 = sorted(far_1)[0]
    last_near_1 = sorted(near_1)[-1]
    cp_bolts_1_1 = last_near_1 + min_edge_clearance
    cp_bolts_1_2 = min(first_far_1, cp_bolts_1_1 + half_bracket_width * bolt_spacing_1)

    first_far_2 = sorted(far_2)[0]
    last_near_2 = sorted(near_2)[-1]
    cp_bolts_2_1 = last_near_2 + min_edge_clearance
    cp_bolts_2_2 = min(first_far_2, cp_bolts_2_1 + half_bracket_width * bolt_spacing_2)

    # --- Bolt circles / solids
    bolt_circles_1, cps_bolts_1 = make_bolt_circles_and_points(
        mid, axis_0, axis_1, plane_1, quarter_bracket_width, cp_bolts_1_1, cp_bolts_1_2, init_bolt_radius
    )
    bolt_circles_2, cps_bolts_2 = make_bolt_circles_and_points(
        mid, axis_0, axis_2, plane_2, quarter_bracket_width, cp_bolts_2_1, cp_bolts_2_2, init_bolt_radius
    )

    bolt_extension = 10
    bolts_geo = []
    bolts_geo += extrude_bolt_solids(bolt_circles_1, perp_1, bolt_extension, init_plate_thickness)
    bolts_geo += extrude_bolt_solids(bolt_circles_2, perp_2, bolt_extension, init_plate_thickness)

    # --- Bracket profile + boolean holes
    corner_pt = rg.Point3d(mid)
    translate_geom(corner_pt, rg.Vector3d(axis_0) * (-half_bracket_width))

    corner_pts: List[rg.Point3d] = []
    for i, d in enumerate([axis_1, axis_2]):
        v = rg.Vector3d(d) * ([cp_bolts_1_2, cp_bolts_2_2][i] + quarter_bracket_width)
        p = rg.Point3d(corner_pt)
        translate_geom(p, v)
        corner_pts.append(p)

    corner_pts.insert(1, corner_pt)

    profile_poly = rg.Polyline(corner_pts)
    profile_plane = rg.Plane(corner_pt, axis_0)

    profile_crv = profile_poly.ToNurbsCurve()
    profile_offset = profile_crv.Offset(profile_plane, init_plate_thickness, DOC_TOL, rg.CurveOffsetCornerStyle.Sharp)[0]
    profile_offset.Reverse()

    cap_lines = [
        rg.Line(profile_crv.PointAtStart, profile_offset.PointAtEnd),
        rg.Line(profile_offset.PointAtStart, profile_crv.PointAtEnd),
    ]

    profile = rg.Curve.JoinCurves([profile_crv, profile_offset] + [l.ToNurbsCurve() for l in cap_lines])[0]
    bracket_geo = rg.Extrusion.Create(profile, bracket_width, True)

    bracket_geo_bool = bracket_geo.ToBrep().Duplicate()
    for other_geo in bolts_geo:
        diff = rg.Brep.CreateBooleanDifference(bracket_geo_bool, other_geo.ToBrep(), DOC_TOL)
        require(diff is not None and len(diff) > 0, "BooleanDifference failed during bolt hole subtraction.")
        bracket_geo_bool = diff[0]

    # --- Ribs
    inside_poly = profile_offset.ControlPolygon()
    if not inside_poly.IsClosed:
        pts = list(inside_poly.ToArray())
        inside_poly = rg.Polyline(pts + [pts[0]])

    inside_rib = rg.Extrusion.Create(inside_poly.ToNurbsCurve(), init_plate_thickness, True)

    if num_ribs == 1:
        facs = [0.5]
    elif num_ribs == 2:
        facs = [0, 1]
    else:
        facs = []

    inside_ribs = []
    for fac in facs:
        rib = inside_rib.Duplicate()
        translate_geom(rib, rg.Vector3d(axis_0) * (bracket_width * fac - init_plate_thickness * fac))
        inside_ribs.append(rib.ToBrep())

    union = rg.Brep.CreateBooleanUnion([bracket_geo_bool] + inside_ribs, DOC_TOL)
    require(union is not None and len(union) > 0, "BooleanUnion failed for bracket + ribs.")
    bracket_solid = union[0]

    # ------------------------------------------------------------------
    # Materials / mass / CG
    # ------------------------------------------------------------------
    parent_dir = gh_parent_dir()
    ensure_parent_on_syspath(parent_dir)

    csv_path = os.path.join(parent_dir, material_csv)
    material_dictionary = load_csv_as_dict(csv_path)

    free_density = float(material_dictionary[material_free]["Density"])
    bracket_density = float(material_dictionary[material_bracket]["Density"])

    free_volume = sum(obj.GetVolume() for obj in free_objects) / 1_000_000_000.0
    free_mass = free_volume * free_density

    bracket_volume = bracket_solid.GetVolume() / 1_000_000_000.0
    bracket_mass = bracket_volume * bracket_density

    combined_mass = free_mass + bracket_mass
    gravity_force_1 = free_mass * 9.81
    gravity_force_2 = combined_mass * 9.81

    mp_free = rg.VolumeMassProperties.Compute(free_objects[0])
    mp_bracket = rg.VolumeMassProperties.Compute(bracket_solid)
    require(mp_free is not None and mp_bracket is not None, "Failed to compute VolumeMassProperties.")

    free_cg = mp_free.Centroid
    bracket_cg = mp_bracket.Centroid

    combined_cg = rg.Point3d(
        (free_mass * free_cg.X + bracket_mass * bracket_cg.X) / combined_mass,
        (free_mass * free_cg.Y + bracket_mass * bracket_cg.Y) / combined_mass,
        (free_mass * free_cg.Z + bracket_mass * bracket_cg.Z) / combined_mass,
    )

    log(f"combined_mass: {combined_mass}")
    log(f"gravity_force_2: {gravity_force_2}")

    # ------------------------------------------------------------------
    # External solver (rigid body)
    # ------------------------------------------------------------------
    import scripts.rigid_body_solver
    importlib.reload(scripts.rigid_body_solver)
    from scripts.rigid_body_solver import calculate_equilibrium_reactions, split_vector, vector_magnitude

    # Reactions at free flange (uses cps_bolts_2)
    applied_F = [0, 0, gravity_force_1]
    applied_M = [0, 0, 0]
    cg_free = [free_cg.X/1000.0, free_cg.Y/1000.0, free_cg.Z/1000.0]
    reaction_points_2 = [[pt.X/1000.0, pt.Y/1000.0, pt.Z/1000.0] for pt in cps_bolts_2]

    reactions_2 = compute_reactions(log, calculate_equilibrium_reactions, vector_magnitude,
                                    applied_F, applied_M, reaction_points_2, cg_free)

    R_2 = [ rg.Vector3d(reaction[0], reaction[1], reaction[2]) for reaction in reactions_2 ]
    T_2, S_2 = reactions_to_T_S_vectors(split_vector, reactions_2, perp_2)

    # Bolt sizing (free flange)
    import scripts.bolt_sizing
    importlib.reload(scripts.bolt_sizing)
    from scripts.bolt_sizing import select_bolt_gh

    bolt_summary, bolt_sizes, bolt_hole_sizes = [], [], []
    for T, S in zip(T_2, S_2):
        result, summary = select_bolt_gh(T.Length, S.Length)
        bolt_summary.append(summary)
        bolt_sizes.append(result.size)
        bolt_hole_sizes.append(result.hole_size)

    hole_size_2 = max(bolt_hole_sizes)

    # Reactions at attached flange (uses cps_bolts_1)
    applied_F = [0, 0, gravity_force_2]
    applied_M = [0, 0, 0]
    cg_combined = [combined_cg.X/1000.0, combined_cg.Y/1000.0, combined_cg.Z/1000.0]
    reaction_points_1 = [[pt.X/1000.0, pt.Y/1000.0, pt.Z/1000.0] for pt in cps_bolts_1]

    reactions_1 = compute_reactions(log, calculate_equilibrium_reactions, vector_magnitude,
                                    applied_F, applied_M, reaction_points_1, cg_combined)

    R_1 = [ rg.Vector3d(reaction[0], reaction[1], reaction[2]) for reaction in reactions_1 ]
    T_1, S_1 = reactions_to_T_S_vectors(split_vector, reactions_1, perp_1)

    new_bolt_hole_sizes = []
    for T, S in zip(T_1, S_1):
        result, summary = select_bolt_gh(T.Length, S.Length)
        bolt_summary.append(summary)
        bolt_sizes.append(result.size)
        new_bolt_hole_sizes.append(result.hole_size)

    hole_size_1 = max(new_bolt_hole_sizes)
    bolt_hole_sizes += new_bolt_hole_sizes

    # ------------------------------------------------------------------
    # Section sizing
    # ------------------------------------------------------------------
    F1 = T_2[1] + T_2[3]
    F2 = T_2[0] + T_2[2]

    L1 = cp_bolts_2_2
    L2 = cp_bolts_2_1

    M = (F1 * L1) - (F2 * L2)

    bb = bracket_solid.GetBoundingBox(plane_2)
    bb_height = (bb.Max.Z - bb.Min.Z)

    bracket_yield_strength = float(material_dictionary[material_bracket]["Yield Strength"])
    b = bracket_width / 1000.0
    h = bb_height / 1000.0
    s = bracket_yield_strength * 1_000_000.0

    import scripts.section_sizing
    importlib.reload(scripts.section_sizing)
    from scripts.section_sizing import optimum_thickness

    t_opt = optimum_thickness(b, h, M, s) * 1000.0

    # Return a structured bundle so GH outputs are easy to wire
    return {
        "plane_2": plane_2,
        "boundary_1": boundary_1,
        "boundary_2": boundary_2,
        "far_edge_1": far_edge_1,
        "far_edge_2": far_edge_2,
        "intersect_line": intersect_line,
        "placement_edge": placement_edge,
        "mid_extension_1": mid_extension_1,
        "mid_extension_2": mid_extension_2,
        "perp_1": perp_1,
        "perp_2": perp_2,
        "free_cg": free_cg,
        "bb": bb,

        "bracket_solid": bracket_solid,
        "bolts_geo": bolts_geo,
        "cps_bolts_1": cps_bolts_1,
        "cps_bolts_2": cps_bolts_2,
        
        "hole_size_1": hole_size_1,
        "hole_size_2": hole_size_2,
        "bolt_sizes": bolt_sizes,
        "bolt_hole_sizes": bolt_hole_sizes,
        "bolt_summary": bolt_summary,
        "combined_cg": combined_cg,
        "combined_mass": combined_mass,
        "gravity_force_1": gravity_force_1,
        "gravity_force_2": gravity_force_2,
        "t_opt": t_opt,
        "M": M,

        "R_1": R_1,
        "R_2": R_2,
        "T_1": T_1,
        "T_2": T_2,
        "S_1": S_1,
        "S_2": S_2,
    }


# ----------------------------------------------------------------------
# GH execution
# ----------------------------------------------------------------------
result = main(
    free_objects=free_objects,
    srf_1=srf_1,
    srf_2=srf_2,
    min_bracket_extension=min_bracket_extension,
    max_bolt_dia=max_bolt_dia,
    min_edge_clearance=min_edge_clearance,
    bolt_spacing_1=bolt_spacing_1,
    bolt_spacing_2=bolt_spacing_2,
    init_bolt_radius=init_bolt_radius,
    init_plate_thickness=init_plate_thickness,
    num_ribs=num_ribs,
    material_csv=material_csv,
    material_free=material_free,
    material_bracket=material_bracket,
)

# Example GH outputs (rename to your component outputs)
plane_2 = result["plane_2"]
boundary_1 = result["boundary_1"]
boundary_2 = result["boundary_2"]
far_edge_1 = result["far_edge_1"]
far_edge_2 = result["far_edge_2"]
intersect_line = result["intersect_line"]
placement_edge = result["placement_edge"]
mid_extension_1 = result["mid_extension_1"]
mid_extension_2 = result["mid_extension_2"]
perp_1 = result["perp_1"]
perp_2 = result["perp_2"]
free_cg = result["free_cg"]
bb = result["bb"]

gravity_force_1 = result["gravity_force_1"]
gravity_force_2 = result["gravity_force_2"]
combined_cg = result["combined_cg"]

bracket_solid = result["bracket_solid"]
bolts_geo = result["bolts_geo"]
cps_bolts_1 = result["cps_bolts_1"]
cps_bolts_2 = result["cps_bolts_2"]
t_opt = result["t_opt"]

R_1 = result["R_1"]
R_2 = result["R_2"]
T_1 = result["T_1"]
T_2 = result["T_2"]
S_1 = result["S_1"]
S_2 = result["S_2"]

bolt_summary = result["bolt_summary"]
bolt_sizes = result["bolt_sizes"]
# ---------- end py3_4 ----------
py3_5 = Python3Script(
    free_objects=merge_2,
    srf_1=item,
    srf_2=item_2,
    min_bracket_extension=number_slider,
    max_bolt_dia=number_slider_7,
    min_edge_clearance=number_slider_2,
    bolt_spacing_1=number_slider_6,
    bolt_spacing_2=number_slider_5,
    init_bolt_radius=number_slider_4,
    init_plate_thickness=number_slider_3,
    num_ribs=number_slider_10,
    material_csv="materials.csv",
    material_free=list_3,
    material_bracket=list_4)  # -> out, plane_2, boundary_1, boundary_2, far_edge_1, far_edge_2, intersect_line, placement_edge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; inputs free_objects: list of Brep, srf_1: Surface, srf_2: Surface
# ---------- py3_5: Python ----------
import os, sys, re, csv, importlib
from typing import List, Tuple, Optional, Callable, Protocol, runtime_checkable, Any, Dict

import Rhino
import Rhino.Geometry as rg
from Rhino.Geometry.Intersect import Intersection

# ----------------------------------------------------------------------
# Settings
# ----------------------------------------------------------------------
DEBUG = False
DOC_TOL = Rhino.RhinoDoc.ActiveDoc.ModelAbsoluteTolerance
PARAM_TOL = 0.01
EPS_EDGE = 0.01
Interval = Tuple[float, float]


# ----------------------------------------------------------------------
# Logging / guardrails
# ----------------------------------------------------------------------
def make_logger(enabled: bool) -> Callable[[str], None]:
    def _log(msg: str) -> None:
        if enabled:
            print(msg)
    return _log


def require(cond: bool, msg: str):
    if not cond:
        raise ValueError(msg)


# ======================================================================
# Step 2: Abstract geometry API (clean: immutable-style transforms)
# ======================================================================

@runtime_checkable
class GPoint(Protocol):
    x: float
    y: float
    z: float
    def translated(self, v: "GVector") -> "GPoint": ...


@runtime_checkable
class GVector(Protocol):
    x: float
    y: float
    z: float
    def length(self) -> float: ...
    def unitized(self) -> "GVector": ...
    def scaled(self, s: float) -> "GVector": ...
    def negated(self) -> "GVector": ...


@runtime_checkable
class GPlane(Protocol):
    def z_axis(self) -> GVector: ...


@runtime_checkable
class GLine(Protocol):
    def from_pt(self) -> GPoint: ...
    def to_pt(self) -> GPoint: ...
    def direction(self) -> GVector: ...
    def point_at(self, t: float) -> GPoint: ...
    def closest_parameter(self, pt: GPoint) -> float: ...
    def translated(self, v: GVector) -> "GLine": ...


@runtime_checkable
class GCurve(Protocol):
    def duplicate(self) -> "GCurve": ...
    def translated(self, v: GVector) -> "GCurve": ...
    def to_points(self) -> List[GPoint]: ...
    def contains(self, pt: GPoint, plane: GPlane, tol: float) -> str: ...
    def reversed(self) -> "GCurve": ...
    def start_point(self) -> GPoint: ...
    def end_point(self) -> GPoint: ...


@runtime_checkable
class GCircle(Protocol):
    pass


@runtime_checkable
class GSolid(Protocol):
    def volume(self) -> float: ...
    def centroid(self) -> GPoint: ...
    def bounding_box(self, plane: GPlane) -> Any: ...
    def translated(self, v: GVector) -> "GSolid": ...


class GeomBackend(Protocol):
    # constructors
    def point(self, x: float, y: float, z: float) -> GPoint: ...
    def vector(self, x: float, y: float, z: float) -> GVector: ...
    def line(self, a: GPoint, b: GPoint) -> GLine: ...

    # surface ops
    def surface_plane(self, srf: Any) -> GPlane: ...
    def surface_boundary(self, srf: Any) -> GCurve: ...
    def surface_boundary_points(self, srf: Any) -> List[GPoint]: ...

    # intersections
    def plane_plane_intersection(self, p1: GPlane, p2: GPlane) -> GLine: ...
    def line_line_params(self, l1: GLine, l2: GLine) -> Tuple[bool, float, float]: ...
    def curve_line_intersections_paramB(self, crv: GCurve, ln: GLine, tol: float) -> List[float]: ...

    # curves/circles/solids
    def circle(self, plane: GPlane, center: GPoint, r: float) -> GCircle: ...
    def circle_to_curve(self, c: GCircle) -> GCurve: ...
    def extrusion(self, profile: GCurve, height: float, cap: bool) -> GSolid: ...
    def boolean_difference(self, a: GSolid, b: GSolid, tol: float) -> GSolid: ...
    def boolean_union(self, solids: List[GSolid], tol: float) -> GSolid: ...

    # misc
    def point_distance(self, a: GPoint, b: GPoint) -> float: ...

    # Option A: move bracket profile building into backend
    def make_bracket_profile(
        self,
        mid: GPoint,
        axis_0: GVector,
        axis_1: GVector,
        axis_2: GVector,
        half_bracket_width: float,
        quarter_bracket_width: float,
        cp_bolts_1_2: float,
        cp_bolts_2_2: float,
        init_plate_thickness: float,
        tol: float,
    ) -> Dict[str, Any]:
        """
        Returns:
          {
            "profile_plane": GPlane,
            "profile_curve": GCurve,         # closed curve used to extrude the bracket plate
            "profile_offset": GCurve,        # inner offset curve (already reversed)
            "inside_poly_curve": GCurve,     # closed curve from profile_offset.ControlPolygon
          }
        """
        ...


# ======================================================================
# Rhino backend implementation (adapter)
# ======================================================================

class RhinoPoint:
    def __init__(self, p: rg.Point3d):
        self._p = p

    @property
    def x(self): return float(self._p.X)
    @property
    def y(self): return float(self._p.Y)
    @property
    def z(self): return float(self._p.Z)

    def translated(self, v: "GVector") -> "RhinoPoint":
        rv = v._rg() if isinstance(v, RhinoVector) else rg.Vector3d(v.x, v.y, v.z)
        p = rg.Point3d(self._p)
        p.Transform(rg.Transform.Translation(rv))
        return RhinoPoint(p)

    def _rg(self) -> rg.Point3d:
        return self._p


class RhinoVector:
    def __init__(self, v: rg.Vector3d):
        self._v = v

    @property
    def x(self): return float(self._v.X)
    @property
    def y(self): return float(self._v.Y)
    @property
    def z(self): return float(self._v.Z)

    def length(self) -> float:
        return float(self._v.Length)

    def unitized(self) -> "RhinoVector":
        vv = rg.Vector3d(self._v)
        vv.Unitize()
        return RhinoVector(vv)

    def scaled(self, s: float) -> "RhinoVector":
        vv = rg.Vector3d(self._v)
        vv *= s
        return RhinoVector(vv)

    def negated(self) -> "RhinoVector":
        vv = rg.Vector3d(self._v)
        vv *= -1.0
        return RhinoVector(vv)

    def _rg(self) -> rg.Vector3d:
        return self._v


class RhinoPlane:
    def __init__(self, pl: rg.Plane):
        self._pl = pl

    def z_axis(self) -> RhinoVector:
        return RhinoVector(self._pl.ZAxis)

    def _rg(self) -> rg.Plane:
        return self._pl


class RhinoLine:
    def __init__(self, ln: rg.Line):
        self._ln = ln

    def from_pt(self) -> RhinoPoint:
        return RhinoPoint(self._ln.From)

    def to_pt(self) -> RhinoPoint:
        return RhinoPoint(self._ln.To)

    def direction(self) -> RhinoVector:
        return RhinoVector(self._ln.Direction)

    def point_at(self, t: float) -> RhinoPoint:
        return RhinoPoint(self._ln.PointAt(t))

    def closest_parameter(self, pt: GPoint) -> float:
        rp = pt._rg() if isinstance(pt, RhinoPoint) else rg.Point3d(pt.x, pt.y, pt.z)
        return float(self._ln.ClosestParameter(rp))

    def translated(self, v: GVector) -> "RhinoLine":
        rv = v._rg() if isinstance(v, RhinoVector) else rg.Vector3d(v.x, v.y, v.z)
        ln = rg.Line(self._ln.From, self._ln.To)
        ln.Transform(rg.Transform.Translation(rv))
        return RhinoLine(ln)

    def _rg(self) -> rg.Line:
        return self._ln


class RhinoCurve:
    def __init__(self, crv: rg.Curve):
        self._crv = crv

    def duplicate(self) -> "RhinoCurve":
        return RhinoCurve(self._crv.DuplicateCurve())

    def translated(self, v: GVector) -> "RhinoCurve":
        rv = v._rg() if isinstance(v, RhinoVector) else rg.Vector3d(v.x, v.y, v.z)
        c = self._crv.DuplicateCurve()
        c.Transform(rg.Transform.Translation(rv))
        return RhinoCurve(c)

    def to_points(self) -> List[RhinoPoint]:
        return [RhinoPoint(p) for p in list(self._crv.ToArray())]

    def contains(self, pt: GPoint, plane: GPlane, tol: float) -> str:
        rp = pt._rg() if isinstance(pt, RhinoPoint) else rg.Point3d(pt.x, pt.y, pt.z)
        rpl = plane._rg() if isinstance(plane, RhinoPlane) else plane
        contains = self._crv.ToNurbsCurve().Contains(rp, rpl, tol)
        if contains == rg.PointContainment.Inside:
            return "inside"
        if contains == rg.PointContainment.Outside:
            return "outside"
        return "boundary"

    def reversed(self) -> "RhinoCurve":
        c = self._crv.DuplicateCurve()
        c.Reverse()
        return RhinoCurve(c)

    def start_point(self) -> RhinoPoint:
        return RhinoPoint(self._crv.PointAtStart)

    def end_point(self) -> RhinoPoint:
        return RhinoPoint(self._crv.PointAtEnd)

    def _rg(self) -> rg.Curve:
        return self._crv


class RhinoCircle:
    def __init__(self, c: rg.Circle):
        self._c = c

    def _rg(self) -> rg.Circle:
        return self._c


class RhinoSolid:
    def __init__(self, brep_or_extrusion):
        self._g = brep_or_extrusion  # Brep or Extrusion

    def _brep(self) -> rg.Brep:
        if isinstance(self._g, rg.Brep):
            return self._g
        return self._g.ToBrep()

    def translated(self, v: GVector) -> "RhinoSolid":
        rv = v._rg() if isinstance(v, RhinoVector) else rg.Vector3d(v.x, v.y, v.z)
        brep = self._brep().Duplicate()
        brep.Transform(rg.Transform.Translation(rv))
        return RhinoSolid(brep)

    def volume(self) -> float:
        return float(self._brep().GetVolume())

    def centroid(self) -> RhinoPoint:
        mp = rg.VolumeMassProperties.Compute(self._brep())
        require(mp is not None, "VolumeMassProperties.Compute failed.")
        return RhinoPoint(mp.Centroid)

    def bounding_box(self, plane: GPlane) -> Any:
        rpl = plane._rg() if isinstance(plane, RhinoPlane) else plane
        return self._brep().GetBoundingBox(rpl)

    def _rg(self):
        return self._g


class RhinoBackend:
    def point(self, x: float, y: float, z: float) -> RhinoPoint:
        return RhinoPoint(rg.Point3d(x, y, z))

    def vector(self, x: float, y: float, z: float) -> RhinoVector:
        return RhinoVector(rg.Vector3d(x, y, z))

    def line(self, a: GPoint, b: GPoint) -> RhinoLine:
        ra = a._rg() if isinstance(a, RhinoPoint) else rg.Point3d(a.x, a.y, a.z)
        rb = b._rg() if isinstance(b, RhinoPoint) else rg.Point3d(b.x, b.y, b.z)
        return RhinoLine(rg.Line(ra, rb))

    def surface_plane(self, srf: Any) -> RhinoPlane:
        ok, plane = srf.TryGetPlane()
        require(ok, "Surface is not planar (TryGetPlane failed).")
        return RhinoPlane(plane)

    def surface_boundary(self, srf: Any) -> RhinoCurve:
        curves = srf.ToBrep().DuplicateEdgeCurves()
        require(curves and len(curves) > 0, "Surface has no edge curves.")
        joined = rg.Curve.JoinCurves(curves, DOC_TOL)
        require(joined and len(joined) > 0, "Failed to join surface edge curves.")
        require(len(joined) == 1, f"Expected 1 joined boundary curve; got {len(joined)}.")
        return RhinoCurve(joined[0])

    def surface_boundary_points(self, srf: Any) -> List[RhinoPoint]:
        curves = srf.ToBrep().DuplicateEdgeCurves()
        require(curves and len(curves) > 0, "Surface has no edge curves.")
        pts: List[rg.Point3d] = []
        for crv in curves:
            for cand in [crv.PointAtStart, crv.PointAtEnd]:
                if not any(cand.DistanceTo(p) <= DOC_TOL for p in pts):
                    pts.append(cand)
        require(len(pts) >= 2, "Failed to extract boundary points.")
        return [RhinoPoint(p) for p in pts]

    def plane_plane_intersection(self, p1: GPlane, p2: GPlane) -> RhinoLine:
        rp1 = p1._rg() if isinstance(p1, RhinoPlane) else p1
        rp2 = p2._rg() if isinstance(p2, RhinoPlane) else p2
        ok, line = Intersection.PlanePlane(rp1, rp2)
        require(ok, "Planes are parallel or coincident; no unique intersection line.")
        return RhinoLine(line)

    def line_line_params(self, l1: GLine, l2: GLine) -> Tuple[bool, float, float]:
        rl1 = l1._rg() if isinstance(l1, RhinoLine) else l1
        rl2 = l2._rg() if isinstance(l2, RhinoLine) else l2
        success, a, b = Intersection.LineLine(rl1, rl2)
        return bool(success), float(a), float(b)

    def curve_line_intersections_paramB(self, crv: GCurve, ln: GLine, tol: float) -> List[float]:
        rcrv = crv._rg() if isinstance(crv, RhinoCurve) else crv
        rln = ln._rg() if isinstance(ln, RhinoLine) else ln
        inters = rg.Intersect.Intersection.CurveLine(rcrv, rln, tol, tol)
        if inters is None or inters.Count == 0:
            return []
        return [float(i.ParameterB) for i in inters]

    def circle(self, plane: GPlane, center: GPoint, r: float) -> RhinoCircle:
        rpl = plane._rg() if isinstance(plane, RhinoPlane) else plane
        rc = center._rg() if isinstance(center, RhinoPoint) else rg.Point3d(center.x, center.y, center.z)
        return RhinoCircle(rg.Circle(rpl, rc, r))

    def circle_to_curve(self, c: GCircle) -> RhinoCurve:
        rc = c._rg() if isinstance(c, RhinoCircle) else c
        return RhinoCurve(rc.ToNurbsCurve().DuplicateCurve())

    def extrusion(self, profile: GCurve, height: float, cap: bool) -> RhinoSolid:
        rcrv = profile._rg() if isinstance(profile, RhinoCurve) else profile
        ex = rg.Extrusion.Create(rcrv, height, cap)
        require(ex is not None, "Extrusion.Create failed.")
        return RhinoSolid(ex)

    def boolean_difference(self, a: GSolid, b: GSolid, tol: float) -> RhinoSolid:
        ra = a._brep() if isinstance(a, RhinoSolid) else a
        rb = b._brep() if isinstance(b, RhinoSolid) else b
        diff = rg.Brep.CreateBooleanDifference(ra, rb, tol)
        require(diff and len(diff) > 0, "BooleanDifference failed.")
        return RhinoSolid(diff[0])

    def boolean_union(self, solids: List[GSolid], tol: float) -> RhinoSolid:
        breps = [(s._brep() if isinstance(s, RhinoSolid) else s) for s in solids]
        union = rg.Brep.CreateBooleanUnion(breps, tol)
        require(union and len(union) > 0, "BooleanUnion failed.")
        return RhinoSolid(union[0])

    def point_distance(self, a: GPoint, b: GPoint) -> float:
        ra = a._rg() if isinstance(a, RhinoPoint) else rg.Point3d(a.x, a.y, a.z)
        rb = b._rg() if isinstance(b, RhinoPoint) else rg.Point3d(b.x, b.y, b.z)
        return float(ra.DistanceTo(rb))

    # -------- Option A method: ALL Rhino-only profile logic is here --------
    def make_bracket_profile(
        self,
        mid: GPoint,
        axis_0: GVector,
        axis_1: GVector,
        axis_2: GVector,
        half_bracket_width: float,
        quarter_bracket_width: float,
        cp_bolts_1_2: float,
        cp_bolts_2_2: float,
        init_plate_thickness: float,
        tol: float,
    ) -> Dict[str, Any]:
        mid_rg = mid._rg() if isinstance(mid, RhinoPoint) else rg.Point3d(mid.x, mid.y, mid.z)
        a0 = axis_0._rg() if isinstance(axis_0, RhinoVector) else rg.Vector3d(axis_0.x, axis_0.y, axis_0.z)
        a1 = axis_1._rg() if isinstance(axis_1, RhinoVector) else rg.Vector3d(axis_1.x, axis_1.y, axis_1.z)
        a2 = axis_2._rg() if isinstance(axis_2, RhinoVector) else rg.Vector3d(axis_2.x, axis_2.y, axis_2.z)
        a0.Unitize(); a1.Unitize(); a2.Unitize()

        corner_pt = rg.Point3d(mid_rg)
        corner_pt.Transform(rg.Transform.Translation(a0 * (-half_bracket_width)))

        corner_pts: List[rg.Point3d] = []
        for i, d in enumerate([a1, a2]):
            dist = ([cp_bolts_1_2, cp_bolts_2_2][i] + quarter_bracket_width)
            v = rg.Vector3d(d) * dist
            p = rg.Point3d(corner_pt)
            p.Transform(rg.Transform.Translation(v))
            corner_pts.append(p)

        corner_pts.insert(1, corner_pt)

        profile_poly = rg.Polyline(corner_pts)
        profile_plane = rg.Plane(corner_pt, a0)

        profile_crv = profile_poly.ToNurbsCurve()

        offs = profile_crv.Offset(profile_plane, init_plate_thickness, tol, rg.CurveOffsetCornerStyle.Sharp)
        require(offs is not None and len(offs) > 0, "Curve offset failed in make_bracket_profile().")
        profile_offset = offs[0]
        profile_offset.Reverse()

        cap_lines = [
            rg.Line(profile_crv.PointAtStart, profile_offset.PointAtEnd),
            rg.Line(profile_offset.PointAtStart, profile_crv.PointAtEnd),
        ]

        joined = rg.Curve.JoinCurves([profile_crv, profile_offset] + [l.ToNurbsCurve() for l in cap_lines], tol)
        require(joined is not None and len(joined) > 0, "JoinCurves failed in make_bracket_profile().")
        profile_closed = joined[0]

        inside_poly = profile_offset.ControlPolygon()
        if not inside_poly.IsClosed:
            pts = list(inside_poly.ToArray())
            inside_poly = rg.Polyline(pts + [pts[0]])

        inside_poly_curve = inside_poly.ToNurbsCurve()

        return {
            "profile_plane": RhinoPlane(profile_plane),
            "profile_curve": RhinoCurve(profile_closed),
            "profile_offset": RhinoCurve(profile_offset),  # already reversed
            "inside_poly_curve": RhinoCurve(inside_poly_curve),
        }


# ======================================================================
# Non-geometry helpers
# ======================================================================

def unique_floats(values: List[float], tol: float) -> List[float]:
    out: List[float] = []
    for v in values:
        if not any(abs(v - u) < tol for u in out):
            out.append(v)
    out.sort()
    return out


def find_overlapping_regions(a: List[Interval], b: List[Interval]) -> List[Interval]:
    a_sorted = sorted(a, key=lambda x: x[0])
    b_sorted = sorted(b, key=lambda x: x[0])
    i = j = 0
    overlaps: List[Interval] = []
    while i < len(a_sorted) and j < len(b_sorted):
        a_start, a_end = a_sorted[i]
        b_start, b_end = b_sorted[j]
        start = max(a_start, b_start)
        end = min(a_end, b_end)
        if start < end:
            overlaps.append((start, end))
        if a_end < b_end:
            i += 1
        else:
            j += 1
    return overlaps

def curve_intervals_inside_poly_on_line(
    geom: GeomBackend,
    line: GLine,
    poly_crv: GCurve,
    plane: GPlane,
    param_tol: float,
    contain_tol: float,
) -> List[Interval]:
    pts = poly_crv.to_points()
    require(len(pts) >= 2, "Polygon curve has too few points.")
    params = [0.0, 1.0]

    for i, a in enumerate(pts[:-1]):
        edge = geom.line(a, pts[i + 1])
        success, p_line, p_edge = geom.line_line_params(line, edge)
        if not success:
            continue
        if (-EPS_EDGE <= p_edge <= 1.0 + EPS_EDGE) and (-EPS_EDGE <= p_line <= 1.0 + EPS_EDGE):
            params.append(p_line)

    final_params = unique_floats(params, param_tol)
    require(len(final_params) >= 2, "Failed to compute usable intersection params.")

    # find intervals of intersected objects within projection distance
    intervals: List[Interval] = []
    for k in range(len(final_params) - 1):
        mid = (final_params[k] + final_params[k + 1]) / 2.0
        mid_pt = line.point_at(mid)
        if poly_crv.contains(mid_pt, plane, contain_tol) == "inside":
            intervals.append((final_params[k], final_params[k + 1]))

    return intervals


def near_far_distances_on_line_for_inside_interval(geom: GeomBackend, line: GLine, inside: Interval) -> Tuple[float, float]:
    a0 = line.point_at(0.0)
    near = geom.point_distance(a0, line.point_at(inside[0]))
    far = geom.point_distance(a0, line.point_at(inside[1]))
    return near, far


def clean_header(header: str) -> str:
    return re.sub(r"\s*\[.*?\]", "", header).strip()


def load_csv_as_dict(path_to_csv: str):
    if not os.path.isfile(path_to_csv):
        raise FileNotFoundError(f"CSV file not found: {path_to_csv}")

    data_dict = {}
    with open(path_to_csv, newline="", encoding="utf-8") as f:
        reader = csv.reader(f)
        raw_headers = next(reader)
        headers = [clean_header(h) for h in raw_headers]

        f.seek(0)
        dict_reader = csv.DictReader(f, fieldnames=headers)
        next(dict_reader)

        key_col = headers[0]
        for row in dict_reader:
            data_dict[row[key_col]] = row.copy()

    return data_dict


def gh_parent_dir() -> str:
    gh_path = ghdoc.Path
    require(bool(gh_path), "Grasshopper document path not available (ghdoc.Path is empty).")
    gh_dir = os.path.dirname(gh_path)
    return os.path.dirname(gh_dir)


def ensure_parent_on_syspath(parent_dir: str) -> None:
    if parent_dir not in sys.path:
        sys.path.append(parent_dir)


def compute_reactions(log, calculate_equilibrium_reactions, vector_magnitude,
                      applied_F, applied_M, reaction_pts_xyz_m, cg_xyz_m):
    reactions = calculate_equilibrium_reactions(applied_F, applied_M, reaction_pts_xyz_m, cg_xyz_m)
    log("---- Reaction Points and Their Reaction Loads ----")
    for i, (pt, r) in enumerate(zip(reaction_pts_xyz_m, reactions), start=1):
        mag = vector_magnitude(r)
        log(f"Support {i} at {pt} -> Reaction Force: {r} N, Magnitude: {mag:.2f} N")
    return reactions


def reactions_to_T_S_vectors(split_vector, reactions_xyz, perp_vec_xyz):
    T, S = [], []
    v = perp_vec_xyz
    for reaction in reactions_xyz:
        u = reaction
        t, s = split_vector(u, v)
        T.append(t)
        S.append(s)
    return T, S


# ======================================================================
# MAIN (Option A + immutable transforms)
# ======================================================================

def main(
    geom: GeomBackend,
    free_objects,
    srf_1,
    srf_2,
    min_bracket_extension,
    max_bolt_dia,
    min_edge_clearance,
    bolt_spacing_1,
    bolt_spacing_2,
    init_bolt_radius,
    init_plate_thickness,
    num_ribs,
    material_csv,
    material_free,
    material_bracket,
):
    log = make_logger(DEBUG)

    # get joining surface planes
    plane_1 = geom.surface_plane(srf_1)
    plane_2 = geom.surface_plane(srf_2)

    # get plane normal axes
    perp_1 = plane_1.z_axis().unitized()
    perp_2 = plane_2.z_axis().unitized()

    # get surface boundaries
    boundary_1 = geom.surface_boundary(srf_1)
    boundary_2 = geom.surface_boundary(srf_2)

    # get surface boundary pts
    boundary_pts_1 = geom.surface_boundary_points(srf_1)
    boundary_pts_2 = geom.surface_boundary_points(srf_2)

    # get plane intersection
    raw_intersection = geom.plane_plane_intersection(plane_1, plane_2)

    def far_edge(pts: List[GPoint], line: GLine) -> GLine:
        max_d = -1.0
        best: Optional[GLine] = None
        for pt in pts:
            t = line.closest_parameter(pt)
            cp = line.point_at(t)
            d = geom.point_distance(cp, pt)
            if d > max_d:
                max_d = d
                best = geom.line(cp, pt)
        require(best is not None, "Could not compute far edge.")
        return best

    # get longest edge to boundary points
    far_edge_1 = far_edge(boundary_pts_1, raw_intersection)
    far_edge_2 = far_edge(boundary_pts_2, raw_intersection)

    # calc hinge line from raw intersection and extremes of projection of corner points of both surfaces
    all_params = [raw_intersection.closest_parameter(pt) for pt in boundary_pts_1] + \
                 [raw_intersection.closest_parameter(pt) for pt in boundary_pts_2]
    all_params_sorted = sorted(all_params)
    intersect_line = geom.line(raw_intersection.point_at(all_params_sorted[0]),
                               raw_intersection.point_at(all_params_sorted[-1]))

    # find overlapping regions to place placement edge
    poly_1 = boundary_1.duplicate().translated(far_edge_1.direction().unitized().scaled(-min_bracket_extension))
    poly_2 = boundary_2.duplicate().translated(far_edge_2.direction().unitized().scaled(-min_bracket_extension))

    intervals_1 = curve_intervals_inside_poly_on_line(geom, intersect_line, poly_1, plane_1, PARAM_TOL, PARAM_TOL)
    intervals_2 = curve_intervals_inside_poly_on_line(geom, intersect_line, poly_2, plane_2, PARAM_TOL, PARAM_TOL)

    overlaps = find_overlapping_regions(intervals_1, intervals_2)
    require(len(overlaps) > 0, "No overlapping interval found between the two boundaries along the intersection line.")

    placement_edge = geom.line(intersect_line.point_at(overlaps[0][0]), intersect_line.point_at(overlaps[0][1]))
    mid = intersect_line.point_at((overlaps[0][0] + overlaps[0][1]) / 2.0)

    def mid_extension(ref_edge: GLine, placement_edge: GLine, boundary: GCurve, mid_pt: GPoint) -> GLine:
        v1 = geom.vector(
            placement_edge.from_pt().x - ref_edge.from_pt().x,
            placement_edge.from_pt().y - ref_edge.from_pt().y,
            placement_edge.from_pt().z - ref_edge.from_pt().z
        )
        v2 = geom.vector(
            placement_edge.to_pt().x - ref_edge.from_pt().x,
            placement_edge.to_pt().y - ref_edge.from_pt().y,
            placement_edge.to_pt().z - ref_edge.from_pt().z
        )
        p1 = ref_edge.translated(v1)
        p2 = ref_edge.translated(v2)

        tB1 = geom.curve_line_intersections_paramB(boundary, p1, DOC_TOL)
        tB2 = geom.curve_line_intersections_paramB(boundary, p2, DOC_TOL)

        require(len(tB1) > 0, "No CurveLine intersections for placement_1.")
        require(len(tB2) > 0, "No CurveLine intersections for placement_2.")

        extension_p = min(max(tB1), max(tB2))
        extension_pt = ref_edge.point_at(extension_p)

        ext = geom.line(ref_edge.from_pt(), extension_pt)
        return ext.translated(geom.vector(
            mid_pt.x - ref_edge.from_pt().x,
            mid_pt.y - ref_edge.from_pt().y,
            mid_pt.z - ref_edge.from_pt().z
        ))

    mid_extension_1 = mid_extension(far_edge_1, placement_edge, boundary_1, mid)
    mid_extension_2 = mid_extension(far_edge_2, placement_edge, boundary_2, mid)

    half_bracket_width = max_bolt_dia * 5
    bracket_width = half_bracket_width * 2
    quarter_bracket_width = half_bracket_width / 2

    axis_0 = placement_edge.direction().unitized()
    axis_1 = mid_extension_1.direction().unitized()
    axis_2 = mid_extension_2.direction().unitized()

    def offset_lines(base_line: GLine, axis: GVector, offset: float) -> List[GLine]:
        return [
            base_line.translated(axis.scaled(-offset)),
            base_line.translated(axis.scaled( offset)),
        ]

    def near_far_for_two_offsets(base_line: GLine, boundary: GCurve, plane: GPlane) -> Tuple[List[float], List[float]]:
        nears: List[float] = []
        fars: List[float] = []
        for ln in offset_lines(base_line, axis_0, quarter_bracket_width):
            inside = curve_intervals_inside_poly_on_line(geom, ln, boundary, plane, PARAM_TOL, PARAM_TOL)
            require(len(inside) > 0, "Failed to compute inside interval for near/far calc.")
            n, f = near_far_distances_on_line_for_inside_interval(geom, ln, inside[0])
            nears.append(n); fars.append(f)
        return nears, fars

    near_1, far_1 = near_far_for_two_offsets(mid_extension_1, boundary_1, plane_1)
    near_2, far_2 = near_far_for_two_offsets(mid_extension_2, boundary_2, plane_2)

    first_far_1 = sorted(far_1)[0]
    last_near_1 = sorted(near_1)[-1]
    cp_bolts_1_1 = last_near_1 + min_edge_clearance
    cp_bolts_1_2 = min(first_far_1, cp_bolts_1_1 + half_bracket_width * bolt_spacing_1)

    first_far_2 = sorted(far_2)[0]
    last_near_2 = sorted(near_2)[-1]
    cp_bolts_2_1 = last_near_2 + min_edge_clearance
    cp_bolts_2_2 = min(first_far_2, cp_bolts_2_1 + half_bracket_width * bolt_spacing_2)

    def bolt_circles_and_points(plane: GPlane, axis_long: GVector, cp1: float, cp2: float):
        cps: List[GPoint] = []
        for i in [quarter_bracket_width, -quarter_bracket_width]:
            for j in [cp1, cp2]:
                p = mid.translated(axis_0.scaled(i)).translated(axis_long.scaled(j))
                cps.append(p)
        circles = [geom.circle(plane, cp, init_bolt_radius) for cp in cps]
        return circles, cps

    bolt_circles_1, cps_bolts_1 = bolt_circles_and_points(plane_1, axis_1, cp_bolts_1_1, cp_bolts_1_2)
    bolt_circles_2, cps_bolts_2 = bolt_circles_and_points(plane_2, axis_2, cp_bolts_2_1, cp_bolts_2_2)

    bolt_extension = 10
    bolts_geo: List[GSolid] = []

    def bolt_solids(circles: List[GCircle], perp: GVector) -> List[GSolid]:
        out: List[GSolid] = []
        for c in circles:
            crv = geom.circle_to_curve(c)
            crv2 = crv.translated(perp.unitized().scaled(-bolt_extension))
            out.append(geom.extrusion(crv2, bolt_extension * 2 + init_plate_thickness, True))
        return out

    bolts_geo += bolt_solids(bolt_circles_1, perp_1)
    bolts_geo += bolt_solids(bolt_circles_2, perp_2)

    prof = geom.make_bracket_profile(
        mid=mid,
        axis_0=axis_0,
        axis_1=axis_1,
        axis_2=axis_2,
        half_bracket_width=half_bracket_width,
        quarter_bracket_width=quarter_bracket_width,
        cp_bolts_1_2=cp_bolts_1_2,
        cp_bolts_2_2=cp_bolts_2_2,
        init_plate_thickness=init_plate_thickness,
        tol=DOC_TOL,
    )

    profile_plane = prof["profile_plane"]
    profile_curve = prof["profile_curve"]
    inside_poly_curve = prof["inside_poly_curve"]

    bracket_geo = geom.extrusion(profile_curve, bracket_width, True)
    bracket_geo_bool = bracket_geo

    for other_geo in bolts_geo:
        bracket_geo_bool = geom.boolean_difference(bracket_geo_bool, other_geo, DOC_TOL)

    # ribs (translated in an abstract way)
    inside_rib = geom.extrusion(inside_poly_curve, init_plate_thickness, True)

    if num_ribs == 1:
        facs = [0.5]
    elif num_ribs == 2:
        facs = [0, 1]
    else:
        facs = []

    inside_ribs: List[GSolid] = []
    for fac in facs:
        rib = geom.extrusion(inside_poly_curve, init_plate_thickness, True)
        shift = bracket_width * fac - init_plate_thickness * fac
        inside_ribs.append(rib.translated(axis_0.scaled(shift)))

    bracket_solid = geom.boolean_union([bracket_geo_bool] + inside_ribs, DOC_TOL)

    # ------------------------------------------------------------------
    # Materials / mass / CG (Rhino-only for free_objects; bracket uses backend)
    # ------------------------------------------------------------------
    parent_dir = gh_parent_dir()
    ensure_parent_on_syspath(parent_dir)

    csv_path = os.path.join(parent_dir, material_csv)
    material_dictionary = load_csv_as_dict(csv_path)

    free_density = float(material_dictionary[material_free]["Density"])
    bracket_density = float(material_dictionary[material_bracket]["Density"])

    free_volume = sum(obj.GetVolume() for obj in free_objects) / 1_000_000_000.0
    free_mass = free_volume * free_density

    bracket_volume = bracket_solid.volume() / 1_000_000_000.0
    bracket_mass = bracket_volume * bracket_density

    combined_mass = free_mass + bracket_mass
    gravity_force_1 = free_mass * 9.81
    gravity_force_2 = combined_mass * 9.81

    mp_free = rg.VolumeMassProperties.Compute(free_objects[0])
    require(mp_free is not None, "Failed to compute free object CG.")
    free_cg = mp_free.Centroid

    bracket_cg = bracket_solid.centroid()
    combined_cg = rg.Point3d(
        (free_mass * free_cg.X + bracket_mass * bracket_cg.x) / combined_mass,
        (free_mass * free_cg.Y + bracket_mass * bracket_cg.y) / combined_mass,
        (free_mass * free_cg.Z + bracket_mass * bracket_cg.z) / combined_mass,
    )

    # ------------------------------------------------------------------
    # External solver (unchanged)
    # ------------------------------------------------------------------
    import scripts.rigid_body_solver
    importlib.reload(scripts.rigid_body_solver)
    from scripts.rigid_body_solver import calculate_equilibrium_reactions, split_vector, vector_magnitude

    applied_F = [0, 0, gravity_force_1]
    applied_M = [0, 0, 0]
    cg_free = [free_cg.X/1000.0, free_cg.Y/1000.0, free_cg.Z/1000.0]
    reaction_points_2 = [[pt.x/1000.0, pt.y/1000.0, pt.z/1000.0] for pt in cps_bolts_2]
    reactions_2 = compute_reactions(log, calculate_equilibrium_reactions, vector_magnitude,
                                    applied_F, applied_M, reaction_points_2, cg_free)
    R_2 = [rg.Vector3d(r[0], r[1], r[2]) for r in reactions_2]
    T2_xyz, S2_xyz = reactions_to_T_S_vectors(split_vector, reactions_2, [perp_2.x, perp_2.y, perp_2.z])
    T_2 = [rg.Vector3d(t[0], t[1], t[2]) for t in T2_xyz]
    S_2 = [rg.Vector3d(s[0], s[1], s[2]) for s in S2_xyz]

    import scripts.bolt_sizing
    importlib.reload(scripts.bolt_sizing)
    from scripts.bolt_sizing import select_bolt_gh

    bolt_summary, bolt_sizes, bolt_hole_sizes = [], [], []
    for T, S in zip(T_2, S_2):
        result, summary = select_bolt_gh(T.Length, S.Length)
        bolt_summary.append(summary)
        bolt_sizes.append(result.size)
        bolt_hole_sizes.append(result.hole_size)
    hole_size_2 = max(bolt_hole_sizes)

    applied_F = [0, 0, gravity_force_2]
    applied_M = [0, 0, 0]
    cg_combined = [combined_cg.X/1000.0, combined_cg.Y/1000.0, combined_cg.Z/1000.0]
    reaction_points_1 = [[pt.x/1000.0, pt.y/1000.0, pt.z/1000.0] for pt in cps_bolts_1]
    reactions_1 = compute_reactions(log, calculate_equilibrium_reactions, vector_magnitude,
                                    applied_F, applied_M, reaction_points_1, cg_combined)
    R_1 = [rg.Vector3d(r[0], r[1], r[2]) for r in reactions_1]
    T1_xyz, S1_xyz = reactions_to_T_S_vectors(split_vector, reactions_1, [perp_1.x, perp_1.y, perp_1.z])
    T_1 = [rg.Vector3d(t[0], t[1], t[2]) for t in T1_xyz]
    S_1 = [rg.Vector3d(s[0], s[1], s[2]) for s in S1_xyz]

    new_bolt_hole_sizes = []
    for T, S in zip(T_1, S_1):
        result, summary = select_bolt_gh(T.Length, S.Length)
        bolt_summary.append(summary)
        bolt_sizes.append(result.size)
        new_bolt_hole_sizes.append(result.hole_size)

    hole_size_1 = max(new_bolt_hole_sizes)
    bolt_hole_sizes += new_bolt_hole_sizes

    F1 = T_2[1] + T_2[3]
    F2 = T_2[0] + T_2[2]
    L1 = cp_bolts_2_2
    L2 = cp_bolts_2_1
    M = (F1 * L1) - (F2 * L2)

    bb = bracket_solid.bounding_box(plane_2)
    bb_height = (bb.Max.Z - bb.Min.Z)

    bracket_yield_strength = float(material_dictionary[material_bracket]["Yield Strength"])
    b = bracket_width / 1000.0
    h = bb_height / 1000.0
    s = bracket_yield_strength * 1_000_000.0

    import scripts.section_sizing
    importlib.reload(scripts.section_sizing)
    from scripts.section_sizing import optimum_thickness
    t_opt = optimum_thickness(b, h, M, s) * 1000.0

    # ------------------------------------------------------------------
    # Return outputs (Rhino objects)
    # ------------------------------------------------------------------
    return {
        "plane_2": plane_2._rg(),
        "boundary_1": boundary_1._rg(),
        "boundary_2": boundary_2._rg(),
        "far_edge_1": far_edge_1._rg(),
        "far_edge_2": far_edge_2._rg(),
        "intersect_line": intersect_line._rg(),
        "placement_edge": placement_edge._rg(),
        "mid_extension_1": mid_extension_1._rg(),
        "mid_extension_2": mid_extension_2._rg(),
        "perp_1": rg.Vector3d(perp_1.x, perp_1.y, perp_1.z),
        "perp_2": rg.Vector3d(perp_2.x, perp_2.y, perp_2.z),
        "free_cg": free_cg,
        "bb": bb,

        "bracket_solid": bracket_solid._brep() if isinstance(bracket_solid, RhinoSolid) else bracket_solid,
        "bolts_geo": [b._brep() if isinstance(b, RhinoSolid) else b for b in bolts_geo],
        "cps_bolts_1": [rg.Point3d(p.x, p.y, p.z) for p in cps_bolts_1],
        "cps_bolts_2": [rg.Point3d(p.x, p.y, p.z) for p in cps_bolts_2],

        "hole_size_1": hole_size_1,
        "hole_size_2": hole_size_2,
        "bolt_sizes": bolt_sizes,
        "bolt_hole_sizes": bolt_hole_sizes,
        "bolt_summary": bolt_summary,
        "combined_cg": combined_cg,
        "combined_mass": combined_mass,
        "gravity_force_1": gravity_force_1,
        "gravity_force_2": gravity_force_2,
        "t_opt": t_opt,
        "M": M,

        "R_1": R_1,
        "R_2": R_2,
        "T_1": T_1,
        "T_2": T_2,
        "S_1": S_1,
        "S_2": S_2,
    }


# ----------------------------------------------------------------------
# GH execution
# ----------------------------------------------------------------------
geom = RhinoBackend()

result = main(
    geom=geom,
    free_objects=free_objects,
    srf_1=srf_1,
    srf_2=srf_2,
    min_bracket_extension=min_bracket_extension,
    max_bolt_dia=max_bolt_dia,
    min_edge_clearance=min_edge_clearance,
    bolt_spacing_1=bolt_spacing_1,
    bolt_spacing_2=bolt_spacing_2,
    init_bolt_radius=init_bolt_radius,
    init_plate_thickness=init_plate_thickness,
    num_ribs=num_ribs,
    material_csv=material_csv,
    material_free=material_free,
    material_bracket=material_bracket,
)

# Example GH outputs (rename to your component outputs)
plane_2 = result["plane_2"]
boundary_1 = result["boundary_1"]
boundary_2 = result["boundary_2"]
far_edge_1 = result["far_edge_1"]
far_edge_2 = result["far_edge_2"]
intersect_line = result["intersect_line"]
placement_edge = result["placement_edge"]
mid_extension_1 = result["mid_extension_1"]
mid_extension_2 = result["mid_extension_2"]
perp_1 = result["perp_1"]
perp_2 = result["perp_2"]
free_cg = result["free_cg"]
bb = result["bb"]

gravity_force_1 = result["gravity_force_1"]
gravity_force_2 = result["gravity_force_2"]
combined_cg = result["combined_cg"]

bracket_solid = result["bracket_solid"]
bolts_geo = result["bolts_geo"]
cps_bolts_1 = result["cps_bolts_1"]
cps_bolts_2 = result["cps_bolts_2"]
t_opt = result["t_opt"]

R_1 = result["R_1"]
R_2 = result["R_2"]
T_1 = result["T_1"]
T_2 = result["T_2"]
S_1 = result["S_1"]
S_2 = result["S_2"]

bolt_summary = result["bolt_summary"]
bolt_sizes = result["bolt_sizes"]
# ---------- end py3_5 ----------
panel_6 = Panel(py3_5.bolt_summary)

# ---- group: Viz placement zone
line = Line(py3_5.mid_extension_2)
line_2 = Line(py3_5.mid_extension_1)
vec = Vector(line)
vec_2 = Vector(line_2)
extr = Extrude(Base=py3_5.placement_edge, Direction=vec_2)
extr_2 = Extrude(Base=py3_5.placement_edge, Direction=vec)
merge_3 = Merge(Data1=extr, Data2=extr_2)
join = BrepJoin(Breps=merge_3)  # -> Breps, Closed
mesh = MeshBrep(
    Brep=join.Breps,
    Settings={GridMaxCount=0, GridMinCount=16, JaggedSeams=False, MaxEdgeLength=0, MinEdgeLength=0.0001, MinTolerance=0, Refine=True, RefineAngle=0, RelativeTolerance=0.65, SimplePlanes=True, Tolerance=0})
panel_7 = Panel("""50
25""")
wires = BrepWireframe(Brep=join.Breps, Density=-1)
dash = DashPattern(Curve=wires, Pattern=panel_7)  # -> Dashes, Gaps
area = MeshArea(Mesh=mesh)  # -> Area, Centroid
preview_2 = CustomPreview(Geometry=mesh, Material=ColourSwatch(SwatchColor=RGBA(102, 102, 102, 124)))
previewlw = CustomPreviewLineweights(Geometry=dash.Dashes, Shader=ColourSwatch(SwatchColor=RGB(0, 0, 0)), Thickness=Slider(3.23, range=0..10), Absolute=False)
panel_8 = Panel(area.Area)

# ---- group: viz surfaces
number_slider_11 = Slider(7.1, range=0..10)
swatch = ColourSwatch(SwatchColor=RGBA(204, 0, 255, 0))
swatch_2 = ColourSwatch(SwatchColor=RGBA(61, 196, 190, 37))
boundary = BoundarySurfaces(Edges=py3_5.boundary_2)
boundary_2 = BoundarySurfaces(Edges=py3_5.boundary_1)
preview_3 = CustomPreview(Geometry=boundary, Material=swatch_2)
previewlw_2 = CustomPreviewLineweights(Geometry=py3_5.boundary_1, Shader=swatch, Thickness=number_slider_11, Absolute=False)
preview_4 = CustomPreview(Geometry=boundary_2, Material=swatch)
previewlw_3 = CustomPreviewLineweights(Geometry=py3_5.boundary_2, Shader=swatch_2, Thickness=number_slider_11, Absolute=False)

# ---- group: viz placement area
line_3 = Line(py3_5.far_edge_1)
line_4 = Line(py3_5.far_edge_2)
line_5 = Line(py3_5.intersect_line)
vec_3 = Vector(line_3)
vec_4 = Vector(line_4)
extr_3 = Extrude(Base=line_5, Direction=vec_3)
extr_4 = Extrude(Base=line_5, Direction=vec_4)
merge_4 = Merge(Data1=extr_3, Data2=extr_4)
join_2 = BrepJoin(Breps=merge_4)  # -> Breps, Closed
preview_5 = CustomPreview(Geometry=join_2.Breps, Material=ColourSwatch(SwatchColor=RGBA(76, 82, 107, 49)))

# ---- group: Viz Oriented BB
xy = XYPlane(Origin=Point(0, 0, 0))
orient = Orient(Geometry=py3_5.bb, Source=xy, Target=py3_5.plane_2)  # -> Geometry, Transform
wires_2 = BrepWireframe(Brep=orient.Geometry, Density=-1)

# ---- group: Viz bracket geo / FINAL GEO
geo = Geometry(py3_5.bracket_solid)

# ---- group: Response vector viz (free) / Free bolt points
geo_2 = Geometry(py3_5.cps_bolts_2)

# ---- group: Response vector viz (fixed) / Fixed bolt points
geo_3 = Geometry(py3_5.cps_bolts_1)

# ---- group: Viz load 2 / CP
pt = Point(py3_5.combined_cg)

# ---- group: Viz load 2
neg = Negative(Value=py3_5.gravity_force_2)
num = Number(number_slider_9)
multiplication = Multiplication(A=neg, B=num)
Z = UnitZ(Factor=multiplication)
move = Move(Geometry=pt, Motion=Z)  # -> Geometry, Transform
int = Integer(py3_5.gravity_force_2)
vdisex = VectorDisplayEx(Point=pt, Vector=Z, Colour=RGB(0, 0, 0), Width=2)
tag = TextTag(Location=move.Geometry, Text=int)

# ---- group: Bolt labels
lng = ListLength(List=py3_5.cps_bolts_1)
lng_2 = ListLength(List=py3_5.cps_bolts_2)
repeat = RepeatData(Data=py3_5.perp_1, Length=lng)
merge_5 = Merge(Data1=py3_5.cps_bolts_2, Data2=py3_5.cps_bolts_1)
repeat_2 = RepeatData(Data=py3_5.perp_2, Length=lng_2)
merge_6 = Merge(Data1=repeat_2, Data2=repeat)
amp = Amplitude(Vector=merge_6, Amplitude="20")
rev = Reverse(Vector=amp)
geo_4 = Geometry(merge_5)
move_2 = Move(Geometry=geo_4, Motion=amp)  # -> Geometry, Transform
tag_2 = TextTag(Location=move_2.Geometry, Text=py3_5.bolt_sizes)

# ---- group: Viz load 1 / CP
pt_2 = Point(py3_5.free_cg)

# ---- group: Viz load 1
neg_2 = Negative(Value=py3_5.gravity_force_1)
num_2 = Number(number_slider_9)
multiplication_2 = Multiplication(A=neg_2, B=num_2)
Z_2 = UnitZ(Factor=multiplication_2)
move_3 = Move(Geometry=pt_2, Motion=Z_2)  # -> Geometry, Transform
int_2 = Integer(py3_5.gravity_force_1)
vdisex_2 = VectorDisplayEx(Point=pt_2, Vector=Z_2, Colour=RGB(0, 0, 0), Width=2)
tag_3 = TextTag(Location=move_3.Geometry, Text=int_2)

# ---- group: Viz bracket geo
mesh_2 = MeshBrep(
    Brep=geo,
    Settings={GridMaxCount=0, GridMinCount=16, JaggedSeams=False, MaxEdgeLength=0, MinEdgeLength=0.0001, MinTolerance=0, Refine=True, RefineAngle=0, RelativeTolerance=0.65, SimplePlanes=True, Tolerance=0})
wires_3 = BrepWireframe(Brep=geo, Density=-1)
unifynormals = MeshUnifyNormals(Mesh=mesh_2)
previewlw_4 = CustomPreviewLineweights(Geometry=wires_3, Shader=ColourSwatch(SwatchColor=RGB(0, 0, 0)), Thickness=Slider(2, range=0..10), Absolute=False)
preview_6 = CustomPreview(Geometry=unifynormals, Material=ColourSwatch(SwatchColor=RGBA(168, 168, 99, 107)))

# ---- group: Response vector viz (free)
cluster = Cluster(vec=py3_5.R_2, S=geo_2, B=number_slider_9)  # -> S_2, E, int_2, L
cluster_2 = Cluster(vec=py3_5.T_2, S=geo_2, B=number_slider_9)  # -> S_2, E, int_2, L
cluster_3 = Cluster(vec=py3_5.S_2, S=geo_2, B=number_slider_9)  # -> S_2, E, int_2, L
previewlw_5 = CustomPreviewLineweights(Geometry=cluster.L, Shader=ColourSwatch(SwatchColor=RGB(255, 94, 94)), Thickness=number_slider_8, Absolute=False)
previewlw_6 = CustomPreviewLineweights(Geometry=cluster_2.L, Shader=ColourSwatch(SwatchColor=RGB(0, 102, 255)), Thickness=number_slider_8, Absolute=False)
previewlw_7 = CustomPreviewLineweights(Geometry=cluster_3.L, Shader=ColourSwatch(SwatchColor=RGB(0, 181, 9)), Thickness=number_slider_8, Absolute=False)
tag_4 = TextTag(Location=cluster.E, Text=cluster.int_2)
tag_5 = TextTag(Location=cluster_2.E, Text=cluster_2.int_2)
tag_6 = TextTag(Location=cluster_3.E, Text=cluster_3.int_2)
srf4pt = _4PointSurface(CornerA=cluster_2.S_2, CornerB=cluster_2.E, CornerC=cluster.E, CornerD=cluster_3.E)

# ---- group: Response vector viz (fixed)
cluster_4 = Cluster(vec=py3_5.R_1, S=geo_3, B=number_slider_9)  # -> S_2, E, int_2, L
cluster_5 = Cluster(vec=py3_5.T_1, S=geo_3, B=number_slider_9)  # -> S_2, E, int_2, L
cluster_6 = Cluster(vec=py3_5.S_1, S=geo_3, B=number_slider_9)  # -> S_2, E, int_2, L
previewlw_8 = CustomPreviewLineweights(Geometry=cluster_4.L, Shader=ColourSwatch(SwatchColor=RGB(255, 94, 94)), Thickness=number_slider_8, Absolute=False)
previewlw_9 = CustomPreviewLineweights(Geometry=cluster_5.L, Shader=ColourSwatch(SwatchColor=RGB(0, 102, 255)), Thickness=number_slider_8, Absolute=False)
previewlw_10 = CustomPreviewLineweights(Geometry=cluster_6.L, Shader=ColourSwatch(SwatchColor=RGB(0, 181, 9)), Thickness=number_slider_8, Absolute=False)
tag_7 = TextTag(Location=cluster_4.E, Text=cluster_4.int_2)
tag_8 = TextTag(Location=cluster_5.E, Text=cluster_5.int_2)
tag_9 = TextTag(Location=cluster_6.E, Text=cluster_6.int_2)
srf4pt_2 = _4PointSurface(CornerA=cluster_5.S_2, CornerB=cluster_5.E, CornerC=cluster_4.E, CornerD=cluster_6.E)

# ---- group: Viz gravity load 1 / CP
pt_3 = Point(py3_5.free_cg)

# ---- group: Viz gravity load 1
f_n = Panel(py3_5.gravity_force_1)
neg_3 = Negative(Value=py3_5.gravity_force_1)
vec_5 = VectorXYZ(XComponent=Slider(0, range=0..5), YComponent=Slider(0, range=0..5), ZComponent=neg_3)  # -> Vector, Length
vlen = VectorLength(Vector=vec_5.Vector)
multiplication_3 = Multiplication(A=vlen, B=number_slider_9)
amp_2 = Amplitude(Vector=vec_5.Vector, Amplitude=multiplication_3)
vdisex_3 = VectorDisplayEx(Point=pt_3, Vector=amp_2, Colour=RGB(0, 0, 0), Width=2)
move_4 = Move(Geometry=pt_3, Motion=amp_2)  # -> Geometry, Transform
int_3 = Integer(vlen)
tag_10 = TextTag(Location=move_4.Geometry, Text=int_3)

# ==== cluster Cluster
vec = ClusterInput()
vec_2 = Vector(vec)
vlen = VectorLength(Vector=vec_2)
B = ClusterInput()
multiplication = Multiplication(A=vlen, B=B)
S = ClusterInput()
panel = Panel(vlen)
line = LineSDL(Start=S, Direction=vec_2, Length=multiplication)
end = EndPoints(Curve=line)  # -> Start, End
L = ClusterOutput(line)
int = Integer(vlen)
S_2 = ClusterOutput(end.Start)
E = ClusterOutput(end.End)
int_2 = ClusterOutput(int)
