# Grasshopper definition bracket_6_python_final.gh (Grasshopper 1.0.8)
# plug-ins: MeshEdit Components, Human

# ---- group: Input BREPs
brep = Brep(<brep referenced from the Rhino model>)
brep_2 = Brep(<brep referenced from the Rhino model>)

# ---- group: Select face
debrep = DeconstructBrep(Brep=brep)  # -> Faces, Edges, Vertices
debrep_2 = DeconstructBrep(Brep=brep_2)  # -> Faces, Edges, Vertices
item = ListItem(List=debrep.Faces, Index=Slider(1, range=0..10), Wrap=True)
item_2 = ListItem(List=debrep_2.Faces, Index=Slider(5, range=0..10), Wrap=True)

# ---- group: Viz BREPs
merge = Merge(Data1=brep, Data2=brep_2)
preview = CustomPreview(Geometry=merge, Material=ColourSwatch(SwatchColor=RGBA(122, 122, 122, 92)))

# ---- group: Materials
py3 = Python3Script(csv_filename="materials.csv")  # -> out, materials, properties
# ---------- py3: Python ----------
import os, sys, re
import csv

def clean_header(header: str) -> str:
    """Remove units in square brackets, e.g. '[MPa]'."""
    return re.sub(r"\s*\[.*?\]", "", header).strip()

def load_csv_as_dict(path_to_csv: str):
    """
    Load a CSV and return a dictionary keyed by the first column.
    Each value is a dict of header -> cell_value for that row.
    """

    if not os.path.isfile(path_to_csv):
        raise FileNotFoundError(f"CSV file not found: {path_to_csv}")

    data_dict = {}

    with open(path_to_csv, newline='', encoding="utf-8") as f:
        reader = csv.reader(f)

        # Read and clean headers
        raw_headers = next(reader)
        headers = [clean_header(h) for h in raw_headers]

        # Use new headers in DictReader
        f.seek(0)
        dict_reader = csv.DictReader(f, fieldnames=headers)
        next(dict_reader)  # skip original header row

        first_col = headers[0]

        for row in dict_reader:
            key = row[first_col]
            data_dict[key] = row.copy()

    return data_dict

# ----------------------------------------------------------------------
# 1. Make sure the folder containing this .gh file is on sys.path
# ----------------------------------------------------------------------
gh_path = ghdoc.Path  # full path to the current Grasshopper file
if gh_path:
    gh_dir = os.path.dirname(gh_path)
    parent_dir = os.path.dirname(gh_dir)   # /path/to/parent/folder

    csv_path = os.path.join(parent_dir, csv_filename)

    material_dictionary = load_csv_as_dict(csv_path)
    materials = list(material_dictionary.keys())
    properties = list(material_dictionary[materials[0]].keys())
# ---------- end py3 ----------
panel = Panel(py3.materials)
panel_2 = Panel(py3.properties)

# ---- group: Get Material - supported part
list = ValueList({"S235 (Structural Steel)", "42CrMo4 (Heat-resistant Steel)", "1.4301 (Stainless Steel)", "EN AW-6061 (Aluminum Alloy)", "Cu-ETP (Copper)"}, selected="Cu-ETP (Copper)")
list_2 = ValueList({"Material", "Elastic Modulus", "Shear Modulus", "Density", "Ultimate Strength", "Yield Strength", "Shear Strength", "Poisson's Ratio"}, selected="Density")
py3_2 = Python3Script(csv_filename="materials.csv", material=list, prop=list_2)  # -> out, materials, properties, value
# ---------- py3_2: Python ----------
import os, sys, re
import csv

def clean_header(header: str) -> str:
    """Remove units in square brackets, e.g. '[MPa]'."""
    return re.sub(r"\s*\[.*?\]", "", header).strip()

def load_csv_as_dict(path_to_csv: str):
    """
    Load a CSV and return a dictionary keyed by the first column.
    Each value is a dict of header -> cell_value for that row.
    """

    if not os.path.isfile(path_to_csv):
        raise FileNotFoundError(f"CSV file not found: {path_to_csv}")

    data_dict = {}

    with open(path_to_csv, newline='', encoding="utf-8") as f:
        reader = csv.reader(f)

        # Read and clean headers
        raw_headers = next(reader)
        headers = [clean_header(h) for h in raw_headers]

        # Use new headers in DictReader
        f.seek(0)
        dict_reader = csv.DictReader(f, fieldnames=headers)
        next(dict_reader)  # skip original header row

        first_col = headers[0]

        for row in dict_reader:
            key = row[first_col]
            data_dict[key] = row.copy()

    return data_dict

# ----------------------------------------------------------------------
# 1. Make sure the folder containing this .gh file is on sys.path
# ----------------------------------------------------------------------
gh_path = ghdoc.Path  # full path to the current Grasshopper file
if gh_path:
    gh_dir = os.path.dirname(gh_path)
    parent_dir = os.path.dirname(gh_dir)   # /path/to/parent/folder

    csv_path = os.path.join(parent_dir, csv_filename)

    material_dictionary = load_csv_as_dict(csv_path)

    materials = list(material_dictionary.keys())
    properties = list(material_dictionary[materials[0]].keys())
    
    value = material_dictionary[material][prop]
# ---------- end py3_2 ----------
panel_3 = Panel(py3_2.value)
panel_4 = Panel(py3_2.materials)
panel_5 = Panel(py3_2.properties)

# ---- group: min bracket extension to first fixture
number_slider = Slider(500, range=0..500)

# ----
number_slider_2 = Slider(50, range=0..200)

# ---- group: plate thickness (mm)
number_slider_3 = Slider(10, range=0..25)

# ----
panel_6 = Panel("data\materials\materials.csv")

# ---- group: Init bolt radius
number_slider_4 = Slider(8, range=0..10)

# ---- group: bolt spacing Y mult
number_slider_5 = Slider(2, range=1..5)

number_slider_6 = Slider(2, range=1..5)

# ---- group: max bolt dia
number_slider_7 = Slider(20, range=0..20)

# ---- group: vector thickness
number_slider_8 = Slider(5, range=0..10)

# ----
list_3 = ValueList({"S235 (Structural Steel)", "42CrMo4 (Heat-resistant Steel)", "1.4301 (Stainless Steel)", "EN AW-6061 (Aluminum Alloy)", "Cu-ETP (Copper)"}, selected="Cu-ETP (Copper)")
list_4 = ValueList({"S235 (Structural Steel)", "42CrMo4 (Heat-resistant Steel)", "1.4301 (Stainless Steel)", "EN AW-6061 (Aluminum Alloy)", "Cu-ETP (Copper)"}, selected="1.4301 (Stainless Steel)")

# ---- group: Vector scaling
number_slider_9 = Slider(0.022, range=0..0.1)

# ---- group: Num ribs
number_slider_10 = Slider(1, range=0..2)

# ----
merge_2 = Merge(Data1=brep_2)
area = Area(Geometry=item)  # -> Area, Centroid
area_2 = Area(Geometry=item_2)  # -> Area, Centroid
panel_7 = Panel(area.Area)
panel_8 = Panel(area_2.Area)
py3_3 = Python3Script(
    free_objects=merge_2,
    srf_1=item,
    srf_2=item_2,
    min_bracket_extension=number_slider,
    max_bolt_dia=number_slider_7,
    min_edge_clearance=number_slider_2,
    bolt_spacing_1=number_slider_5,
    bolt_spacing_2=number_slider_6,
    init_bolt_radius=number_slider_4,
    init_plate_thickness=number_slider_3,
    num_ribs=number_slider_10,
    material_csv=panel_6,
    material_free=list_3,
    material_bracket=list_4)  # -> out, plane_2, boundary_1, boundary_2, far_edge_1, far_edge_2, intersect_line, placement_edge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; inputs free_objects: list of Brep, srf_1: Surface, srf_2: Surface
# ---------- py3_3: Python ----------
import os, sys, re, csv, importlib, json
from typing import List, Tuple, Optional, Callable, Protocol, runtime_checkable, Any, Dict

def require(cond: bool, msg: str):
    if not cond:
        raise ValueError(msg)

# ----------------------------------------------------------------------
# Make sure the folder containing this .gh file is on sys.path
# ----------------------------------------------------------------------

gh_path = ghdoc.Path  # full path to the current Grasshopper file
if gh_path:
    gh_dir = os.path.dirname(gh_path)
    parent_dir = os.path.dirname(gh_dir)   # /path/to/parent/folder

    if parent_dir not in sys.path:
        sys.path.append(parent_dir)

# ----------------------------------------------------------------------
# Import libraries
# ----------------------------------------------------------------------

import geom.common
import geom.rhino_backend
import scripts.bracket

importlib.reload(geom.common)
importlib.reload(geom.rhino_backend)
importlib.reload(scripts.bracket)

from geom.rhino_backend import RhinoBackend
from scripts.bracket import main

# ----------------------------------------------------------------------
# Load material library from CSV
# ----------------------------------------------------------------------

def clean_header(header: str) -> str:
    return re.sub(r"\s*\[.*?\]", "", header).strip()

def load_csv_as_dict(path_to_csv: str):
    if not os.path.isfile(path_to_csv):
        raise FileNotFoundError(f"CSV file not found: {path_to_csv}")

    data_dict = {}
    with open(path_to_csv, newline="", encoding="utf-8") as f:
        reader = csv.reader(f)
        raw_headers = next(reader)
        headers = [clean_header(h) for h in raw_headers]

        f.seek(0)
        dict_reader = csv.DictReader(f, fieldnames=headers)
        next(dict_reader)

        key_col = headers[0]
        for row in dict_reader:
            data_dict[row[key_col]] = row.copy()

    return data_dict

csv_path = os.path.join(parent_dir, material_csv)
material_dictionary = load_csv_as_dict(csv_path)

# ----------------------------------------------------------------------
# GH execution
# ----------------------------------------------------------------------

geom = RhinoBackend()

result = main(
    geom=geom,
    srf_1=srf_1,
    srf_2=srf_2,
    free_objects=free_objects,

    min_edge_clearance=min_edge_clearance,
    num_ribs=num_ribs,
    init_plate_thickness=init_plate_thickness,

    bolt_spacing_1=bolt_spacing_1,
    bolt_spacing_2=bolt_spacing_2,
    init_bolt_radius=init_bolt_radius,
    max_bolt_dia=max_bolt_dia,

    material_dictionary=material_dictionary,
    material_free=material_free,
    material_bracket=material_bracket,
)

def get_geo(result, key):
    if key not in result.keys():
        return None
    return result[key]._rg()

plane_2 = get_geo(result, "plane_2")

perp_1 = get_geo(result, "perp_1")
perp_2 = get_geo(result, "perp_2")

boundary_1 = get_geo(result, "boundary_1")
boundary_2 = get_geo(result, "boundary_2")

far_edge_1 = get_geo(result, "far_edge_1")
far_edge_2 = get_geo(result, "far_edge_2")

intersect_line = get_geo(result, "intersect_line")
placement_edge = get_geo(result, "placement_edge")

mid_extension_1 = get_geo(result, "mid_extension_1")
mid_extension_2 = get_geo(result, "mid_extension_2")

axis_0 = get_geo(result, "axis_0")

cps_bolts_1 = [pt._rg() for pt in result.get("cps_bolts_1")]
cps_bolts_2 = [pt._rg() for pt in result.get("cps_bolts_2")]

profile_curve = get_geo(result, "profile_curve")
inside_poly_curve = get_geo(result, "inside_poly_curve")

bracket_solid = get_geo(result, "bracket_solid")
inside_ribs = [geo._rg() for geo in result.get("inside_ribs")]

bolts_geo = result.get("bolts_geo")

gravity_force_1 = result["mass"]["gravity_force_1"]
gravity_force_2 = result["mass"]["gravity_force_2"]
free_cg = result["mass"]["free_cg"]._rg()
combined_cg = result["mass"]["combined_cg"]._rg()

R_1 = [geom.vector(*vector)._rg() for vector in result["reactions"]["R_1"]]
R_2 = [geom.vector(*vector)._rg() for vector in result["reactions"]["R_2"]]
T_1 = [geom.vector(*vector)._rg() for vector in result["reactions"]["T_1"]]
T_2 = [geom.vector(*vector)._rg() for vector in result["reactions"]["T_2"]]
S_1 = [geom.vector(*vector)._rg() for vector in result["reactions"]["S_1"]]
S_2 = [geom.vector(*vector)._rg() for vector in result["reactions"]["S_2"]]

bolt_summary = result["bolts"]["bolt_summary"]
bolt_sizes = result["bolts"]["bolt_sizes"]

bb = json.dumps(result["opt"]["bb"])

t_opt = result["opt"]["t_opt"]

import Rhino.Geometry as rg
# ---------- end py3_3 ----------
py3_4 = Python3Script(
    free_objects=merge_2,
    srf_1=item,
    srf_2=item_2,
    max_bolt_dia=number_slider_7,
    min_edge_clearance=number_slider_2,
    bolt_spacing_1=number_slider_5,
    bolt_spacing_2=number_slider_6,
    init_bolt_radius=number_slider_4,
    init_plate_thickness=number_slider_3,
    num_ribs=number_slider_10,
    material_csv=panel_6,
    material_free=list_3,
    material_bracket=list_4)  # -> out, inputs; inputs free_objects: list of Brep, srf_1: Surface, srf_2: Surface
# ---------- py3_4: Python ----------
import json, re, csv, os, sys

import Rhino
import Rhino.Geometry as rg

# ----------------------------------------------------------------------
# Make sure the folder containing this .gh file is on sys.path
# ----------------------------------------------------------------------

gh_path = ghdoc.Path  # full path to the current Grasshopper file
if gh_path:
    gh_dir = os.path.dirname(gh_path)
    parent_dir = os.path.dirname(gh_dir)   # /path/to/parent/folder

    if parent_dir not in sys.path:
        sys.path.append(parent_dir)

def clean_header(header: str) -> str:
    return re.sub(r"\s*\[.*?\]", "", header).strip()

def load_csv_as_dict(path_to_csv: str):
    if not os.path.isfile(path_to_csv):
        raise FileNotFoundError(f"CSV file not found: {path_to_csv}")

    data_dict = {}
    with open(path_to_csv, newline="", encoding="utf-8") as f:
        reader = csv.reader(f)
        raw_headers = next(reader)
        headers = [clean_header(h) for h in raw_headers]

        f.seek(0)
        dict_reader = csv.DictReader(f, fieldnames=headers)
        next(dict_reader)

        key_col = headers[0]
        for row in dict_reader:
            data_dict[row[key_col]] = row.copy()

    return data_dict

csv_path = os.path.join(parent_dir, material_csv)
material_dictionary = load_csv_as_dict(csv_path)

def mesh_surface_serialize(surface, *, density=1.0, max_edge_length=None, jagged_seams=False, simple_planes=True):
    """
    Mesh a Rhino surface/Brep face and serialize to:
      {
        "geometry": {
          "positions": {"0": x0, "1": y0, "2": z0, ...},
          "indices":   {"0": i0, "1": i1, "2": i2, ...},
          "itemSize": 3
        }
      }

    Args:
      surface: rg.Surface | rg.BrepFace | rg.Brep
      density: float (larger => finer, used for MeshingParameters.Density)
      max_edge_length: float | None (if set, limits max edge length)
      jagged_seams: bool
      simple_planes: bool
    """
    tol = Rhino.RhinoDoc.ActiveDoc.ModelAbsoluteTolerance if Rhino.RhinoDoc.ActiveDoc else 1e-6

    # --- Build meshing parameters ---
    mp = rg.MeshingParameters.Default
    mp.JaggedSeams = bool(jagged_seams)
    mp.SimplePlanes = bool(simple_planes)
    mp.RefineGrid = True
    mp.Density = float(density)
    mp.Tolerance = float(tol)

    if max_edge_length is not None:
        mp.MaximumEdgeLength = float(max_edge_length)

    # --- Get meshes ---
    meshes = []

    if isinstance(surface, rg.BrepFace):
        m = rg.Mesh.CreateFromBrep(surface.DuplicateFace(False), mp)
        if m: meshes.extend(m)

    elif isinstance(surface, rg.Surface):
        brep = surface.ToBrep()
        m = rg.Mesh.CreateFromBrep(brep, mp)
        if m: meshes.extend(m)

    elif isinstance(surface, rg.Brep):
        m = rg.Mesh.CreateFromBrep(surface, mp)
        if m: meshes.extend(m)

    else:
        print(type(surface))
        raise TypeError("surface must be rg.Surface, rg.BrepFace, or rg.Brep")

    if not meshes:
        raise ValueError("Meshing produced no meshes.")

    # Join multiple meshes (if Brep has multiple faces)
    mesh = rg.Mesh()
    for mm in meshes:
        mesh.Append(mm)

    mesh.Vertices.CombineIdentical(True, True)
    mesh.UnifyNormals()
    mesh.Normals.ComputeNormals()
    mesh.Compact()

    # --- Positions ---
    positions = {}
    pi = 0
    for v in mesh.Vertices:
        positions[str(pi + 0)] = float(v.Y)
        positions[str(pi + 1)] = float(v.Z)
        positions[str(pi + 2)] = float(v.X)
        pi += 3

    # --- Indices (triangulate quads) ---
    indices = {}
    ii = 0
    for f in mesh.Faces:
        if f.IsTriangle:
            indices[str(ii + 0)] = int(f.A)
            indices[str(ii + 1)] = int(f.B)
            indices[str(ii + 2)] = int(f.C)
            ii += 3
        else:
            # quad -> two triangles: (A,B,C) and (A,C,D)
            indices[str(ii + 0)] = int(f.A)
            indices[str(ii + 1)] = int(f.B)
            indices[str(ii + 2)] = int(f.C)
            indices[str(ii + 3)] = int(f.A)
            indices[str(ii + 4)] = int(f.C)
            indices[str(ii + 5)] = int(f.D)
            ii += 6

    return {
        "geometry": {
            "positions": positions,
            "indices": indices,
            "itemSize": 3,
        }
    }

# Example usage:
# srf_payload = mesh_surface_serialize(srf)
# out = {"srf_1": srf_payload}

data = [
  {
    "srf_1": mesh_surface_serialize(srf_1),
    "srf_2": mesh_surface_serialize(srf_2),
    "free_objects": [mesh_surface_serialize(free_object) for free_object in free_objects],

    "min_edge_clearance": min_edge_clearance,
    "num_ribs": num_ribs,
    "init_plate_thickness": init_plate_thickness,

    "bolt_spacing_1": bolt_spacing_1,
    "bolt_spacing_2": bolt_spacing_2,
    "init_bolt_radius": init_bolt_radius,
    "max_bolt_dia": max_bolt_dia,

    "material_dictionary": material_dictionary,
    "material_free": material_free,
    "material_bracket": material_bracket
  }
]

inputs = json.dumps(data)
# ---------- end py3_4 ----------
panel_9 = Panel(py3_3.bolt_summary)
py3_5 = Python3Script(run=Toggle(True), inputs=py3_4.inputs)  # -> out, plane_1, plane_2, perp_1, perp_2, boundary_1, boundary_2, raw_intersection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
# ---------- py3_5: Python ----------
import json, os, sys, importlib
from json import encoder
import subprocess
import Rhino.Geometry as rg

# ----------------------------------------------------------------------
# Make sure the folder containing this .gh file is on sys.path
# ----------------------------------------------------------------------

gh_path = ghdoc.Path  # full path to the current Grasshopper file
if gh_path:
    gh_dir = os.path.dirname(gh_path)
    parent_dir = os.path.dirname(gh_dir)   # /path/to/parent/folder

    if parent_dir not in sys.path:
        sys.path.append(parent_dir)

# ----------------------------------------------------------------------
# Import libraries
# ----------------------------------------------------------------------

import geom.rhino_backend
importlib.reload(geom.rhino_backend)
from geom.rhino_backend import RhinoPoint, RhinoVector, RhinoPlane, RhinoLine, RhinoCurve, RhinoMesh

def get_points(key):
    points_data = data.get(key)
    return [RhinoPoint(*point_data)._rg() for point_data in points_data]

def get_vec(key):
    print(key)
    vec = data.get(key)
    return RhinoVector(*vec)._rg()

def get_plane(key):
    plane = data.get(key)
    return RhinoPlane(plane.get("origin"), plane.get("normal"))._rg()

def get_poly(key):
    poly_data = data.get(key)
    return RhinoCurve(poly_data)._rg()

def get_line(key):
    line_data = data.get(key)
    return RhinoLine(line_data[0], line_data[1])._rg()

def get_mesh(key):
    mesh_data = data.get(key)
    return RhinoMesh(mesh_data)._rg()

def quote(s):
    if s is None:
        return 'None'
    return '\"' + s + '\"'

### GET LOCAL PATH
file_path = ghenv.Component.OnPingDocument().FilePath.split("\\")
repo_path = "\\".join(file_path[:-2])
print("repo path:", repo_path)

data_path = repo_path + "\\data\\inputs.json"

py = r"C:\Users\danil\.conda\envs\pyoccenv\python.exe"

env = os.environ.copy()

# Remove the variables that hijack sys.path/site-packages
for k in ["PYTHONHOME", "PYTHONPATH", "PYTHONSAFEPATH", "PYTHONNOUSERSITE"]:
    env.pop(k, None)

# cmds = []
# cmds.append( "C:" )
# cmds.append( "cd {}".format(quote(repo_path)) )
# cmds.append( "{} {} {}".format(py, "run.py", quote(data_path)))

# print(cmds)

output = ""

# if run:
#     ### DUMP DATA TO LOCAL FILE
#     with open(data_path, "w") as f:
#         json.dump(json.loads(inputs), f, indent=2)
    
#     try:
#         output = subprocess.check_output("&&".join(cmds), stderr=subprocess.STDOUT, shell=True, env=env)
#     except subprocess.CalledProcessError as exc:
#         out = exc.output
#         if isinstance(out, (bytes, bytearray)):
#             out = out.decode("utf-8", errors="replace")

#         # normalize Windows newlines
#         out = out.replace("\r\n", "\n").replace("\r", "\n")

#         print("---- subprocess failed ----")
#         print("exit code:", exc.returncode)
#         print("---- stdout+stderr ----")
#         print(out)
#         print("---------------------------")

with open(data_path, "w") as f:
    json.dump(json.loads(inputs), f, indent=2)

# import os, subprocess

# repo_path = r"C:\Users\danil\OneDrive\Documents\Github\colidescope\os_server"
# py = r"C:\Users\danil\.conda\envs\pyoccenv\python.exe"
# inputs = r"C:\Users\danil\OneDrive\Documents\Github\colidescope\os_server\data\inputs.json"

# # Start with current env, then decontaminate
# env = os.environ.copy()

# # Remove common Python/Rhino contamination
# for k in ["PYTHONHOME", "PYTHONPATH", "PYTHONUSERBASE", "PYTHONEXECUTABLE"]:
#     env.pop(k, None)

# Force conda env + DLL search paths to the *right* place
conda_prefix = r"C:\Users\danil\.conda\envs\pyoccenv"
env["CONDA_PREFIX"] = conda_prefix

conda_paths = [
    conda_prefix,
    os.path.join(conda_prefix, "Scripts"),
    os.path.join(conda_prefix, "Library", "bin"),  # <-- very important for OCCT deps
    os.path.join(conda_prefix, "DLLs"),
]
env["PATH"] = ";".join(conda_paths + [env.get("PATH", "")])

# Get a traceback-ish dump on native crash
env["PYTHONFAULTHANDLER"] = "1"

cp = subprocess.run(
    [py, "-X", "faulthandler", "run.py", data_path],
    cwd=repo_path,
    env=env,
    capture_output=True,
    text=True,          # decode stdout/stderr to str
)

print("exit:", cp.returncode)
print("---- STDOUT ----")
print(cp.stdout)
print("---- STDERR ----")
print(cp.stderr)

output = cp.stdout

# print(output)

if len(output) > 0:
    # text = output.decode("utf-8", errors="replace")
    # text=output
    output_path = output.split("\n")[-2]
    output_path_joined = ("\\").join(output_path.strip().split("\\"))

    print("output path:", output_path)

    with open(output_path_joined, 'r') as f:
        data = json.load(f)

    # print(data)

    plane_1 = get_plane('plane_1')
    plane_2 = get_plane('plane_2')

    perp_1 = get_vec('perp_1')
    perp_2 = get_vec('perp_2')

    boundary_1 = get_poly('boundary_1')
    boundary_2 = get_poly('boundary_2')
    
    raw_intersection = get_line('raw_intersection')
    intersect_line = get_line('intersect_line')

    far_edge_1 = get_line('far_edge_1')
    far_edge_2 = get_line('far_edge_2')

    placement_edge = get_line('placement_edge')
    
    mid_extension_1 = get_line('mid_extension_1')
    mid_extension_2 = get_line('mid_extension_2')
    
    axis_0 = get_vec('axis_0')

    cps_bolts_1 = get_points('cps_bolts_1')
    cps_bolts_2 = get_points('cps_bolts_2')
    
    profile_curve = get_poly('profile_curve')
    inside_poly_curve = get_poly('inside_poly_curve')
    
    bracket_solid = get_mesh('bracket_solid')
    bracket_solid.RebuildNormals()
    bracket_solid.UnifyNormals()

    mass_data = data.get("mass")

    if mass_data:
        gravity_force_1 = mass_data.get("gravity_force_1")
        gravity_force_2 = mass_data.get("gravity_force_2")
        free_cg = RhinoPoint(*mass_data.get("free_cg"))._rg()
        combined_cg = RhinoPoint(*mass_data.get("combined_cg"))._rg()
    
    reactions_data = data.get("reactions")

    if reactions_data:
        R_1 = [RhinoVector(*vec)._rg() for vec in reactions_data.get("R_1")]
        R_2 = [RhinoVector(*vec)._rg() for vec in reactions_data.get("R_2")]
        T_1 = [RhinoVector(*vec)._rg() for vec in reactions_data.get("T_1")]
        T_2 = [RhinoVector(*vec)._rg() for vec in reactions_data.get("T_2")]
        S_1 = [RhinoVector(*vec)._rg() for vec in reactions_data.get("S_1")]
        S_2 = [RhinoVector(*vec)._rg() for vec in reactions_data.get("S_2")]
    
    bolts_data = data.get("bolts")

    if bolts_data:
        bolt_summary = bolts_data.get("bolt_summary")
        bolt_sizes = bolts_data.get("bolt_sizes")
        
    opt_data = data.get("opt")

    if bolts_data:
        bb = json.dumps(opt_data.get("bb"))
        t_opt = opt_data.get("t_opt")
# ---------- end py3_5 ----------
py3_6 = Python3Script(bb_data=py3_3.bb)  # -> out, A, B
# ---------- py3_6: Python ----------
import json
import Rhino.Geometry as rg

bb = json.loads(bb_data)

A = rg.Point3d(*bb.get("min"))
B = rg.Point3d(*bb.get("max"))
# ---------- end py3_6 ----------
box = Box2Pt(PointA=py3_6.A, PointB=py3_6.B, Plane=PlaneXY(0, 0, 0))
py3_7 = Python3Script(bb_data=py3_5.bb)  # -> out, A, B; same code as py3_6
geo = Geometry(py3_5.boundary_1)
geo_2 = Geometry(py3_5.boundary_2)
geo_3 = Geometry(py3_5.plane_1)
geo_4 = Geometry(py3_5.plane_2)
geo_5 = Geometry(py3_5.raw_intersection)
geo_6 = Geometry(py3_5.intersect_line)
geo_7 = Geometry(py3_5.far_edge_1)
geo_8 = Geometry(py3_5.far_edge_2)
geo_9 = Geometry(py3_5.placement_edge)
geo_10 = Geometry(py3_5.mid_extension_1)
geo_11 = Geometry(py3_5.cps_bolts_1)
geo_12 = Geometry(py3_5.cps_bolts_2)
geo_13 = Geometry(py3_5.profile_curve)
geo_14 = Geometry(py3_5.inside_poly_curve)
geo_15 = Geometry(py3_5.bracket_solid)
geo_16 = Geometry(py3_5.mid_extension_2)
box_2 = Box2Pt(PointA=py3_7.A, PointB=py3_7.B, Plane=PlaneXY(0, 0, 0))
geo_17 = Geometry(py3_3.mid_extension_2)
len = Length(Curve=geo_8)
len_2 = Length(Curve=geo_16)

# ---- group: Viz placement zone
line = Line(py3_3.mid_extension_2)
line_2 = Line(py3_3.mid_extension_1)
vec = Vector(line)
vec_2 = Vector(line_2)
extr = Extrude(Base=py3_3.placement_edge, Direction=vec_2)
extr_2 = Extrude(Base=py3_3.placement_edge, Direction=vec)
merge_3 = Merge(Data1=extr, Data2=extr_2)
join = BrepJoin(Breps=merge_3)  # -> Breps, Closed
mesh = MeshBrep(
    Brep=join.Breps,
    Settings={GridMaxCount=0, GridMinCount=16, JaggedSeams=False, MaxEdgeLength=0, MinEdgeLength=0.0001, MinTolerance=0, Refine=True, RefineAngle=0, RelativeTolerance=0.65, SimplePlanes=True, Tolerance=0})
panel_10 = Panel("""50
25""")
wires = BrepWireframe(Brep=join.Breps, Density=-1)
dash = DashPattern(Curve=wires, Pattern=panel_10)  # -> Dashes, Gaps
area_3 = MeshArea(Mesh=mesh)  # -> Area, Centroid
preview_2 = CustomPreview(Geometry=mesh, Material=ColourSwatch(SwatchColor=RGBA(102, 102, 102, 124)))
previewlw = CustomPreviewLineweights(Geometry=dash.Dashes, Shader=ColourSwatch(SwatchColor=RGB(0, 0, 0)), Thickness=Slider(3.23, range=0..10), Absolute=False)
panel_11 = Panel(area_3.Area)

# ---- group: viz surfaces
number_slider_11 = Slider(7.1, range=0..10)
swatch = ColourSwatch(SwatchColor=RGBA(204, 0, 255, 0))
swatch_2 = ColourSwatch(SwatchColor=RGBA(61, 196, 190, 37))
boundary = BoundarySurfaces(Edges=py3_3.boundary_2)
boundary_2 = BoundarySurfaces(Edges=py3_3.boundary_1)
preview_3 = CustomPreview(Geometry=boundary, Material=swatch_2)
previewlw_2 = CustomPreviewLineweights(Geometry=py3_3.boundary_1, Shader=swatch, Thickness=number_slider_11, Absolute=False)
preview_4 = CustomPreview(Geometry=boundary_2, Material=swatch)
previewlw_3 = CustomPreviewLineweights(Geometry=py3_3.boundary_2, Shader=swatch_2, Thickness=number_slider_11, Absolute=False)

# ---- group: viz placement area
line_3 = Line(py3_3.far_edge_1)
line_4 = Line(py3_3.far_edge_2)
line_5 = Line(py3_3.intersect_line)
vec_3 = Vector(line_3)
vec_4 = Vector(line_4)
extr_3 = Extrude(Base=line_5, Direction=vec_3)
extr_4 = Extrude(Base=line_5, Direction=vec_4)
merge_4 = Merge(Data1=extr_3, Data2=extr_4)
join_2 = BrepJoin(Breps=merge_4)  # -> Breps, Closed
preview_5 = CustomPreview(Geometry=join_2.Breps, Material=ColourSwatch(SwatchColor=RGBA(76, 82, 107, 49)))

# ---- group: Viz Oriented BB
xy = XYPlane(Origin=Point(0, 0, 0))
orient = Orient(Geometry=box_2, Source=xy, Target=py3_5.plane_2)  # -> Geometry, Transform
wires_2 = BrepWireframe(Brep=orient.Geometry, Density=-1)

xy_2 = XYPlane(Origin=Point(0, 0, 0))
orient_2 = Orient(Geometry=box, Source=xy_2, Target=py3_3.plane_2)  # -> Geometry, Transform
wires_3 = BrepWireframe(Brep=orient_2.Geometry, Density=-1)

# ---- group: Viz bracket geo / FINAL GEO
geo_18 = Geometry(py3_3.bracket_solid)

# ---- group: Response vector viz (free) / Free bolt points
geo_19 = Geometry(py3_3.cps_bolts_2)

# ---- group: Response vector viz (fixed) / Fixed bolt points
geo_20 = Geometry(py3_3.cps_bolts_1)

# ---- group: Viz load 2 / CP
pt = Point(py3_3.combined_cg)

# ---- group: Viz load 2
neg = Negative(Value=py3_3.gravity_force_2)
num = Number(number_slider_9)
multiplication = Multiplication(A=neg, B=num)
Z = UnitZ(Factor=multiplication)
move = Move(Geometry=pt, Motion=Z)  # -> Geometry, Transform
vdisex = VectorDisplayEx(Point=pt, Vector=Z, Colour=RGB(0, 0, 0), Width=2)
int = Integer(py3_3.gravity_force_2)
tag = TextTag(Location=move.Geometry, Text=int)

# ---- group: Bolt labels
lng = ListLength(List=py3_3.cps_bolts_1)
lng_2 = ListLength(List=py3_3.cps_bolts_2)
repeat = RepeatData(Data=py3_3.perp_1, Length=lng)
merge_5 = Merge(Data1=py3_3.cps_bolts_2, Data2=py3_3.cps_bolts_1)
repeat_2 = RepeatData(Data=py3_3.perp_2, Length=lng_2)
merge_6 = Merge(Data1=repeat_2, Data2=repeat)
amp = Amplitude(Vector=merge_6, Amplitude="20")
rev = Reverse(Vector=amp)
geo_21 = Geometry(merge_5)
move_2 = Move(Geometry=geo_21, Motion=amp)  # -> Geometry, Transform
tag_2 = TextTag(Location=move_2.Geometry, Text=py3_3.bolt_sizes)

# ---- group: Viz load 1 / CP
pt_2 = Point(py3_3.free_cg)

# ---- group: Viz load 1
neg_2 = Negative(Value=py3_3.gravity_force_1)
num_2 = Number(number_slider_9)
multiplication_2 = Multiplication(A=neg_2, B=num_2)
Z_2 = UnitZ(Factor=multiplication_2)
move_3 = Move(Geometry=pt_2, Motion=Z_2)  # -> Geometry, Transform
vdisex_2 = VectorDisplayEx(Point=pt_2, Vector=Z_2, Colour=RGB(0, 0, 0), Width=2)
int_2 = Integer(py3_3.gravity_force_1)
tag_3 = TextTag(Location=move_3.Geometry, Text=int_2)

# ---- group: Viz bracket geo
mesh_2 = MeshBrep(
    Brep=geo_18,
    Settings={GridMaxCount=0, GridMinCount=16, JaggedSeams=False, MaxEdgeLength=0, MinEdgeLength=0.0001, MinTolerance=0, Refine=True, RefineAngle=0, RelativeTolerance=0.65, SimplePlanes=True, Tolerance=0})
wires_4 = BrepWireframe(Brep=geo_18, Density=-1)
unifynormals = MeshUnifyNormals(Mesh=mesh_2)
previewlw_4 = CustomPreviewLineweights(Geometry=wires_4, Shader=ColourSwatch(SwatchColor=RGB(0, 0, 0)), Thickness=Slider(2, range=0..10), Absolute=False)
preview_6 = CustomPreview(Geometry=unifynormals, Material=ColourSwatch(SwatchColor=RGBA(168, 168, 99, 107)))

# ---- group: Response vector viz (free)
cluster = Cluster(vec=py3_3.R_2, S=geo_19, B=number_slider_9)  # -> S_2, E, int_2, L
cluster_2 = Cluster(vec=py3_3.T_2, S=geo_19, B=number_slider_9)  # -> S_2, E, int_2, L
cluster_3 = Cluster(vec=py3_3.S_2, S=geo_19, B=number_slider_9)  # -> S_2, E, int_2, L
previewlw_5 = CustomPreviewLineweights(Geometry=cluster.L, Shader=ColourSwatch(SwatchColor=RGB(255, 94, 94)), Thickness=number_slider_8, Absolute=False)
previewlw_6 = CustomPreviewLineweights(Geometry=cluster_2.L, Shader=ColourSwatch(SwatchColor=RGB(0, 102, 255)), Thickness=number_slider_8, Absolute=False)
previewlw_7 = CustomPreviewLineweights(Geometry=cluster_3.L, Shader=ColourSwatch(SwatchColor=RGB(0, 181, 9)), Thickness=number_slider_8, Absolute=False)
tag_4 = TextTag(Location=cluster.E, Text=cluster.int_2)
tag_5 = TextTag(Location=cluster_2.E, Text=cluster_2.int_2)
tag_6 = TextTag(Location=cluster_3.E, Text=cluster_3.int_2)
srf4pt = _4PointSurface(CornerA=cluster_2.S_2, CornerB=cluster_2.E, CornerC=cluster.E, CornerD=cluster_3.E)

# ---- group: Response vector viz (fixed)
cluster_4 = Cluster(vec=py3_3.R_1, S=geo_20, B=number_slider_9)  # -> S_2, E, int_2, L
cluster_5 = Cluster(vec=py3_3.T_1, S=geo_20, B=number_slider_9)  # -> S_2, E, int_2, L
cluster_6 = Cluster(vec=py3_3.S_1, S=geo_20, B=number_slider_9)  # -> S_2, E, int_2, L
previewlw_8 = CustomPreviewLineweights(Geometry=cluster_4.L, Shader=ColourSwatch(SwatchColor=RGB(255, 94, 94)), Thickness=number_slider_8, Absolute=False)
previewlw_9 = CustomPreviewLineweights(Geometry=cluster_5.L, Shader=ColourSwatch(SwatchColor=RGB(0, 102, 255)), Thickness=number_slider_8, Absolute=False)
previewlw_10 = CustomPreviewLineweights(Geometry=cluster_6.L, Shader=ColourSwatch(SwatchColor=RGB(0, 181, 9)), Thickness=number_slider_8, Absolute=False)
tag_7 = TextTag(Location=cluster_4.E, Text=cluster_4.int_2)
tag_8 = TextTag(Location=cluster_5.E, Text=cluster_5.int_2)
tag_9 = TextTag(Location=cluster_6.E, Text=cluster_6.int_2)
srf4pt_2 = _4PointSurface(CornerA=cluster_5.S_2, CornerB=cluster_5.E, CornerC=cluster_4.E, CornerD=cluster_6.E)

# ---- group: Viz gravity load 1 / CP
pt_3 = Point(py3_3.free_cg)

# ---- group: Viz gravity load 1
f_n = Panel(py3_3.gravity_force_1)
neg_3 = Negative(Value=py3_3.gravity_force_1)
vec_5 = VectorXYZ(XComponent=Slider(0, range=0..5), YComponent=Slider(0, range=0..5), ZComponent=neg_3)  # -> Vector, Length
vlen = VectorLength(Vector=vec_5.Vector)
multiplication_3 = Multiplication(A=vlen, B=number_slider_9)
amp_2 = Amplitude(Vector=vec_5.Vector, Amplitude=multiplication_3)
vdisex_3 = VectorDisplayEx(Point=pt_3, Vector=amp_2, Colour=RGB(0, 0, 0), Width=2)
move_4 = Move(Geometry=pt_3, Motion=amp_2)  # -> Geometry, Transform
int_3 = Integer(vlen)
tag_10 = TextTag(Location=move_4.Geometry, Text=int_3)

# ==== cluster Cluster
vec = ClusterInput()
vec_2 = Vector(vec)
vlen = VectorLength(Vector=vec_2)
B = ClusterInput()
multiplication = Multiplication(A=vlen, B=B)
S = ClusterInput()
panel = Panel(vlen)
line = LineSDL(Start=S, Direction=vec_2, Length=multiplication)
end = EndPoints(Curve=line)  # -> Start, End
L = ClusterOutput(line)
int = Integer(vlen)
S_2 = ClusterOutput(end.Start)
E = ClusterOutput(end.End)
int_2 = ClusterOutput(int)
