# Grasshopper definition test.gh (Grasshopper 1.0.7)

panel = Panel("[enter prod api without https:// here]")
toggle = BooleanToggle(True)
python = GhPythonScript(x=Slider(100, range=0..100), y=Slider(100, range=0..100), z=Slider(100, range=0..100))  # -> out, params
# ---------- python: Python ----------
import json

params = json.dumps({
    "x": x,
    "y": y,
    "z": z
})
# ---------- end python ----------
python_2 = GhPythonScript(r=Slider(100, range=0..100))  # -> out, params
# ---------- python_2: Python ----------
import json

params = json.dumps({
    "r": r
})
# ---------- end python_2 ----------
python_3 = GhPythonScript(run_local=toggle, prod_api=panel)  # -> out, products
# ---------- python_3: Python ----------
import httplib  # For Python 2.7 and IronPython
import urllib
import json
import Rhino
import scriptcontext as sc
import System
import rhinoscriptsyntax as rs
from System.Net import WebClient
from System.IO import MemoryStream
from uuid import uuid4
import os

# Determine the folder of the Grasshopper file and construct the file path
def get_grasshopper_folder():
    ### GET LOCAL PATH
    file_path = ghenv.Component.OnPingDocument().FilePath
    return os.path.dirname(file_path) if file_path else None


def call_api(run_local=False):
    """
    Call the create-box API to generate a box BREP.
    """
    
    if run_local:
        conn = httplib.HTTPConnection("127.0.0.1", 8000)
    else:
        conn = httplib.HTTPSConnection(prod_api, 443)
    
    # Set the headers for a JSON POST request
    headers = {
        "Content-type": "application/json",
        "Accept": "application/json"
    }

    # Make the request
    conn.request("GET", "/items")
    response = conn.getresponse()

    # Check the response status
    if response.status != 200:
        raise ValueError("API call failed with status {}: {}".format(response.status, response.read().decode("utf-8")))

    # Parse the response
    response_data = json.loads(response.read().decode("utf-8"))
    
    return response_data

products = call_api(run_local)
# ---------- end python_3 ----------
python_4 = GhPythonScript(run_local=toggle, prod_api=panel, product="cube", params=python.params)  # -> out, a
# ---------- python_4: Python ----------
import httplib  # For Python 2.7 and IronPython
import urllib
import json
import Rhino
import scriptcontext as sc
import System
import rhinoscriptsyntax as rs
from System.Net import WebClient
from System.IO import MemoryStream
from uuid import uuid4
import os

# Determine the folder of the Grasshopper file and construct the file path
def get_grasshopper_folder():
    ### GET LOCAL PATH
    file_path = ghenv.Component.OnPingDocument().FilePath
    return os.path.dirname(file_path) if file_path else None

def delete_objects_on_layer(layer_name):
    """
    Delete all objects on the current layer.
    """
    # Switch context to Rhino document
    ghdoc = sc.doc
    sc.doc = Rhino.RhinoDoc.ActiveDoc
    
    try:
        objects = rs.ObjectsByLayer(layer_name)
        
        if objects:
            print("Deleting {} objects on layer [{}]".format(len(objects), layer_name))
            rs.DeleteObjects(objects)
    finally:
        # Restore context to Grasshopper document
        sc.doc = ghdoc
 
def call_create_object_api(product, params, run_local=False):
    """
    Call the create-box API to generate a box BREP.
    """
    
    if run_local:
        conn = httplib.HTTPConnection("127.0.0.1", 8000)
    else:
        conn = httplib.HTTPSConnection(prod_api, 443)
    
    # Prepare the JSON request body
    body = json.dumps({
        "product": product,
        "params": params
    })
    
    # Set the headers for a JSON POST request
    headers = {
        "Content-type": "application/json",
        "Accept": "application/json"
    }

    # Make the request
    conn.request("POST", "/create-object", body, headers)
    response = conn.getresponse()

    # Check the response status
    if response.status != 200:
        raise ValueError("API call failed with status {}: {}".format(response.status, response.read().decode("utf-8")))

    # Parse the response
    response_data = json.loads(response.read().decode("utf-8"))
    
    return response_data["path_to_iges_file"]

def download_iges_from_url(url):
    """
    Download the IGES file from the given public URL and save it locally.
    """
    
    # Get the Grasshopper file's folder
    gh_folder = get_grasshopper_folder()
    
    # Generate a local file name
    local_filename = os.path.join(gh_folder, "{}.iges".format(uuid4()))
    
     # Open the URL and save the content to a local file
    response = urllib.urlopen(url)  # Use `urllib.urlopen` for IronPython
    with open(local_filename, 'wb') as out_file:
        out_file.write(response.read())
    
    # Close the response explicitly since `with` is not supported
    response.close()
    
    return local_filename

# Function to import IGES into Rhino
def import_iges_to_rhino(file_path):
    """
    Import an IGES file into Rhino using RhinoScriptSyntax.
    """
    if not os.path.exists(file_path):
        raise ValueError("File not found: {file}".format(file=file_path))

    # Import the IGES file using Rhino's command
    rs.Command("-Import \"{path}\" Enter".format(path=file_path))

# Main function
def create_object_in_rhino(product, params):
    """
    Generate a box through the API, download its IGES file from S3, and import it into Rhino.
    """
    
#    print(params)
#    
#    x = params["x"]
#    y = params["y"]
#    z = params["z"]
    
    # Call the API to generate the IGES file
    s3_url = call_create_object_api(product, params, run_local)
    
    # Replace the old download function
    local_file_path = download_iges_from_url(s3_url)
    
    try:
        # Import the IGES file into Rhino
        import_iges_to_rhino(local_file_path)
        
        # Redraw the document to update the view
        sc.doc.Views.Redraw()
        
        
    finally:
        # Clean up the downloaded IGES file
        if os.path.exists(local_file_path):
            os.remove(local_file_path)

# Delete any objects on target import layer
layer_name = "IGES level 0"
try:
    delete_objects_on_layer(layer_name)
except:
    print("Target layer [{}] not found".format(layer_name))

# Example usage
create_object_in_rhino(product, params)
# ---------- end python_4 ----------
python_5 = GhPythonScript(run_local=toggle, prod_api=panel, product="sphere", params=python_2.params)  # -> out, a; same code as python_4
panel_2 = Panel(python_3.products)
