# Grasshopper definition test2.gh (Grasshopper 1.0.7)
# plug-ins: Pufferfish

panel = Panel("[enter prod api without https:// here]")  # disabled
panel_2 = Panel("[enter prod api without https:// here]")
path = FilePath("C:\Users\danil\OneDrive\Documents\Github\colidescope\block-picker-app\rhino\test.xml")  # disabled
toggle = BooleanToggle(True)  # disabled
toggle_2 = BooleanToggle(True)
file = ReadFile(File=path, PerLineParse=False)  # disabled
panel_3 = Panel(file)  # disabled
python = GhPythonScript(x=Slider(97, range=0..100), y=Slider(97, range=0..100), z=Slider(100, range=0..100))  # -> out, params
# ---------- python: Python ----------
import json

params = json.dumps({
    "x": x,
    "y": y,
    "z": z
})
# ---------- end python ----------
python_2 = GhPythonScript(r=Slider(67, range=0..100))  # -> out, params
# ---------- python_2: Python ----------
import json

params = json.dumps({
    "r": r
})
# ---------- end python_2 ----------
python_3 = GhPythonScript(run_local=toggle_2, prod_api=panel_2)  # -> out, a
# ---------- python_3: Python ----------
import scriptcontext as sc

import httplib  # For Python 2.7 and IronPython
import urllib
import json
import Rhino
import scriptcontext as sc
import System
import rhinoscriptsyntax as rs
from System.Net import WebClient
from System.IO import MemoryStream
from uuid import uuid4
import os


if run_local:
    conn = httplib.HTTPConnection("127.0.0.1", 8000)
else:
    conn = httplib.HTTPSConnection(prod_api, 443)

sc.sticky["conn"] = conn
# ---------- end python_3 ----------
python_4 = GhPythonScript(run_local=toggle, prod_api=panel, xml=file)  # -> out, a; disabled
# ---------- python_4: Python ----------
import httplib  # For Python 2.7 and IronPython
import urllib
import json
import Rhino
import scriptcontext as sc
import System
import rhinoscriptsyntax as rs
from System.Net import WebClient
from System.IO import MemoryStream
from uuid import uuid4
import os

# Determine the folder of the Grasshopper file and construct the file path
def get_grasshopper_folder():
    ### GET LOCAL PATH
    file_path = ghenv.Component.OnPingDocument().FilePath
    return os.path.dirname(file_path) if file_path else None

def delete_objects_on_layer(layer_name):
    """
    Delete all objects on the current layer.
    """
    # Switch context to Rhino document
    ghdoc = sc.doc
    sc.doc = Rhino.RhinoDoc.ActiveDoc
    
    try:
        objects = rs.ObjectsByLayer(layer_name)
        
        if objects:
            print("Deleting {} objects on layer [{}]".format(len(objects), layer_name))
            rs.DeleteObjects(objects)
    finally:
        # Restore context to Grasshopper document
        sc.doc = ghdoc
 
def call_create_object_api(xml, run_local=False):
    """
    Call the create-box API to generate a box BREP.
    """
    
    if run_local:
        conn = httplib.HTTPConnection("127.0.0.1", 8888)
    else:
        conn = httplib.HTTPSConnection(prod_api, 443)
    
    # Prepare the JSON request body
    body = json.dumps({
        "xml": xml
    })
    
    print body
    
    # Set the headers for a JSON POST request
    headers = {
        "Content-type": "application/json",
        "Accept": "application/json"
    }

    # Make the request
    conn.request("PUT", "/.netlify/functions/xml-handler", body, headers)
    response = conn.getresponse()

    # Check the response status
    if response.status != 200:
        raise ValueError("API call failed with status {}: {}".format(response.status, response.read().decode("utf-8")))

    # Parse the response
    response_data = json.loads(response.read().decode("utf-8"))
    
    print response_data
    
    return response_data

def download_iges_from_url(url):
    """
    Download the IGES file from the given public URL and save it locally.
    """
    
    # Get the Grasshopper file's folder
    gh_folder = get_grasshopper_folder()
    
    # Generate a local file name
    local_filename = os.path.join(gh_folder, "{}.step".format(uuid4()))
    
     # Open the URL and save the content to a local file
    response = urllib.urlopen(url)  # Use `urllib.urlopen` for IronPython
    with open(local_filename, 'wb') as out_file:
        out_file.write(response.read())
    
    # Close the response explicitly since `with` is not supported
    response.close()
    
    return local_filename

# Function to import IGES into Rhino
def import_step_to_rhino(file_path):
    """
    Import an IGES file into Rhino using RhinoScriptSyntax.
    """
    if not os.path.exists(file_path):
        raise ValueError("File not found: {file}".format(file=file_path))

    # Import the IGES file using Rhino's command
    rs.Command("-Import \"{path}\" Enter".format(path=file_path))

# Main function
def create_object_in_rhino(xml):
    """
    Generate a box through the API, download its IGES file from S3, and import it into Rhino.
    """
    
#    print(params)
#    
#    x = params["x"]
#    y = params["y"]
#    z = params["z"]
    
    # Call the API to generate the IGES file
    s3_url = call_create_object_api(xml, run_local)
    
    # Replace the old download function
#    local_file_path = download_iges_from_url(s3_url)
#    
#    try:
#        # Import the IGES file into Rhino
#        import_step_to_rhino(local_file_path)
#        
#        # Redraw the document to update the view
#        sc.doc.Views.Redraw()
#        
#        
#    finally:
#        # Clean up the downloaded IGES file
#        if os.path.exists(local_file_path):
#            os.remove(local_file_path)

# Delete any objects on target import layer
#layer_name = "Default"
#try:
#    delete_objects_on_layer(layer_name)
#except:
#    print("Target layer [{}] not found".format(layer_name))

# Example usage
create_object_in_rhino(xml)
# ---------- end python_4 ----------
pipeline = GeometryPipeline(
    GroupByLayer=False,
    GroupByType=False,
    IncludeHidden=True,
    IncludeLocked=True,
    LayerFilter="*",
    NameFilter="*",
    SublayerFiltering=True,
    TypeFilter=1)
python_5 = GhPythonScript(run_local=toggle_2, prod_api=panel_2)  # -> out, products; disabled
# ---------- python_5: Python ----------
import httplib  # For Python 2.7 and IronPython
import urllib
import json
import Rhino
import scriptcontext as sc
import System
import rhinoscriptsyntax as rs
from System.Net import WebClient
from System.IO import MemoryStream
from uuid import uuid4
import os

# Determine the folder of the Grasshopper file and construct the file path
def get_grasshopper_folder():
    ### GET LOCAL PATH
    file_path = ghenv.Component.OnPingDocument().FilePath
    return os.path.dirname(file_path) if file_path else None


def call_api(run_local=False):
    """
    Call the create-box API to generate a box BREP.
    """
    
    if run_local:
        conn = httplib.HTTPConnection("127.0.0.1", 8000)
    else:
        conn = httplib.HTTPSConnection(prod_api, 443)
    
    # Set the headers for a JSON POST request
    headers = {
        "Content-type": "application/json",
        "Accept": "application/json"
    }

    # Make the request
    conn.request("GET", "/items")
    response = conn.getresponse()

    # Check the response status
    if response.status != 200:
        raise ValueError("API call failed with status {}: {}".format(response.status, response.read().decode("utf-8")))

    # Parse the response
    response_data = json.loads(response.read().decode("utf-8"))
    
    return response_data

products = call_api(run_local)
# ---------- end python_5 ----------
python_6 = GhPythonScript(run_local=toggle_2, prod_api=panel_2, product="create_sphere", params=python_2.params)  # -> out, a; disabled
# ---------- python_6: Python ----------
import httplib  # For Python 2.7 and IronPython
import urllib
import json
import Rhino
import scriptcontext as sc
import System
import rhinoscriptsyntax as rs
from System.Net import WebClient
from System.IO import MemoryStream
from uuid import uuid4
import os

# Determine the folder of the Grasshopper file and construct the file path
def get_grasshopper_folder():
    ### GET LOCAL PATH
    file_path = ghenv.Component.OnPingDocument().FilePath
    return os.path.dirname(file_path) if file_path else None

def delete_objects_on_layer(layer_name):
    """
    Delete all objects on the current layer.
    """
    # Switch context to Rhino document
    ghdoc = sc.doc
    sc.doc = Rhino.RhinoDoc.ActiveDoc
    
    try:
        objects = rs.ObjectsByLayer(layer_name)
        
        if objects:
            print("Deleting {} objects on layer [{}]".format(len(objects), layer_name))
            rs.DeleteObjects(objects)
    finally:
        # Restore context to Grasshopper document
        sc.doc = ghdoc
 
def call_create_object_api(product, params, run_local=False):
    """
    Call the create-box API to generate a box BREP.
    """
    
    if run_local:
        conn = httplib.HTTPConnection("127.0.0.1", 8000)
    else:
        conn = httplib.HTTPSConnection(prod_api, 443)
    
    # Prepare the JSON request body
    body = json.dumps({
        "product": product,
        "params": params
    })
    
    # Set the headers for a JSON POST request
    headers = {
        "Content-type": "application/json",
        "Accept": "application/json"
    }

    # Make the request
    conn.request("POST", "/create-object", body, headers)
    response = conn.getresponse()

    # Check the response status
    if response.status != 200:
        raise ValueError("API call failed with status {}: {}".format(response.status, response.read().decode("utf-8")))

    # Parse the response
    response_data = json.loads(response.read().decode("utf-8"))
    
    return response_data["path_to_file"]

def download_iges_from_url(url):
    """
    Download the IGES file from the given public URL and save it locally.
    """
    
    # Get the Grasshopper file's folder
    gh_folder = get_grasshopper_folder()
    
    # Generate a local file name
    local_filename = os.path.join(gh_folder, "{}.step".format(uuid4()))
    
     # Open the URL and save the content to a local file
    response = urllib.urlopen(url)  # Use `urllib.urlopen` for IronPython
    with open(local_filename, 'wb') as out_file:
        out_file.write(response.read())
    
    # Close the response explicitly since `with` is not supported
    response.close()
    
    return local_filename

# Function to import IGES into Rhino
def import_step_to_rhino(file_path):
    """
    Import an IGES file into Rhino using RhinoScriptSyntax.
    """
    if not os.path.exists(file_path):
        raise ValueError("File not found: {file}".format(file=file_path))

    # Import the IGES file using Rhino's command
    rs.Command("-Import \"{path}\" Enter".format(path=file_path))

# Main function
def create_object_in_rhino(product, params):
    """
    Generate a box through the API, download its IGES file from S3, and import it into Rhino.
    """
    
#    print(params)
#    
#    x = params["x"]
#    y = params["y"]
#    z = params["z"]
    
    # Call the API to generate the IGES file
    s3_url = call_create_object_api(product, params, run_local)
    
    # Replace the old download function
    local_file_path = download_iges_from_url(s3_url)
    
    try:
        # Import the IGES file into Rhino
        import_step_to_rhino(local_file_path)
        
        # Redraw the document to update the view
        sc.doc.Views.Redraw()
        
        
    finally:
        # Clean up the downloaded IGES file
        if os.path.exists(local_file_path):
            os.remove(local_file_path)

# Delete any objects on target import layer
layer_name = "Default"
try:
    delete_objects_on_layer(layer_name)
except:
    print("Target layer [{}] not found".format(layer_name))

# Example usage
create_object_in_rhino(product, params)
# ---------- end python_6 ----------
python_7 = GhPythonScript(run_local=toggle_2, prod_api=panel_2, product="create_cube", params=python.params)  # -> out, a; disabled; same code as python_6
python_8 = GhPythonScript()  # -> out, a
# ---------- python_8: Python ----------
import scriptcontext as sc

# Define the key
key = "conn"

# Retrieve the value if it exists
if key in sc.sticky:
    value = sc.sticky[key]
    print("Retrieved value: {}".format(value))
else:
    value = "No value found"

# Output the retrieved value
a = value  # Assigning to Grasshopper output
# ---------- end python_8 ----------
python_9 = GhPythonScript(product="create_cube", params=python.params)  # -> out, a; disabled
# ---------- python_9: Python ----------
import httplib  # For Python 2.7 and IronPython
import urllib
import json
import Rhino
import scriptcontext as sc
import System
import rhinoscriptsyntax as rs
from System.Net import WebClient
from System.IO import MemoryStream
from uuid import uuid4
import os

# Determine the folder of the Grasshopper file and construct the file path
def get_grasshopper_folder():
    ### GET LOCAL PATH
    file_path = ghenv.Component.OnPingDocument().FilePath
    return os.path.dirname(file_path) if file_path else None

def delete_objects_on_layer(layer_name):
    """
    Delete all objects on the current layer.
    """
    # Switch context to Rhino document
    ghdoc = sc.doc
    sc.doc = Rhino.RhinoDoc.ActiveDoc
    
    try:
        objects = rs.ObjectsByLayer(layer_name)
        
        if objects:
            print("Deleting {} objects on layer [{}]".format(len(objects), layer_name))
            rs.DeleteObjects(objects)
    finally:
        # Restore context to Grasshopper document
        sc.doc = ghdoc
 
def call_create_object_api(product, params):
    """
    Call the create-box API to generate a box BREP.
    """
    
    if "conn" in sc.sticky:
        conn = sc.sticky["conn"]
    else:
        conn = httplib.HTTPConnection("127.0.0.1", 8000)
    
    # Prepare the JSON request body
    body = json.dumps({
        "product": product,
        "params": params
    })
    
    # Set the headers for a JSON POST request
    headers = {
        "Content-type": "application/json",
        "Accept": "application/json"
    }

    # Make the request
    conn.request("POST", "/create-object", body, headers)
    response = conn.getresponse()

    # Check the response status
    if response.status != 200:
        raise ValueError("API call failed with status {}: {}".format(response.status, response.read().decode("utf-8")))

    # Parse the response
    response_data = json.loads(response.read().decode("utf-8"))
    
    return response_data["path_to_file"]

def download_iges_from_url(url):
    """
    Download the IGES file from the given public URL and save it locally.
    """
    
    # Get the Grasshopper file's folder
    gh_folder = get_grasshopper_folder()
    
    # Generate a local file name
    local_filename = os.path.join(gh_folder, "{}.step".format(uuid4()))
    
     # Open the URL and save the content to a local file
    response = urllib.urlopen(url)  # Use `urllib.urlopen` for IronPython
    with open(local_filename, 'wb') as out_file:
        out_file.write(response.read())
    
    # Close the response explicitly since `with` is not supported
    response.close()
    
    return local_filename

# Function to import IGES into Rhino
def import_step_to_rhino(file_path):
    """
    Import an IGES file into Rhino using RhinoScriptSyntax.
    """
    if not os.path.exists(file_path):
        raise ValueError("File not found: {file}".format(file=file_path))

    # Import the IGES file using Rhino's command
    rs.Command("-Import \"{path}\" Enter".format(path=file_path))

# Main function
def create_object_in_rhino(product, params):
    """
    Generate a box through the API, download its IGES file from S3, and import it into Rhino.
    """
    
#    print(params)
#    
#    x = params["x"]
#    y = params["y"]
#    z = params["z"]
    
    # Call the API to generate the IGES file
    s3_url = call_create_object_api(product, params)
    
    # Replace the old download function
    local_file_path = download_iges_from_url(s3_url)
    
    try:
        # Import the IGES file into Rhino
        import_step_to_rhino(local_file_path)
        
        # Redraw the document to update the view
        sc.doc.Views.Redraw()
        
        
    finally:
        # Clean up the downloaded IGES file
        if os.path.exists(local_file_path):
            os.remove(local_file_path)

# Delete any objects on target import layer
layer_name = "Default"
try:
    delete_objects_on_layer(layer_name)
except:
    print("Target layer [{}] not found".format(layer_name))

# Example usage
create_object_in_rhino(product, params)
# ---------- end python_9 ----------
path_2 = FilePath("C:\Users\danil\OneDrive\Documents\Github\colidescope\block-picker-app\rhino\Sphere.json")
file_2 = ReadFile(File=path_2, PerLineParse=False)
panel_4 = Panel(python_5.products)
pt = Point(pipeline)
srf = Surface(<surface referenced from the Rhino model>)
sph = Sphere(Base=PlaneXY(0, 0, 0), Radius=1)
panel_5 = Panel(file_2)
python_10 = GhPythonScript(script=file_2)  # -> out, a
# ---------- python_10: Python ----------
import httplib  # For Python 2.7 and IronPython
import urllib
import json
import Rhino
import scriptcontext as sc
import System
import rhinoscriptsyntax as rs
from System.Net import WebClient
from System.IO import MemoryStream
from uuid import uuid4
import os

# Determine the folder of the Grasshopper file and construct the file path
def get_grasshopper_folder():
    ### GET LOCAL PATH
    file_path = ghenv.Component.OnPingDocument().FilePath
    return os.path.dirname(file_path) if file_path else None

def delete_objects_on_layer(layer_name):
    """
    Delete all objects on the current layer.
    """
    # Switch context to Rhino document
    ghdoc = sc.doc
    sc.doc = Rhino.RhinoDoc.ActiveDoc
    
    try:
        objects = rs.ObjectsByLayer(layer_name)
        
        if objects:
            print("Deleting {} objects on layer [{}]".format(len(objects), layer_name))
            rs.DeleteObjects(objects)
    finally:
        # Restore context to Grasshopper document
        sc.doc = ghdoc
 
def call_create_object_api(script):
    """
    Call the create-box API to generate a box BREP.
    """
    
    conn = httplib.HTTPConnection("127.0.0.1", 8000)
    
    print(script)
    
    # Prepare the JSON request body
    body = json.dumps({
        "script": script
    })
    
    # Set the headers for a JSON POST request
    headers = {
        "Content-type": "application/json",
        "Accept": "application/json"
    }

    # Make the request
    conn.request("POST", "/run-script", body, headers)
    response = conn.getresponse()

    # Check the response status
    if response.status != 200:
        raise ValueError("API call failed with status {}: {}".format(response.status, response.read().decode("utf-8")))

    # Parse the response
    response_data = json.loads(response.read().decode("utf-8"))
    
    return response_data["path_to_file"]

def download_iges_from_url(url):
    """
    Download the IGES file from the given public URL and save it locally.
    """
    
    # Get the Grasshopper file's folder
    gh_folder = get_grasshopper_folder()
    
    # Generate a local file name
    local_filename = os.path.join(gh_folder, "{}.step".format(uuid4()))
    
     # Open the URL and save the content to a local file
    response = urllib.urlopen(url)  # Use `urllib.urlopen` for IronPython
    with open(local_filename, 'wb') as out_file:
        out_file.write(response.read())
    
    # Close the response explicitly since `with` is not supported
    response.close()
    
    return local_filename

# Function to import IGES into Rhino
def import_step_to_rhino(file_path):
    """
    Import an IGES file into Rhino using RhinoScriptSyntax.
    """
    if not os.path.exists(file_path):
        raise ValueError("File not found: {file}".format(file=file_path))

    # Import the IGES file using Rhino's command
    rs.Command("-Import \"{path}\" Enter".format(path=file_path))

# Main function
def create_object_in_rhino(script):
    
    # Call the API to generate the IGES file
    s3_url = call_create_object_api(script)
    
    # Replace the old download function
    local_file_path = download_iges_from_url(s3_url)
    
    try:
        # Import the IGES file into Rhino
        import_step_to_rhino(local_file_path)
        
        # Redraw the document to update the view
        sc.doc.Views.Redraw()
        
    finally:
        # Clean up the downloaded IGES file
        if os.path.exists(local_file_path):
            os.remove(local_file_path)

# Delete any objects on target import layer
layer_name = "Default"
try:
    delete_objects_on_layer(layer_name)
except:
    print("Target layer [{}] not found".format(layer_name))

# Example usage
create_object_in_rhino(script)
# ---------- end python_10 ----------
bbox = BoundingBox(Content=pt, Plane=PlaneXY(0, 0, 0), UnionBox=True)  # -> Box, Box_2
edges = BrepEdges(Brep=srf)  # -> Naked, Interior, NonManifold
plfit = PlaneFit(Points=pt)  # -> Plane, Deviation
join = JoinCurves(Curves=edges.Naked, Preserve=False)
offcrv = OffsetCurve(Curve=join, Plane=srf, Distance="-1", BothSides=0, Kinks=0, CapType=1)
cp = ControlPoints(Curve=offcrv)  # -> Points, Weights, Knots
cullpt = CullDuplicates(Points=cp.Points, Tolerance=0.1, CullMode=3)  # -> Points, Indices, Valence
plfit_2 = PlaneFit(Points=cullpt.Points)  # -> Plane, Deviation
ppx = PlanePlane(PlaneA=plfit.Plane, PlaneB=plfit_2.Plane)
end = EndPoints(Curve=ppx)  # -> Start, End
scale = Scale(Geometry=ppx, Center=end.Start, Factor=Slider(100, range=0..100))  # -> Geometry, Transform
crv_cp = CurveClosestPoint(Point=cullpt.Points, Curve=scale.Geometry)  # -> Point, Parameter, Distance
